# Grasshopper definition 180618_model_to_depth.gh (Grasshopper 0.9.76)
# plug-ins: Python Interpreter

# Model  To  Array
branch_1_mesh = Mesh(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)
branch_2_mesh = Mesh(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)
branch_3_mesh = Mesh(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)
branch_4_mesh = Mesh(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)
branch_5_mesh = Mesh(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)
branch_6_mesh = Mesh(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)
branch_7_mesh = Mesh(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)
branch_8_mesh = Mesh(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)
branch_9_mesh = Mesh(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)
branch_10_mesh = Mesh(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)
branch_11_mesh = Mesh(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)
branch_12_mesh = Mesh(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)
branch_13_mesh = Mesh(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)
branch_14_mesh = Mesh(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)
fake_branch_1_mesh = Mesh(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)
fake_branch_2_mesh = Mesh(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)
fake_branch_3_mesh = Mesh(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)
mesh = Mesh(fake_branch_3_mesh)
volume = Volume(Geometry=mesh)  # -> Volume, Centroid
number_slider = Slider(1000, range=0..1000)
scale = Scale(Geometry=mesh, Center=volume.Centroid, Factor=Slider(5.5, range=0..10))  # -> Geometry, Transform
number_slider_2 = Slider(0, range=0..100)
rand_x_rot = Slider(5, range=0..20)
toggle = BooleanToggle(False)
number_slider_3 = Slider(2, range=0..10)
number_slider_4 = Slider(256, range=0..1000)
number_slider_5 = Slider(2, range=0..2)

division = Division(A=number_slider_4, B=number_slider_5)
multiplication = Multiplication(A=number_slider_4, B=number_slider_3)
pt = ConstructPoint(XCoordinate=multiplication, YCoordinate=multiplication, ZCoordinate=division)
division_2 = Division(A=pt, B=2)
division_3 = Division(A=pt, B=-2)
box = Box2Pt(PointA=division_3, PointB=division_2, Plane=PlaneXY(0, 0, 0))
edges = BrepEdges(Brep=box)  # -> Naked, Interior, NonManifold

mesh_2 = Mesh(scale.Geometry)
model_to_array = PythonScript(
    mesh=mesh_2,
    z_scale=number_slider_5,
    size=number_slider_3,
    dim=number_slider_4,
    N=Slider(5, range=1..12),
    a_range=Slider(60, range=0..100),
    rand_x_rot=rand_x_rot,
    export=Button())  # -> meshes
# ---------- model_to_array: Python ----------
import rhinoscriptsyntax as rs
import os
import random

def getZ(point):
    return point[2]

def write_array_to_file(array,path,tag,index):
    filename = path+'/'+tag+'/'+str(index)+'.csv'
    file = open(filename,'w') 
    for a in array:
        txt = ''
        for item in a:
            txt = txt + str(item) + ','  
        file.write(txt +'\n')
    file.close()

def within_range(px):
    if px<5:
        print px, 'out of range'
        px = 5
    if px>250:
        print px, 'out of range'
        px = 250
    return px

a = []
b = []

meshes = []
path = os.path.join(os.path.expanduser('~'), 'Documents', 'Branch Project Igarashi Lab', 'pix2pix', 'datasets', 'depth_from_model')
dim = int(0.5+0.5*dim)
rand_x_rot = int(rand_x_rot)
deg_start = -a_range/2
deg_step = a_range/N
N = int(N)
ctr = rs.MeshVolumeCentroid(mesh)
# Iterate rotations
for n in range(N):
    #rotate mesh one step along the Y-axis
    mesh_temp = rs.RotateObject(mesh,ctr,deg_start+deg_step*n,(0,1,0),True)
    #rotate mesh a random amount along X-axis
    degx = random.randint(-rand_x_rot,rand_x_rot)
    mesh_temp = rs.RotateObject(mesh_temp,ctr,degx,(1,0,0),True)
    #move branch a random amount along the Z-axis
    #zmove = random.randint(-rand_z,rand_z)
    #rs.MoveObject(mesh_temp,(0,0,zmove))
    meshes.append(mesh_temp)
    #initate arrays to store Z-value / depth data
    zmat_top = []
    zmat_bot = []
    if export == True:
        for i in range(-dim,dim):
            temp1 = []
            temp2 = []
            for j in range(-dim,dim):
                #crete point in grid and project to mesh
                pt = rs.AddPoint(size*i,size*j,0)
                X = rs.ProjectPointToMesh(pt,mesh_temp,(0,0,1))
                if X!=None and len(X)>0:
                    # make into normal array
                    pts = []
                    for x in X: pts.append(x)
                    # sort
                    pts.sort(key=getZ)
                    top_pt = pts[-1]
                    bot_pt = pts[0]
                    # output
                    #print top_pt[2],bot_pt[2]
                    a.append(top_pt)
                    b.append(bot_pt)
                    top_px = round(z_scale*top_pt[2]+127.5,2)
                    bot_px = round(z_scale*bot_pt[2]+127.5,2)
                    top_px = within_range(top_px)
                    bot_px = within_range(bot_px)
                    temp1.append(top_px)
                    temp2.append(bot_px)
                else:
                    temp1.append(0.00)
                    temp2.append(0.00)
            zmat_top.append(temp1)
            zmat_bot.append(temp2)
        #write files (to be transformed to an image by git/branch_git/array_to_image.py n
        write_array_to_file(zmat_top,path,'Input//Array',n+1)
        write_array_to_file(zmat_bot,path,'Label//Array',n+1)
# ---------- end model_to_array ----------
number_slider_6 = Slider(256, range=0..1000)
panel = Panel(box)

pt_2 = ConstructPoint(XCoordinate=number_slider_6, YCoordinate=number_slider_6, ZCoordinate=number_slider_6)
division_4 = Division(A=pt_2, B=2)
division_5 = Division(A=pt_2, B=-2)
box_2 = Box2Pt(PointA=division_5, PointB=division_4, Plane=PlaneXY(0, 0, 0))
edges_2 = BrepEdges(Brep=box_2)  # -> Naked, Interior, NonManifold

item = ListItem(List=model_to_array, Index=Slider(4, range=0..10), Wrap=True)
python = PythonScript(n=Slider(5, range=1..14))  # -> pts_top, pts_bot; inputs n: Int32
# ---------- python: Python ----------
import rhinoscriptsyntax as rs
import os

def get_points(filename):
    pts = []
    file = open(filename,'r')
    lines = file.readlines()
    for i in range(len(lines)):
        line = lines[i].split(',')
        for j in range(len(line)):
            if line[j] == None or line[j] == '\n': continue
            z = float(line[j])-255/2
            if z<5: continue
            x = i-255/2
            y = j-255/2
            pt = rs.AddPoint(x,y,z)
            pts.append(pt)
    file.close()
    return pts

path_1 = os.path.join(os.path.expanduser('~'), 'Documents', 'Branch Project Igarashi Lab', 'pix2pix', 'datasets', 'depth_from_model', 'Input', 'Array', '')
path_2 = os.path.join(os.path.expanduser('~'), 'Documents', 'Branch Project Igarashi Lab', 'pix2pix', 'datasets', 'depth_from_model', 'Label', 'Array', '')

name_number = str(n)
filename1 = path_1+name_number+'.csv'
filename2 = path_2+name_number+'.csv'

pts_top = get_points(filename1)
pts_bot = get_points(filename2)
# ---------- end python ----------
# Image To  Model
number_slider_7 = Slider(2, range=0..10)  # disabled
number_slider_8 = Slider(255, range=0..1000)  # disabled
multiplication_2 = Multiplication(A=number_slider_8, B=number_slider_7)  # disabled
pt_3 = ConstructPoint(XCoordinate=multiplication_2, YCoordinate=multiplication_2, ZCoordinate=number_slider_8)  # disabled
panel_2 = Panel(box_2)
division_6 = Division(A=pt_3, B=-2)  # disabled
pt_4 = Point()  # disabled
panel_3 = Panel(pt_4)  # disabled
pdecon = Deconstruct(Point=pt_4)  # -> XComponent, YComponent, ZComponent; disabled
sqgrid = Square(Plane=division_6, Size=number_slider_7, ExtentX=number_slider_8, ExtentY=number_slider_8)  # -> Cells, Points; disabled
sort = SortList(Keys=pdecon.ZComponent)  # -> Keys, ValuesA; disabled
image = ImageSampler(
    sqgrid.Points,
    FilePath="C:\Users\hyoshdia\Documents\Branch Project Igarashi Lab\pix2pix\test\top.png",
    Filter="Value",
    Interpolate=False,
    Umax=256,
    Umin=1,
    Vmax=256,
    Vmin=1,
    Wrap=1)  # disabled
image_2 = ImageSampler(
    sqgrid.Points,
    FilePath="C:\Users\hyoshdia\Documents\Branch Project Igarashi Lab\pix2pix\test\back.png",
    Filter="Value",
    Interpolate=False,
    Umax=256,
    Umin=1,
    Vmax=256,
    Vmin=1,
    Wrap=1)  # disabled
rev = ReverseList(List=sort.Keys)  # disabled
panel_4 = Panel(rev)  # disabled
python_2 = PythonScript(top=image, bot=image_2, size=number_slider_3, dim=number_slider_8)  # -> top_pts, bot_pts; inputs top: tree, bot: tree; disabled
# ---------- python_2: Python ----------
import rhinoscriptsyntax as rs

print top.Branch(0)[0]
# ---------- end python_2 ----------
