# Grasshopper definition 180621_image_to_model.gh (Grasshopper 0.9.76)
# plug-ins: Python Interpreter, Volvox

number_slider = Slider(255, range=0..1000)
number_slider_2 = Slider(2, range=0..10)
multiplication = Multiplication(A=number_slider, B=number_slider_2)
pt = ConstructPoint(XCoordinate=multiplication, YCoordinate=multiplication, ZCoordinate=number_slider)
division = Division(A=pt, B=-2)
# Image To  Model
sqgrid = Square(Plane=division, Size=1, ExtentX=number_slider, ExtentY=number_slider)  # -> Cells, Points
# Input
input = ImageSampler(
    sqgrid.Points,
    FilePath="C:\Users\hyoshdia\Documents\Branch Project Igarashi Lab\pix2pix\20180620_testresult_from_unseen_branch\17-inputs.png",
    Filter="Value",
    Interpolate=False,
    Umax=256,
    Umin=1,
    Vmax=256,
    Vmin=1,
    Wrap=1)
# Output
image = ImageSampler(
    sqgrid.Points,
    FilePath="C:\Users\hyoshdia\Documents\Branch Project Igarashi Lab\pix2pix\20180620_testresult_from_unseen_branch\17-outputs.png",
    Filter="Value",
    Interpolate=False,
    Umax=256,
    Umin=1,
    Vmax=256,
    Vmin=1,
    Wrap=1)
# Target
image_2 = ImageSampler(
    sqgrid.Points,
    FilePath="C:\Users\hyoshdia\Documents\Branch Project Igarashi Lab\pix2pix\20180620_testresult_from_unseen_branch\17-targets.png",
    Filter="Value",
    Interpolate=False,
    Umax=256,
    Umin=1,
    Vmax=256,
    Vmin=1,
    Wrap=1)
# Get top and bottom
# pointclouds
python = PythonScript(top=input, bot=image, size=number_slider_2, dim=number_slider, z_scale=Slider(2, range=0..10))  # -> top_pts, bot_pts; inputs top: tree, bot: tree
# ---------- python: Python ----------
import rhinoscriptsyntax as rs

def get_points(tree):
    pts = []
    for i in range(dim):
        for j in range(dim):
            z = (255/(z_scale))*tree.Branch(i)[j]
            if z<3: continue
            px_neighbour = check_lowest_neighbor(tree,i,j)
            if px_neighbour<3: continue
            x = i*size - size*255/2
            y = j*size - size*255/2
            pt = rs.AddPoint(x,y,z)
            pts.append(pt)
    return pts

def check_lowest_neighbor(tree,i,j):
    step = 2
    if i<step or j<step or i>dim-step or j>dim-step: lowest_neighbor = 0
    else:
        neighbors = []
        for k in range(-step,step):
            for m in range(-step,step):
                z = (255/(z_scale))*tree.Branch(i+k)[j+m]
                neighbors.append(z)
        neighbors.sort()
        lowest_neighbor = neighbors[0]
    return lowest_neighbor

dim = int(dim)

top_pts = get_points(top)
bot_pts = get_points(bot)
# ---------- end python ----------
pt_2 = Point(python.bot_pts)
pt_3 = Point(python.top_pts)
number_slider_3 = Slider(2, range=0..10)
cloud = ConstructCloud(Points=pt_2)
cloud_2 = ConstructCloud(Points=pt_3)
disjoint = DisjointCloud(Cloud=cloud, VoxelSize=number_slider_3)
disjoint_2 = DisjointCloud(Cloud=cloud_2, VoxelSize=number_slider_3)
item = ListItem(List=disjoint, Index=0, Wrap=True)
item_2 = ListItem(List=disjoint_2, Index=0, Wrap=True)
mcloud = MergeClouds(Cloud=flatten([item_2, item]))
decloud = DeconstructCloud(Cloud=mcloud)  # -> Points, Normals, Colors
pt_4 = Point(decloud.Points)
