# Grasshopper definition 180622_image_to_model.gh (Grasshopper 0.9.76)
# plug-ins: Python Interpreter, Volvox

number_slider = Slider(255, range=0..1000)
# Image To Model
number_slider_2 = Slider(2, range=0..10)
multiplication = Multiplication(A=number_slider, B=number_slider_2)
pt = ConstructPoint(XCoordinate=multiplication, YCoordinate=multiplication, ZCoordinate=number_slider)
division = Division(A=pt, B=-2)
sqgrid = Square(Plane=division, Size=1, ExtentX=number_slider, ExtentY=number_slider)  # -> Cells, Points
# Input
input = ImageSampler(
    sqgrid.Points,
    FilePath="C:\Users\hyoshdia\Documents\Branch Project Igarashi Lab\pix2pix\20180620_testresult_from_unseen_branch\artificial_branches\23-inputs.png",
    Filter="Value",
    Interpolate=False,
    Umax=256,
    Umin=1,
    Vmax=256,
    Vmin=1,
    Wrap=1)
# Output
image = ImageSampler(
    sqgrid.Points,
    FilePath="C:\Users\hyoshdia\Documents\Branch Project Igarashi Lab\pix2pix\20180620_testresult_from_unseen_branch\artificial_branches\23-outputs.png",
    Filter="Value",
    Interpolate=False,
    Umax=256,
    Umin=1,
    Vmax=256,
    Vmin=1,
    Wrap=1)
# Target
image_2 = ImageSampler(
    sqgrid.Points,
    FilePath="C:\Users\hyoshdia\Documents\Branch Project Igarashi Lab\pix2pix\20180620_testresult_from_unseen_branch\artificial_branches\23-targets.png",
    Filter="Value",
    Interpolate=False,
    Umax=256,
    Umin=1,
    Vmax=256,
    Vmin=1,
    Wrap=1)
# Get top and bottom
# pointclouds
python = PythonScript(top=input, bot=image_2, size=number_slider_2, dim=number_slider, z_scale=Slider(2, range=0..10))  # -> top_P, top_N, bot_P, bot_N; inputs top: tree, bot: tree
# ---------- python: Python ----------
import rhinoscriptsyntax as rs

def get_points_and_normals(array):
    pts = []
    norms = []
    Z = rs.VectorCreate((0,0,1),(0,0,0))
    for i in range(dim):
        for j in range(dim):
            z = (255/(z_scale))*array[i][j]
            if z<3: continue
            pt = get_point(array,i,j)
            pts.append(pt)
            #normal
            #near_points = get_close_points(array,i,j,2)
            #if len(near_points)>2:
            #    plane = rs.PlaneFitFromPoints(near_points)
            #    N = plane.Normal
            #    ang = rs.VectorAngle(N,Z)
            #    if ang>90: N = rs.VectorReverse(N)
            #    norms.append(N)
            #else: norms.append(Z)
    return (pts,norms)

def get_point(array,i,j):
    z = (255/(z_scale))*array[i][j] - 255/(2*z_scale)
    x = i*size - size*255/2
    y = j*size - size*255/2
    pt = rs.AddPoint(x,y,z)
    return pt

def clean_edges(array):
    array2 = []
    for i in range(dim):
        temp = []
        for j in range(dim):
            neighbors = get_neighbors(array,i,j,1)
            neighbors.sort()
            lowest_neighbor = neighbors[0]
            if lowest_neighbor<3: temp.append(0)
            else: temp.append(array[i][j])
        array2.append(temp)
    return array2

def tree_to_array(tree):
    array = []
    for i in range(dim):
        temp = []
        for j in range(dim):
            temp.append(tree.Branch(i)[j])
        array.append(temp)
    return array

def get_neighbors(array,i,j,step):
    neighbors = []
    if i<step or j<step or i>dim-step or j>dim-step: neighbors.append(0)
    else:
        for k in range(-step,step):
            for m in range(-step,step):
                z = (255/(z_scale))*array[i+k][j+m]
                neighbors.append(z)
    return neighbors

def get_close_points(array,i,j,step):
    neighbors = []
    if i<step or j<step or i>dim-step or j>dim-step: neighbors.append(None)
    else:
        for k in range(-step,step):
            for m in range(-step,step):
                pt = get_point(array,i+k,j+m)
                neighbors.append(pt)
    return neighbors

dim = int(dim)

top = tree_to_array(top)
bot = tree_to_array(bot)

#top = clean_edges(top)
#bot = clean_edges(bot)

(top_P,top_N) = get_points_and_normals(top)
(bot_P,bot_N) = get_points_and_normals(bot)
# ---------- end python ----------
rev = Reverse(Vector=python.bot_N)
pt_2 = Point(python.bot_P)
pt_3 = Point(python.top_P)
mesh = Mesh(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)
mesh_2 = Mesh(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)
number_slider_3 = Slider(2, range=0..10)
demesh = DeconstructMesh(Mesh=mesh_2)  # -> Vertices, Faces, Colours, Normals
demesh_2 = DeconstructMesh(Mesh=mesh)  # -> Vertices, Faces, Colours, Normals
cloud = ConstructCloud(Points=pt_2, Normals=rev)
cloud_2 = ConstructCloud(Points=pt_3, Normals=python.top_N)
conmesh = ConstructMesh(Vertices=demesh.Vertices, Faces=demesh.Faces)
conmesh_2 = ConstructMesh(Vertices=demesh_2.Vertices, Faces=demesh_2.Faces)
disjoint = DisjointCloud(Cloud=cloud, VoxelSize=number_slider_3)
disjoint_2 = DisjointCloud(Cloud=cloud_2, VoxelSize=number_slider_3)
item = ListItem(List=disjoint, Index=0, Wrap=True)
item_2 = ListItem(List=disjoint_2, Index=0, Wrap=True)
mesh_3 = Mesh(conmesh_2)
mesh_4 = Mesh(conmesh)
mcloud = MergeClouds(Cloud=flatten([item_2, item]))
X = UnitX(Factor=Slider(1000, range=0..1000))
move = Move(Geometry=mesh_3, Motion=X)  # -> Geometry, Transform
move_2 = Move(Geometry=mesh_4, Motion=X)  # -> Geometry, Transform
decloud = DeconstructCloud(Cloud=mcloud)  # -> Points, Normals, Colors
preview = CustomPreview(Geometry=move_2.Geometry, Shader=ColourSwatch(SwatchColor=RGBA(0, 34, 255, 87)))
preview_2 = CustomPreview(Geometry=move.Geometry, Shader=ColourSwatch(SwatchColor=RGBA(6, 194, 0, 69)))
pt_4 = Point(decloud.Points)
