# Grasshopper definition 180726_design.gh (Grasshopper 0.9.76)
# plug-ins: Python Interpreter

genes = GenePool(Decimals=1, Maximum=1, Minimum=0, Value=[0.8, 0.2])

# ----
# GENES
genes_2 = GenePool(Decimals=1, Maximum=1, Minimum=0, Value=[0.3, 1])
min_alfa = Slider(15, range=0..20)
max_alfa = Slider(25, range=0..40)
max_scale = Slider(1, range=0..2)
min_scale = Slider(0.8, range=0..1)
item = ListItem(List=genes_2, Index="0", Wrap=True)
item_2 = ListItem(List=genes_2, Index="1", Wrap=True)
python = PythonScript(gene=item, mina=min_alfa, maxa=max_alfa)  # -> alfa
# ---------- python: Python ----------
dom = maxa-mina
alfa = mina+gene*dom
# ---------- end python ----------
python_2 = PythonScript(gene=item_2, mina=min_scale, maxa=max_scale)  # -> scale
# ---------- python_2: Python ----------
dom = maxa-mina
scale = mina+gene*dom
# ---------- end python_2 ----------

panel = Panel(python)
panel_2 = Panel(python_2)
galapagos = Galapagos(fitness=division, gene=genes_2)

# ----
# REAL
number_slider = Slider(1.5, range=0..10)
skeleton_crv = Curve([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])
X = UnitX(Factor=1)  # disabled
profile = PythonScript(C=skeleton_crv, N=X, r=number_slider, n=Slider(8, range=0..10))  # -> plane, cutwood, barkwood, a; inputs n: Int32; disabled
# ---------- profile: Python ----------
import rhinoscriptsyntax as rs
import Rhino.Geometry as rg


pts = rs.DivideCurve(C,n)
profiles = []
aa = []
bb = []
cc = []
dd = []

mid = rs.CurveMidPoint(C)
norm = N

for i in range(len(pts)):
    pt = pts[i]
    t = rs.CurveClosestPoint(C,pt)
    if i == len(pts)-1: t = rs.CurveClosestPoint(C,pts[i-1])
    tan = rs.CurveTangent(C,t)
    xvec = rs.VectorCrossProduct(norm,tan)
    xvec = rs.VectorRotate(xvec,90,tan)
    pln = rs.PlaneFromNormal(pt,-tan,xvec)
    vecY = pln.YAxis
    vecX = pln.XAxis
    rect = rs.AddRectangle(pln,2*r,2*r)
    move_vec = -r*vecX + -r*vecY
    rs.MoveObject(rect,move_vec)
    segs = rs.ExplodeCurves(rect)
    ## arc1
    st = rs.CurveStartPoint(segs[0])
    en = rs.CurveEndPoint(segs[0])
    mid = pt-1.3*r*pln.YAxis
    arc1 = rs.AddArc3Pt(st,en,mid)
    ## arc2
    st = rs.CurveStartPoint(segs[2])
    en = rs.CurveEndPoint(segs[2])
    mid = pt+1.3*r*pln.YAxis
    arc2 = rs.AddArc3Pt(st,en,mid)
    ## profile
    prof = rs.JoinCurves((arc1,segs[1],arc2,segs[3]))[0]
    profiles.append(prof)
    aa.append(segs[1])
    bb.append(segs[3])
    cc.append(arc1)
    dd.append(arc2)
    if i == int(len(pts)/2): plane = pln 


A = rs.AddLoftSrf(aa)[0]
B = rs.AddLoftSrf(bb)[0]
C = rs.AddLoftSrf(cc)[0]
D = rs.AddLoftSrf(dd)[0]

start = profiles[0]
end = profiles[-1]



A = rg.Mesh.CreateFromBrep(rs.coercebrep(A))[0]
B = rg.Mesh.CreateFromBrep(rs.coercebrep(B))[0]
C = rg.Mesh.CreateFromBrep(rs.coercebrep(C))[0]
D = rg.Mesh.CreateFromBrep(rs.coercebrep(D))[0]
param = rg.MeshingParameters()
E = rg.Mesh.CreateFromPlanarBoundary(rs.coercecurve(start),param)
F = rg.Mesh.CreateFromPlanarBoundary(rs.coercecurve(end),param)

cutwood = rg.Mesh()
cutwood.Append(A)
cutwood.Append(B)
cutwood.Append(E)
cutwood.Append(F)

barkwood = rg.Mesh()
barkwood.Append(C)
barkwood.Append(D)
# ---------- end profile ----------
swatch = ColourSwatch(SwatchColor=RGB(117, 99, 80))  # disabled
swatch_2 = ColourSwatch(SwatchColor=RGB(255, 252, 217))  # disabled
mcol = MeshColours(Mesh=profile.cutwood, Colours=swatch_2)  # -> graft(Mesh); disabled
mcol_2 = MeshColours(Mesh=profile.barkwood, Colours=swatch)  # -> graft(Mesh); disabled
mjoin = MeshJoin(Meshes=[mcol, mcol_2])  # -> flatten(Mesh); disabled

real_crv = Curve(skeleton_crv)
real_crv_2 = Curve(real_crv)

# ----
# SURFACE
small_one_srf = Surface(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)

scale = Scale(Geometry=small_one_srf, Center=Point(0, 0, 0), Factor=python_2)  # -> Geometry, Transform

srf = Surface(scale.Geometry)
ext_srf = ExtSrf(S=srf)
output_s = Surface(ext_srf)

# ----
# PATTERN
number_slider_2 = Slider(3, range=0..20)
number_slider_3 = Slider(2, range=0..20)
alfa = Slider(30, range=-40..40)
alfa_2 = Number(python)
sdiv_equi = PythonScript(S=srf, U=number_slider_2, V=number_slider_3)  # -> simplify(P); inputs S: Surface
# ---------- sdiv_equi: Python ----------
import rhinoscriptsyntax as rs
import math
import Rhino.Geometry as rg
from clr import AddReference as addr
addr("Grasshopper")
from System import Object
from Grasshopper import DataTree
from Grasshopper.Kernel.Data import GH_Path

def raggedListToDataTree(raggedList):
    rl = raggedList
    result = DataTree[object]()
    for i in range(len(rl)):
        temp = []
        for j in range(len(rl[i])):
            temp.append(rl[i][j])
        #print i, " - ",temp
        path = GH_Path(i)
        result.AddRange(temp, path)
    return result

def add_rotate_line(pt0,pt1):
    ln = rs.AddLine(pt0,pt1)
    # Rotate line around its mid point
    mid = rs.CurveMidPoint(ln)
    uv = rs.SurfaceClosestPoint(S,mid)
    axis = rs.SurfaceNormal(S,uv)
    rs.RotateObject(ln,mid,alfa,axis)
    # Extend line
    rs.ExtendCurveLength(ln,0,0,ext)
    rs.ExtendCurveLength(ln,0,1,ext)
    # Project line to surface
    # ln = rs.ProjectCurveToSurface(ln,S,axis)
    return ln


u_step = 1.00/U
v_step = 1.00/V

U = int(U)
V = int(V)

# Creat grid of points on surface
pts = []
for i in range(U+1):
    u_ = u_step * i
    temp = []
    for j in range(V+1):
        v_ = v_step * j
        (u,v) = rs.SurfaceParameter(S,(u_,v_))
        pt = rs.EvaluateSurface(S, u, v,)
        temp.append(pt)
    pts.append(temp)

# Make division equidistance
pts = zip(*pts)
for i in range(len(pts)):
    crv = rs.AddInterpCrvOnSrf(S,pts[i])
    pts[i] = rs.DivideCurve(crv,U)
    #pts[i].append(rs.CurveEndPoint(crv))
pts = zip(*pts)
for i in range(len(pts)):
    #crv = rs.AddInterpCrvOnSrf(S,pts[i])
    crv = rs.AddInterpCurve(pts[i])
    pts[i] = rs.DivideCurve(crv,V)
    #pts[i].append(rs.CurveEndPoint(crv))
pts = zip(*pts)

P = raggedListToDataTree(pts)
# ---------- end sdiv_equi ----------
sdivide = DivideSurface(Surface=srf, UCount=number_slider_2, VCount=number_slider_3)  # -> simplify(Points), Normals, Parameters
number_slider_4 = Slider(5, range=0..20)

cluster_edge_pts = ClusterEdgePts(S=output_s, P=sdiv_equi)

pattern_1 = PythonScript(S=output_s, P=cluster_edge_pts, alfa=alfa_2, dir=Slider(1, range=-1..1))  # -> L1, L2; inputs S: Surface, P: tree
# ---------- pattern_1: Python ----------
import rhinoscriptsyntax as rs
import math
import Rhino.Geometry as rg
from clr import AddReference as addr
addr("Grasshopper")
from System import Object
from Grasshopper import DataTree
from Grasshopper.Kernel.Data import GH_Path

def dataTreeToList(aTree):
    theList = []
    for i in range(aTree.BranchCount ):
        thisListPart = []
        thisBranch = aTree.Branch(i)
        for j in range(len(thisBranch)):
            thisListPart.append( thisBranch[j] )
        theList.append(thisListPart)
    return theList
    
def raggedListToDataTree(raggedList):
    rl = raggedList
    result = DataTree[object]()
    for i in range(len(rl)):
        temp = []
        for j in range(len(rl[i])):
            temp.append(rl[i][j])
        #print i, " - ",temp
        path = GH_Path(i)
        result.AddRange(temp, path)
    return result

def point_to_surface(pt):
    (u,v) = rs.SurfaceClosestPoint(S,pt)
    pt = rs.EvaluateSurface(S,u,v)
    return pt

def add_rotate_line(pt0,pt1):
    ln = rs.AddLine(pt0,pt1)
    # Rotate line around its mid point
    mid = rs.CurveMidPoint(ln)
    uv = rs.SurfaceClosestPoint(S,mid)
    axis = rs.SurfaceNormal(S,uv)
    rs.RotateObject(ln,mid,alfa,dir*axis)
    # Project line endpoints to surface
    st = point_to_surface(rs.CurveStartPoint(ln))
    en = point_to_surface(rs.CurveEndPoint(ln))
    ln = rs.AddLine(st,en)
    # ln = rs.ProjectCurveToSurface(ln,S,axis)
    # Extend line
    #rs.ExtendCurveLength(ln,0,0,ext)
    #rs.ExtendCurveLength(ln,0,1,ext)
    return ln

P = dataTreeToList(P)

# Create rotated lines along V direction
L1 = []
for i in range(1,len(P)-1):
    temp = []
    for j in range(len(P[i])-1):
        p0 = P[i][j]
        p1 = P[i][j+1]
        line = add_rotate_line(p0,p1)
        temp.append(line)
    L1.append(temp)

# Create rotated lines along U direction
L2 = []
for i in range(len(P)-1):
    temp = []
    for j in range(1,len(P[i])-1):
        p0 = P[i][j]
        p1 = P[i+1][j]
        line = add_rotate_line(p0,p1)
        temp.append(line)
    L2.append(temp)

L1 = raggedListToDataTree(L1)
L2 = raggedListToDataTree(L2)
# ---------- end pattern_1 ----------
ext_proj_lines = PythonScript(S=output_s, L1=pattern_1.L1, L2=pattern_1.L2, n=Slider(8, range=0..10))  # -> C1, C2; inputs S: list, L1: tree, L2: tree
# ---------- ext_proj_lines: Python ----------
import rhinoscriptsyntax as rs
import math
import Rhino.Geometry as rg
from clr import AddReference as addr
addr("Grasshopper")
from System import Object
from Grasshopper import DataTree
from Grasshopper.Kernel.Data import GH_Path

def dataTreeToList(aTree):
    theList = []
    for i in range(aTree.BranchCount ):
        thisListPart = []
        thisBranch = aTree.Branch(i)
        for j in range(len(thisBranch)):
            thisListPart.append( thisBranch[j] )
        theList.append(thisListPart)
    return theList
    
def raggedListToDataTree(raggedList):
    rl = raggedList
    result = DataTree[object]()
    for i in range(len(rl)):
        temp = []
        for j in range(len(rl[i])):
            temp.append(rl[i][j])
        #print i, " - ",temp
        path = GH_Path(i)
        result.AddRange(temp, path)
    return result

def curve_to_surface(crv):
    mid = rs.CurveMidPoint(crv)
    uv = rs.SurfaceClosestPoint(S[0],mid)
    norm = rs.SurfaceNormal(S[0],uv)
    pts = rs.DivideCurve(crv,n)
    for k in range(len(pts)):
        pt = pts[k]
        ppts = rs.ProjectPointToSurface(pt,S,norm)
        if ppts==None or len(ppts)==0:
            ppts = rs.ProjectPointToSurface(pt,S,-norm)
        if ppts!=None and len(ppts)>0:
            if len(ppts)==1: pt = ppts[0]
            else:
                (u,v) = rs.SurfaceClosestPoint(S[0],pt)
                cpt = rs.EvaluateSurface(S[0],u,v)
                mindist = 9999
                for ppt in ppts:
                    dist = rs.Distance(ppt,cpt)
                    if dist<mindist:
                        mindist = dist
                        pt = ppt
        else: 
            pt = None
            print "miss"
        pts[k] = pt
    pts2 = []
    for pt in pts:
        if pt!=None:
            pts2.append(pt)
    crv = rs.AddInterpCurve(pts2)
    return crv


C1 = dataTreeToList(L1)
C2 = dataTreeToList(L2)

ratio = 0.5


for i in range(len(C1)):
    for j in range(len(C1[0])):
        ln = C1[i][j]
        d = ratio*rs.CurveLength(ln)
        rs.ExtendCurveLength(ln,0,0,d)
        rs.ExtendCurveLength(ln,0,1,d)
        crv = curve_to_surface(ln)
        C1[i][j] = crv

for i in range(len(C2)):
    for j in range(len(C2[0])):
        ln = C2[i][j]
        d = ratio*rs.CurveLength(ln)
        rs.ExtendCurveLength(ln,0,0,d)
        rs.ExtendCurveLength(ln,0,1,d)
        crv = curve_to_surface(ln)
        C2[i][j] = crv

C1 = raggedListToDataTree(C1)
C2 = raggedListToDataTree(C2)
# ---------- end ext_proj_lines ----------
trim_ext_curves = PythonScript(S=output_s, C1=ext_proj_lines.C1, C2=ext_proj_lines.C2, ext=number_slider_4)  # -> C1, C2; inputs S: Surface, C1: tree, C2: tree
# ---------- trim_ext_curves: Python ----------
import rhinoscriptsyntax as rs
import math
import Rhino.Geometry as rg
from clr import AddReference as addr
addr("Grasshopper")
from System import Object
from Grasshopper import DataTree
from Grasshopper.Kernel.Data import GH_Path

def dataTreeToList(aTree):
    theList = []
    for i in range(aTree.BranchCount ):
        thisListPart = []
        thisBranch = aTree.Branch(i)
        for j in range(len(thisBranch)):
            thisListPart.append( thisBranch[j] )
        theList.append(thisListPart)
    return theList

def raggedListToDataTree(raggedList):
    rl = raggedList
    result = DataTree[object]()
    for i in range(len(rl)):
        temp = []
        for j in range(len(rl[i])):
            temp.append(rl[i][j])
        path = GH_Path(i)
        result.AddRange(temp, path)
    return result

def curve_cp(crv,pt):
    t = rs.CurveClosestPoint(crv,pt)
    pt = rs.EvaluateCurve(crv,t)
    return pt

def cut_at_boundaries(crv,boundary1,boundary2,tag):
    # Boundary 1
    t1 = rs.CurveClosestPoint(crv,rs.CurveStartPoint(crv))
    if boundary1!=None:
        X = rs.CurveCurveIntersection(crv,boundary1,10)
        if X!=None:
            X = X[0][1]
            t1 = rs.CurveClosestPoint(crv,X)
        else: 
            print "error",tag
            st = rs.CurveStartPoint(crv)
            st = curve_cp(boundary1,st)
            t1 = rs.CurveClosestPoint(crv,st)
    # Boundary 2
    t2 = rs.CurveClosestPoint(crv,rs.CurveEndPoint(crv))
    if boundary2!=None:
        X = rs.CurveCurveIntersection(crv,boundary2,10)
        if X!=None:
            X = X[0][1]
            t2 = rs.CurveClosestPoint(crv,X)
        else: 
            print "error",tag
            en = rs.CurveEndPoint(crv)
            en = curve_cp(boundary2,en)
            t2 = rs.CurveClosestPoint(crv,en)
    # Trim curve
    crv = rs.TrimCurve(crv,(t1,t2))
    return crv

C1 = dataTreeToList(C1)
C2 = dataTreeToList(C2)

C1_ = []
for crvs in C1:
    C1_.append(rs.CopyObjects(crvs))

for i in range(len(C1)):
    for j in range(len(C1[i])): 
        line = C1[i][j]
        if j==0:
            bound1 = C2[i+1][j]
            bound2 = C2[i][j] 
        elif j==len(C1[0])-1:
            bound1 = C2[i+1][j-1]
            bound2 = C2[i][j-1]
        else:
            bound1 = C2[i+1][j-1]
            bound2 = C2[i][j]
        polyline = cut_at_boundaries(line,bound1,bound2,"C1-"+str(j))
        C1[i][j] = polyline


for i in range(len(C2)):
    for j in range(len(C2[i])): 
        line = C2[i][j]
        if i==0:
            bound1 = C1_[i][j]
            bound2 = C1_[i][j+1]
        elif i==len(C2)-1:
            bound1 = C1_[i-1][j]
            bound2 = C1_[i-1][j+1]
        else:
            bound1 = C1_[i-1][j]
            bound2 = C1_[i][j+1]
        polyline = cut_at_boundaries(line,bound1,bound2,"C2-"+str(i))
        C2[i][j] = polyline

for crvs in C1:
    for crv in crvs:
        rs.ExtendCurveLength(crv,2,0,ext)
        rs.ExtendCurveLength(crv,2,1,ext)

for crvs in C2:
    for crv in crvs:
        rs.ExtendCurveLength(crv,2,0,ext)
        rs.ExtendCurveLength(crv,2,1,ext)


C1 = raggedListToDataTree(C1)
C2 = raggedListToDataTree(C2)
# ---------- end trim_ext_curves ----------

# ----
# NORMALS
curve_normals = PythonScript(S=output_s, C1=trim_ext_curves.C1, C2=trim_ext_curves.C2)  # -> M1, N1, M2, N2; inputs S: Surface, C1: tree, C2: tree
# ---------- curve_normals: Python ----------
import rhinoscriptsyntax as rs
import math
import Rhino.Geometry as rg
from clr import AddReference as addr
addr("Grasshopper")
from System import Object
from Grasshopper import DataTree
from Grasshopper.Kernel.Data import GH_Path

def dataTreeToList(aTree):
    theList = []
    for i in range(aTree.BranchCount ):
        thisListPart = []
        thisBranch = aTree.Branch(i)
        for j in range(len(thisBranch)):
            thisListPart.append( thisBranch[j] )
        theList.append(thisListPart)
    return theList

def raggedListToDataTree(raggedList):
    rl = raggedList
    result = DataTree[object]()
    for i in range(len(rl)):
        temp = []
        for j in range(len(rl[i])):
            temp.append(rl[i][j])
        path = GH_Path(i)
        result.AddRange(temp, path)
    return result

C1 = dataTreeToList(C1)
C2 = dataTreeToList(C2)

N1 = []
N2 = []
M1 = []
M2 = []

for crvs in C1:
    temp = []
    temp2 = []
    for crv in crvs:
        mid = rs.CurveMidPoint(crv)
        uv = rs.SurfaceClosestPoint(S,mid)
        norm = rs.SurfaceNormal(S,uv)
        temp.append(norm)
        temp2.append(mid)
    N1.append(temp)
    M1.append(temp2)

for crvs in C2:
    temp = []
    temp2 = []
    for crv in crvs:
        mid = rs.CurveMidPoint(crv)
        uv = rs.SurfaceClosestPoint(S,mid)
        norm = rs.SurfaceNormal(S,uv)
        temp.append(norm)
        temp2.append(mid)
    N2.append(temp)
    M2.append(temp2)

N1 = raggedListToDataTree(N1)
N2 = raggedListToDataTree(N2)

M1 = raggedListToDataTree(M1)
M2 = raggedListToDataTree(M2)
# ---------- end curve_normals ----------
number_slider_5 = Slider(10, range=0..100)
multiplication = Multiplication(A=curve_normals.N1, B=number_slider_5)
multiplication_2 = Multiplication(A=curve_normals.N2, B=number_slider_5)
vdis = VectorDisplay(Anchor=curve_normals.M2, Vector=multiplication_2)
vdis_2 = VectorDisplay(Anchor=curve_normals.M1, Vector=multiplication)

# ----
# OPTIMIZE
optimize_curves = PythonScript(C1=trim_ext_curves.C1, N1=curve_normals.N1, C2=trim_ext_curves.C2, N2=curve_normals.N2, ext=number_slider_4)  # -> C1, C2, CRVS, XPTS, XTANS, XNORMS, NORM; inputs C1: tree, N1: tree, C2: tree, N2: tree
# ---------- optimize_curves: Python ----------
import rhinoscriptsyntax as rs
import math
import Rhino.Geometry as rg
from clr import AddReference as addr
addr("Grasshopper")
from System import Object
from Grasshopper import DataTree
from Grasshopper.Kernel.Data import GH_Path

def dataTreeToList(aTree):
    theList = []
    for i in range(aTree.BranchCount ):
        thisListPart = []
        thisBranch = aTree.Branch(i)
        for j in range(len(thisBranch)):
            thisListPart.append( thisBranch[j] )
        theList.append(thisListPart)
    return theList

def raggedListToDataTree(raggedList):
    rl = raggedList
    result = DataTree[object]()
    for i in range(len(rl)):
        temp = []
        for j in range(len(rl[i])):
            temp.append(rl[i][j])
        path = GH_Path(i)
        result.AddRange(temp, path)
    return result

def get_X_and_T(crv,C,N,i,j):
    cross = C[i][j]
    norm = N[i][j]
    x = rs.CurveCurveIntersection(crv,cross,1)
    if x!=None: 
        x = x[0][1]
        t = rs.CurveClosestPoint(crv,x)
        tan = rs.CurveTangent(crv,t)
        pln = rs.PlaneFromFrame(x,norm,tan)
        tan = pln.YAxis
    else: 
        tan = None
        print "error"
    return (x,tan,norm)

def opti_crv_pts(p1,t1,p2,t2):
    mag = 0.33*rs.Distance(p1,p2)
    p1b = p1+mag*t1
    p2b = p2-mag*t2
    return (p1b,p2b)

def line_from_point(pt,vec,ray_length):
    vec = ray_length*rs.VectorUnitize(vec)
    vec1 = rs.VectorAdd(pt,vec)
    vec2 = rs.VectorAdd(pt,-vec)
    p1 = rs.AddPoint(vec1[0],vec1[1],vec1[2])
    p2 = rs.AddPoint(vec2[0],vec2[1],vec2[2])
    line = rs.AddLine(p1,p2)
    return line

def opti_edge_pt(edge_pt,prev_pt,tangent):
    dist = rs.Distance(edge_pt,prev_pt)
    line = line_from_point(prev_pt,tangent,2*dist)
    t = rs.CurveClosestPoint(line,edge_pt)
    edge_pt = rs.EvaluateCurve(line,t)
    return edge_pt
    
    
XPTS = []
XTANS = []
XNORMS = []
CRVS = []
NORM = []

C1 = dataTreeToList(C1)
C2 = dataTreeToList(C2)
N1 = dataTreeToList(N1)
N2 = dataTreeToList(N2)

for i in range(len(C1)):
    for j in range(len(C1[i])): 
        crv = C1[i][j]
        # Get intersection point and ideal tangent at each point
        xpts = []
        tans = []
        norms = []
        if j>0:
            pt1,tan1,n1 = get_X_and_T(crv,C2,N2,i+1,j-1)
            pt2,tan2,n2 = get_X_and_T(crv,C2,N2,i,j-1)
            xpts.extend((pt1,pt2))
            tans.extend((tan1,tan2))
            norms.extend((n1,n2))
        if j<len(C1[i])-1:
            pt3,tan3,n3 = get_X_and_T(crv,C2,N2,i+1,j)
            pt4,tan4,n4 = get_X_and_T(crv,C2,N2,i,j)
            xpts.extend((pt3,pt4))
            tans.extend((tan3,tan4))
            norms.extend((n3,n4))
        XPTS.append(xpts)
        XTANS.append(tans)
        XNORMS.append(norms)
        # Define point curves to create a curve from ideal tangents
        ### Update start and end points so that the edge segments are 
        ### aligned with the edge tangents
        st = rs.CurveStartPoint(crv)
        en = rs.CurveEndPoint(crv)
        st = opti_edge_pt(st,xpts[0],tans[0])
        en = opti_edge_pt(en,xpts[-1],tans[-1])
        #### Get curve points for points in between
        crv_pts = []
        crv_pts.append(st)
        for k in range(len(xpts)-1):
            crv_pts.append(xpts[k])
            opti_pts = opti_crv_pts(xpts[k],tans[k],xpts[k+1],tans[k+1])
            crv_pts.extend(opti_pts)
        crv_pts.append(xpts[-1])
        crv_pts.append(en)
        crv = rs.AddCurve(crv_pts)
        C1[i][j] = crv
        CRVS.append(crv)
        NORM.append(N1[i][j])



for i in range(len(C2)):
    for j in range(len(C2[i])): 
        crv = C2[i][j]
        # Get intersection point and ideal tangent at each point
        xpts = []
        tans = []
        norms = []
        if i>0:
            pt1,tan1,n1 = get_X_and_T(crv,C1,N1,i-1,j)
            pt2,tan2,n2 = get_X_and_T(crv,C1,N1,i-1,j+1)
            xpts.extend((pt1,pt2))
            tans.extend((tan1,tan2))
            norms.extend((n1,n2))
        if i<len(C2)-1:
            pt3,tan3,n3 = get_X_and_T(crv,C1,N1,i,j)
            pt4,tan4,n4 = get_X_and_T(crv,C1,N1,i,j+1)
            xpts.extend((pt3,pt4))
            tans.extend((tan3,tan4))
            norms.extend((n3,n4))
        XPTS.append(xpts)
        XTANS.append(tans)
        XNORMS.append(norms)
        # Define point curves to create a curve from ideal tangents
        ### Update start and end points so that the edge segments are 
        ### aligned with the edge tangents
        st = rs.CurveStartPoint(crv)
        en = rs.CurveEndPoint(crv)
        st = opti_edge_pt(st,xpts[0],tans[0])
        en = opti_edge_pt(en,xpts[-1],tans[-1])
        #### Get curve points for points in between
        crv_pts = []
        crv_pts.append(st)
        for k in range(len(xpts)-1):
            crv_pts.append(xpts[k])
            opti_pts = opti_crv_pts(xpts[k],tans[k],xpts[k+1],tans[k+1])
            crv_pts.extend(opti_pts)
        crv_pts.append(xpts[-1])
        crv_pts.append(en)
        crv = rs.AddCurve(crv_pts)
        C2[i][j] = crv
        CRVS.append(crv)
        NORM.append(N2[i][j])

C1 = raggedListToDataTree(C1)
C2 = raggedListToDataTree(C2)
XPTS = raggedListToDataTree(XPTS)
XTANS = raggedListToDataTree(XTANS)
XNORMS = raggedListToDataTree(XNORMS)
# ---------- end optimize_curves ----------
number_slider_6 = Slider(5, range=0..100)  # disabled
multiplication_3 = Multiplication(A=optimize_curves.XTANS, B=number_slider_6)  # disabled
vdis_3 = VectorDisplay(Anchor=optimize_curves.XPTS, Vector=multiplication_3)  # disabled

multiplication_4 = Multiplication(A=optimize_curves.XNORMS, B=number_slider_6)  # disabled
vdis_4 = VectorDisplay(Anchor=optimize_curves.XPTS, Vector=multiplication_4)  # disabled
merge_crv = Merge(Data1=optimize_curves.C1, Data2=optimize_curves.C2)  # -> flatten(Result); disabled

# ----
# FYI: LENGTHS
mid_pt = PythonScript(C=merge_crv)  # -> Lmin, Lmax; inputs C: list; disabled
# ---------- mid_pt: Python ----------
import rhinoscriptsyntax as rs

def getL(crv):
    L = rs.CurveLength(crv)
    return L

C = sorted(C,key=getL)

Lmin = getL(C[0])
Lmax = getL(C[-1])
# ---------- end mid_pt ----------
panel_3 = Panel([mid_pt.Lmin, mid_pt.Lmax])  # disabled

merge_n = Merge(Data1=curve_normals.N1, Data2=curve_normals.N2)  # -> flatten(Result); disabled

# ----
# RADIUS
mid_pt_2 = PythonScript(C=merge_crv)  # -> M, zmin, zmax; inputs C: list; disabled
# ---------- mid_pt_2: Python ----------
import rhinoscriptsyntax as rs

def getZ(pt):
    z = pt[2]
    return z

M = []

for crv in C:
    mid = rs.CurveMidPoint(crv)
    M.append(mid)


M2 = sorted(M,key=getZ)

zmin = getZ(M2[0])
zmax = getZ(M2[-1])
# ---------- end mid_pt_2 ----------
number_slider_7 = Slider(1.5, range=0..5)  # disabled
number_slider_8 = Slider(0, range=0..5)  # disabled
number_slider_9 = Slider(1.5, range=0..5)  # disabled
python_3 = PythonScript(
    pt=mid_pt_2.M,
    r_min=number_slider_9,
    r_max=number_slider_7,
    z_scale=number_slider_8,
    z_min=mid_pt_2.zmin,
    z_max=mid_pt_2.zmax)  # -> r; inputs pt: Point3d; disabled
# ---------- python_3: Python ----------
import rhinoscriptsyntax as rs
import random as rand

z = pt[2]

r_base = rand.uniform(r_min,r_max)

z_range = z_max-z_min
z_norm = (z-z_min)/z_range
r_z = z_scale*(1-z_norm)

r = r_base+r_z
#r = r_base
# ---------- end python_3 ----------

# ----
# SQUARE/PIPE
number_slider_10 = Slider(8, range=0..10)  # disabled
profile_2 = PythonScript(C=merge_crv, N=merge_n, r=python_3, n=number_slider_10)  # -> plane, cutwood, barkwood; inputs n: Int32; disabled
# ---------- profile_2: Python ----------
import rhinoscriptsyntax as rs
import Rhino.Geometry as rg

a = []

pts = rs.DivideCurve(C,n)
profiles = []
aa = []
bb = []
cc = []
dd = []

norm = N

for i in range(len(pts)):
    pt = pts[i]
    t = rs.CurveClosestPoint(C,pt)
    if i == len(pts)-1: t = rs.CurveClosestPoint(C,pts[i-1])
    tan = rs.CurveTangent(C,t)
    xvec = rs.VectorCrossProduct(norm,tan)
    xvec = rs.VectorRotate(xvec,90,tan)
    pln = rs.PlaneFromNormal(pt,-tan,xvec)
    vecY = pln.YAxis
    vecX = pln.XAxis
    rect = rs.AddRectangle(pln,2*r,2*r)
    move_vec = -r*vecX + -r*vecY
    rs.MoveObject(rect,move_vec)
    segs = rs.ExplodeCurves(rect)
    ## arc1
    st = rs.CurveStartPoint(segs[0])
    en = rs.CurveEndPoint(segs[0])
    mid = pt-1.3*r*pln.YAxis
    arc1 = rs.AddArc3Pt(st,en,mid)
    ## arc2
    st = rs.CurveStartPoint(segs[2])
    en = rs.CurveEndPoint(segs[2])
    mid = pt+1.3*r*pln.YAxis
    arc2 = rs.AddArc3Pt(st,en,mid)
    ## profile
    prof = rs.JoinCurves((arc1,segs[1],arc2,segs[3]))[0]
    profiles.append(prof)
    aa.append(segs[1])
    bb.append(segs[3])
    cc.append(arc1)
    dd.append(arc2)
    if i == int(len(pts)/2): plane = pln 
    a.append(pln)

A = rs.AddLoftSrf(aa)[0]
B = rs.AddLoftSrf(bb)[0]
C = rs.AddLoftSrf(cc)[0]
D = rs.AddLoftSrf(dd)[0]

start = profiles[0]
end = profiles[-1]



A = rg.Mesh.CreateFromBrep(rs.coercebrep(A))[0]
B = rg.Mesh.CreateFromBrep(rs.coercebrep(B))[0]
C = rg.Mesh.CreateFromBrep(rs.coercebrep(C))[0]
D = rg.Mesh.CreateFromBrep(rs.coercebrep(D))[0]
param = rg.MeshingParameters()
E = rg.Mesh.CreateFromPlanarBoundary(rs.coercecurve(start),param)
F = rg.Mesh.CreateFromPlanarBoundary(rs.coercecurve(end),param)

cutwood = rg.Mesh()
cutwood.Append(A)
cutwood.Append(B)
cutwood.Append(E)
cutwood.Append(F)

barkwood = rg.Mesh()
barkwood.Append(C)
barkwood.Append(D)
# ---------- end profile_2 ----------
swatch_3 = ColourSwatch(SwatchColor=RGB(117, 99, 80))  # disabled
swatch_4 = ColourSwatch(SwatchColor=RGB(255, 252, 217))  # disabled
mcol_3 = MeshColours(Mesh=profile_2.cutwood, Colours=swatch_4)  # -> graft(Mesh); disabled
mcol_4 = MeshColours(Mesh=profile_2.barkwood, Colours=swatch_3)  # -> graft(Mesh); disabled
mjoin_2 = MeshJoin(Meshes=[mcol_3, mcol_4])  # -> flatten(Mesh); disabled

xnorms_vec = Vector(simplify(optimize_curves.XNORMS))
ideal_n_vec = Vector(optimize_curves.NORM)
xpts_pt = Point(simplify(optimize_curves.XPTS))
# SELECT
ideal_crv = Curve(optimize_curves.CRVS)
match = PythonScript(IDEAL=ideal_crv, IDEAL_N=ideal_n_vec, XPTS=xpts_pt, XNORMS=xnorms_vec, REAL=real_crv)  # -> REPOS_REAL, DIFF_TOTAL; inputs IDEAL: list, IDEAL_N: list, XPTS: tree, XNORMS: tree, REAL: list
# ---------- match: Python ----------
import rhinoscriptsyntax as rs
import Rhino.Geometry as rg
from clr import AddReference as addr
addr("Grasshopper")
from System import Object
from Grasshopper import DataTree
from Grasshopper.Kernel.Data import GH_Path

def dataTreeToList(aTree):
    theList = []
    for i in range(aTree.BranchCount ):
        thisListPart = []
        thisBranch = aTree.Branch(i)
        for j in range(len(thisBranch)):
            thisListPart.append( thisBranch[j] )
        theList.append(thisListPart)
    return theList

def raggedListToDataTree(raggedList):
    rl = raggedList
    result = DataTree[object]()
    for i in range(len(rl)):
        temp = []
        for j in range(len(rl[i])):
            temp.append(rl[i][j])
        #print i, " - ",temp
        path = GH_Path(i)
        result.AddRange(temp, path)
    return result

def plane_points(pln):
    org = pln.Origin
    X = pln.XAxis
    Y = pln.YAxis
    pts = (org,org+X,org+Y)
    return pts

def crv_direction(crv):
    st = rs.CurveStartPoint(crv)
    en = rs.CurveEndPoint(crv)
    vec = rs.VectorCreate(en,st)
    vec = rs.VectorUnitize(vec)
    return vec

def crv_mid(crv):
    pts = rs.DivideCurve(crv,2)
    n = len(pts)
    sum_pt = rs.AddPoint(0,0,0)
    x = 0
    y = 0
    z = 0
    for pt in pts: 
        x = x+pt[0]
        y = y+pt[1]
        z = z+pt[2]
    x = x/n
    y = y/n
    z = z/n
    pt = rs.AddPoint(x,y,z)
    return pt

def get2pts(pts,crv):
    if len(pts)==2:
        pts2 = pts
    elif len(pts)==4:
        p0 = 0.5*rs.PointAdd(pts[0],pts[1])
        t = rs.CurveClosestPoint(crv,p0)
        p0 = rs.EvaluateCurve(crv,t)
        p1 = 0.5*rs.PointAdd(pts[2],pts[3])
        t = rs.CurveClosestPoint(crv,p1)
        p1 = rs.EvaluateCurve(crv,t)
        pts2 = [p0,p1]
    else:
        pts2 = None
        print "error"
    return pts2

def get_norm_params(crv,pts):
    T = []
    for pt in pts:
        t = rs.CurveClosestPoint(crv,pt)
        t = rs.CurveNormalizedParameter(crv,t)
        T.append(t)
    return(T)

def get_points_from_norm_params(crv,norm_ts):
    pts = []
    st = rs.CurveStartPoint(crv)
    en = rs.CurveEndPoint(crv)
    t_start = rs.CurveClosestPoint(crv,st)
    t_end = rs.CurveClosestPoint(crv,en)
    t_range = t_end-t_start
    for norm_t in norm_ts:
        t = t_start + t_range * norm_t
        pt = rs.EvaluateCurve(crv,t)
        pts.append(pt)
    return pts

def curve_difference(real,ideal,xpts,xnorms):
    diff_general = curve_general_difference(real,ideal)
    diff_joint_dist = curve_joint_dist_difference(real,ideal,xpts)
    diff_joint_ang = curve_joint_ang_difference(real,ideal,xpts,xnorms)
    diff = round((diff_general + diff_joint_dist + diff_joint_ang),3)
    return diff

def curve_joint_ang_difference(real,ideal,xpts,xnorms):
    for xpt,xnorm in zip(xpts,xnorms):
        pln = rs.PlaneFromNormal(xpt,xnorm)
        t = rs.CurveClosestPoint(real,xpt)
        tan = rs.CurveTangent(real,t)
        tan_pt = rs.PointAdd(xpt,rs.AddPoint(tan[0],tan[1],tan[2]))
        tan_ppt = rs.PlaneClosestPoint(pln,tan_pt)
        vec1 = rs.VectorCreate(xpt,tan_pt)
        vec2 = rs.VectorCreate(xpt,tan_ppt)
        diff = rs.VectorAngle(vec1,vec2)
    return diff

def curve_general_difference(real,ideal):
    n = 2
    pts = rs.DivideCurve(ideal,n)
    sum = 0
    for pt in pts:
        t = rs.CurveClosestPoint(real,pt)
        pt2 = rs.EvaluateCurve(real,t)
        dist = rs.Distance(pt,pt2)
        sum = sum+dist
    average_diff = sum/len(pts)
    return average_diff

def curve_joint_dist_difference(crv1,crv2,pts2):
    sum = 0
    for pt2 in pts2:
        t = rs.CurveClosestPoint(crv1,pt2)
        pt1 = rs.EvaluateCurve(crv1,t)
        dist = rs.Distance(pt1,pt2)
        sum = sum+dist
    average_diff = sum/len(pts2)
    return average_diff

def reposition_vec(real,pts2_ideal,ts2_ideal):
    pts2 = get_points_from_norm_params(real,ts2_ideal)
    dist1 = rs.Distance(pts2_ideal[0],pts2[0])
    dist2 = rs.Distance(pts2_ideal[0],pts2[0])
    if dist2<dist1: pts2.reverse()
    vec1 = rs.VectorCreate(pts2_ideal[0],pts2[0])
    vec2 = rs.VectorCreate(pts2_ideal[1],pts2[1])
    vec = 0.25*(vec1+vec2)
    return vec

XPTS = dataTreeToList(XPTS)
XNORMS = dataTreeToList(XNORMS)

### Initialize output lists
REPOS_REAL = []
DIFF_TOTAL = []

for i in range(len(IDEAL)):
    ideal = IDEAL[i]
    norm_ideal = IDEAL_N[i]
    xpts = XPTS[i]
    xnorms = XNORMS[i]
    #
    ### Extract properties of ideal curve
    #
    pts2_ideal = get2pts(xpts,ideal)
    dir_ideal = rs.VectorCreate(pts2_ideal[1],pts2_ideal[0])
    ctr_ideal = 0.5*rs.PointAdd(pts2_ideal[1],pts2_ideal[0])
    pln_ideal = rs.PlaneFromNormal(ctr_ideal,norm_ideal,dir_ideal)
    ts2_ideal = get_norm_params(ideal,pts2_ideal)
    length_ideal = rs.CurveLength(ideal)
    #
    ### Initiate temporary lists
    #
    repos_real = []
    diff_joint_ang = []
    diff_joint_dist = []
    diff_dist = []
    diff_total = []
    #
    ### Iterate real curves
    #
    for j in range(len(REAL)):
        real = rs.CopyObject(REAL[j])
        #
        # 1) Curve length
        #
        ### a) Obit real curve if it is shorter than the ideal one
        length = rs.CurveLength(real)
        if length < length_ideal: 
            repos_real.append(None)
            diff_joint_ang.append(None)
            diff_joint_dist.append(None)
            diff_dist.append(None)
            diff_total.append(99)
            continue
        ### b) Trim curve to match length of ideal curve
        trim_length = 0.5*(length - length_ideal)
        rs.ExtendCurveLength(real,0,0,-trim_length)
        rs.ExtendCurveLength(real,0,1,-trim_length)
        #
        # 2) Position the real curve with ideal one
        #
        ### a) Get corresponding xpts on real curve
        pts2 = get_points_from_norm_params(real,ts2_ideal)
        dir = rs.VectorCreate(pts2[1],pts2[0])
        ctr = 0.5*rs.PointAdd(pts2[1],pts2[0])
        ### b) Orient by reference plane (real) and target plane (ideal)
        ref_pln = rs.PlaneFromFrame(ctr,dir,(0,0,1))
        rs.OrientObject(real,plane_points(ref_pln),plane_points(pln_ideal))
        ### c) Try all 4 posibile real branch positions and pick the one most similar to the ideal branch
        real_b = rs.RotateObject(real,ctr_ideal,180, axis=pln_ideal.Normal,copy=True)
        real_2 = rs.RotateObject(real,ctr_ideal,180, axis=pln_ideal.YAxis,copy=True)
        real_2_b = rs.RotateObject(real_2,ctr_ideal,180, axis=pln_ideal.Normal,copy=True)
        reals = [real,real_b,real_2,real_2_b]
        diffs = []
        for k in range(len(reals)):
            diff = curve_difference(reals[k],ideal,xpts,xnorms)
            vec = reposition_vec(reals[k],pts2_ideal,ts2_ideal)
            rs.MoveObject(reals[k],vec)
            diffs.append(diff)
        reals = [x for _,x in sorted(zip(diffs,reals))]
        real = reals[0]
        repos_real.append(real)
        #
        # 3. Calculate differences and append final lists
        #
        #diff_joint_ang.append(curve_joint_ang_difference(real,ideal,xpts,xnorms))
        #diff_joint_dist.append(curve_joint_dist_difference(real,ideal,xpts))
        #diff_dist.append(curve_general_difference(real,ideal))
        diff_total.append(curve_difference(real,ideal,xpts,xnorms))
    REPOS_REAL.append(repos_real)
    DIFF_TOTAL.append(diff_total)

REPOS_REAL = raggedListToDataTree(REPOS_REAL)
DIFF_TOTAL = raggedListToDataTree(DIFF_TOTAL)
# ---------- end match ----------
repos_real = Panel(match.REPOS_REAL)
diff_total = Panel(match.DIFF_TOTAL)
cut_mesh = Mesh(flatten(profile_2.cutwood))  # disabled
bark_mesh = Mesh(flatten(profile_2.barkwood))  # disabled
assignment = PythonScript(DIFF_TOTAL=match.DIFF_TOTAL)  # -> indices; inputs DIFF_TOTAL: tree
# ---------- assignment: Python ----------
import rhinoscriptsyntax as rs
import Rhino.Geometry as rg
import rhinoscriptsyntax as rs
import Rhino.Geometry as rg
from clr import AddReference as addr
addr("Grasshopper")
from System import Object
from Grasshopper import DataTree
from Grasshopper.Kernel.Data import GH_Path


def get_maximum_assignements(list):
    ind = [None] * len(list)          # Create an initial list of "Nons"
    for i in range(len(list)):        # Browse list of possible column matches (list_of_zeros)
        for j in range(len(list[i])): # Brows possible column matches for each row
            item = list[i][j]
            if already_exists(ind,item)==False: # Check if item already exists in list if assigned column indexes
                ind[i] = item                   # If it doesnt, assign this posibility to the row
                break                           # And break
        if ind[i] == None:                  # If no match was found yet for this row
            for j in range(len(list[i])):   # Browse possibilities again
                item = list[i][j]           
                (ind,free) = try_reassigning(ind,[item],list,0) # Try to geassign the possibility where it already exists in the list
                if free == True:            # If reassignment was successfull, 
                    ind[i] = item           # assign possibility to the current row
                    break                   # and break
    return ind  # return list of assigned columns

def try_reassigning(ass_list,visited_col_indexes,poss_list,n): 
    if n>len(ass_list):                     # If n is higher than "safetly limit" for recusion function, 
        print "Ended early"     # 
        return (ass_list,False) # return that reassignment was unsuccessful (false)
    else:
        col_index = visited_col_indexes[-1]               # The index we are looking at currently is the last one added to the list of visited indexes
        other_row = get_index_in_list(ass_list,col_index) # Find the row of the column index you are trying to free up
        other_row_poss_list = poss_list[other_row]        # Get the list of possibilities for this row
        if len(other_row_poss_list)<=1:                   # If the possibilities are just one, it is impossible to reassign
            #print "Ended because ran into list of just one possibility"   
            return (ass_list,False)                       # return that reassignment was unsuccessful (false)
        else:           # Else we have a list of several possibilities, so we can try other ones
            n = n+1     # Add value to your safety number, so that you wont go in endless loops
            success = False
            for poss in other_row_poss_list:             # The possibilities for this row
                if poss==col_index: continue             # If it is same as the one already assigned, move on immediately
                if already_exists(ass_list,poss)==False: # Check if the possibility already exists elsewhere among assignments
                    ass_list[other_row] = poss           # If not, reassign!
                    #print "Reassignment success!!!!!!!!!!!!!!!!!!!!!!!!!!!!!!!!!!!!!!!!!!!!!!!!!!!!!!!!!!!"
                    success = True                       # Recoded that reassignemnt was successful
                    break                                # And exit loop
            if success == False:                                    # If reassignment still wasn't successful...
                for poss in other_row_poss_list:                    # Browse the possibilities again
                    if poss==col_index: continue                    # If it is same as the one already assigned, move on immediately               
                    #print "***Doing a recursion***"                 # Do a recusstion, trying to reassign the value to freeup the one you are trying to reassign
                    if already_exists(visited_col_indexes,poss)==False: # Avoid looping in recursion
                        visited_col_indexes.append(poss)
                        (ass_list,success) = try_reassigning(ass_list,visited_col_indexes,poss_list,n)
                        if success == True:                             # If this reassignment is successful
                            #print "***Did a successful recursion***"          
                            ass_list[other_row] = poss                  # Assign the new possibility to the other row 
                            break                                       # Exit loop
                    #else: 
                    #    print "Didnt continue recursion because of loop"
            return (ass_list,success)                               # Return (possibly) updated assignment list and weather or not the operation was successful

def dataTreeToList(aTree):
    theList = []
    for i in range(aTree.BranchCount ):
        thisListPart = []
        thisBranch = aTree.Branch(i)
        for j in range(len(thisBranch)):
            thisListPart.append( thisBranch[j] )
        theList.append(thisListPart)
    return theList

def get_list_of_all_zeros(matrix):
    zeros = [None] * len(matrix)
    for i in range(len(matrix)):
        row_zeros = []
        for j in range(len(matrix[i])):
            if matrix[i][j]==0.00:
                row_zeros.append(j)
        zeros[i] = row_zeros
    return zeros

def get_unssigned_rows(list):
    non_items = []
    for i in range(len(list)):
        if list[i]==None:
            non_items.append(i)
    return non_items

def invert_mark(list,list_length):
    unmarked = []
    for i in range(list_length):
        marked = False
        for mark in list:
            if i==mark:
                marked = True
                break
        if marked == False:
            unmarked.append(i)
    return unmarked

def already_exists(list,item):
    exists = False
    for item2 in list:
        if item == item2:
            exists = True
            break
    return exists

def get_index_in_list(list,value):
    index = None
    for i in range(len(list)):
        if list[i]==value: index = i
    return index

def make_square(matrix):
    row_no = len(matrix)
    col_no = len(matrix[0])
    # Add rows if number of columns is greater than number of rows
    if row_no<col_no:
        zero_row = []
        add_no = col_no-row_no
        for i in range(col_no): zero_row.append(0)
        for i in range(add_no): matrix.append(zero_row)
    # Make matrix square by adding dummy zeros
    # Add columns if number of columns is smaller than number of rows
    if row_no>col_no:
        zero_col = []
        add_no = row_no-col_no
        for i in range(len(matrix)):
            for j in range(add_no): 
                matrix[i].append(0)
    return matrix

mat = dataTreeToList(DIFF_TOTAL)

# Make matrix square by adding dummy zeros
# Store original size in order to revert to it at the end
org_row_no = len(mat)
org_col_no = len(mat[0])
mat = make_square(mat)
print "Size",len(mat),len(mat[0])

### Make integer (for faster calculation) ###
for i in range(len(mat)):
    for j in range(len(mat[i])):
        mat[i][j] = int(10*mat[i][j]+0.5)
#print "Start matrix", mat

### Subtract minimum value in each row (should result in at least one 0 in each row) ###
for i in range(len(mat)):
    min_value = sorted(mat[i])[0]
    for j in range(len(mat[i])): mat[i][j] = mat[i][j]-min_value

### Subtract minimum value in each col (should result in at least one 0 in each col) ###
for j in range(len(mat[0])):
    temp = []
    for i in range(len(mat)):
        temp.append(mat[i][j])
    min_value = sorted(temp)[0]
    if min_value==0: continue
    for i in range(len(mat)):
        mat[i][j] = mat[i][j]-min_value
#print "Matrix after initial subtractions", mat

for iterantion0 in range(len(mat)*len(mat[0])):
    print " - - - - - - - - - - I T E R A T I O N   ",iterantion0,"    - - - - - - - - - - "
    #
    ### Try to assign one column to each row ###
    #
    zeros_list = get_list_of_all_zeros(mat)
    #print "Zeros", zeros_list
    indices = get_maximum_assignements(zeros_list)
    print "Indices:",indices
    unass = get_unssigned_rows(indices)
    # 
    ### Break if there are no unassigned columns ###
    #
    if len(unass)==0:
        print "Done!"
        break
    ### Mark rows and columns ###
    #
    #1. Tick all unassigned rows
    #
    marked_rows = unass
    marked_columns = []
    for mark_iteration in range(len(mat)):
        #
        # 2. Tick all (unticked) columns that have zeros in ticked rows
        #
        start_len_cols = len(marked_columns)
        for row_index in marked_rows:
            #find zeros in this row
            for j in range(len(mat[0])):
                if mat[row_index][j]==0:
                    # Check that it is not already added to marked columns
                    new = True
                    for mark in marked_columns:
                        if mark==j:
                            new = False
                            break
                    if new == True: marked_columns.append(j)
        marked_columns = sorted(marked_columns)
        #print "Marked cols at",mark_iteration,"are",marked_columns
        #
        # 3. Tick all (unticked) rows that have assigned zeros in ticked columns
        #
        start_len_rows = len(marked_rows)
        for col_index in marked_columns:
            # Find zeros in the column
            for i in range(len(indices)):
                index = indices[i]
                if col_index == index:
                    new = True
                    for mark in marked_rows:
                        if mark == i:
                            new = False
                            break
                    if new==True: marked_rows.append(i)
        marked_rows = sorted(marked_rows)
        #print "Marked rows at",mark_iteration,"are",marked_rows
        # Break if no items were added to columns or rows at this iteration
        if start_len_rows==len(marked_rows) and start_len_cols==len(marked_columns):
            print "Marking done at iteration:", mark_iteration
            break
    marked_rows = invert_mark(marked_rows,len(mat))
    print "Marked rows", marked_rows
    print "Marked colmuns", marked_columns
    #
    ### Find the smallest value in unmarked columns and unmarked rows ###
    #
    unmarked_items = []
    for i in range(len(mat)):
        marked = False
        for mark in marked_rows:
            if i == mark:
                marked = True
                break
        if marked == True: continue
        for j in range(len(mat[i])):
            marked = False
            for mark in marked_columns:
                if j == mark:
                    marked = True
                    break
            if marked == True: continue
            unmarked_items.append(mat[i][j])
    if len(unmarked_items)==0: 
        print "***Break because all items are marked"
        break
    lowest_value = min(unmarked_items)
    print "Lowest value:", lowest_value
    if lowest_value == 0: 
        print "****Break because lowest_value was zero"
        break
    #
    ### Subtract the lowest value from all unmarked elements ###
    ### and add it to all double-marked elements             ###
    #
    for i in range(len(mat)):
        #check for marked row
        marked_row = False
        for mark in marked_rows:
            if i == mark:
                marked_row = True
        for j in range(len(mat[i])):
            marked_col = False
            for mark in marked_columns:
                if j == mark:
                    marked_col = True
            if marked_row==False and marked_col==False:
                mat[i][j] = mat[i][j]-lowest_value
            elif marked_row==True and marked_col==True:
                mat[i][j] = mat[i][j]+lowest_value
    #print "New mat",mat


### Remove padded part of matrix ###
#
# 1. Remove rows if number of initial rows were smaller
#
if org_row_no<len(mat):
    for i in range(len(mat)-org_row_no):
        indices.pop()
#
# Or 2. Remove columns if number of initial columns was smaller
#
if org_col_no<len(mat[0]):
    for i in range(len(indices)):
        if indices[i]>=org_col_no:
            indices[i]=None

#Finally print result!
print "Result:",indices
# ---------- end assignment ----------

# ----
# BRANCHES
xz = XZPlane(Origin=Point(0, 0, 0))  # disabled
number_slider_11 = Slider(81, range=0..100)  # disabled
number_slider_12 = Slider(12, range=0..20)  # disabled
number_slider_13 = Slider(43, range=20..70)  # disabled
orient = Orient(Geometry=mjoin_2, Source=profile_2.plane, Target=xz)  # -> Geometry, Transform; disabled
orient_2 = Orient(Geometry=mjoin_2, Source=profile_2.plane, Target=xz)  # -> Geometry, Transform; disabled
python_4 = PythonScript(G=orient.Geometry, n=number_slider_13, d=number_slider_12, d2=number_slider_11)  # -> G; inputs G: list; disabled
# ---------- python_4: Python ----------
import rhinoscriptsyntax as rs

G2 = []

for i in range(len(G)):
    geo = G[i]
    j = i//n
    i = i%n
    vec = (d*i,-d2*j,0)
    rs.MoveObject(geo,vec)
# ---------- end python_4 ----------
python_5 = PythonScript(G=orient_2.Geometry, n=number_slider_13, d=number_slider_12, d2=number_slider_11)  # -> G; inputs G: list; disabled; same code as python_4

pick = PythonScript(REPOS_REAL=match.DIFF_TOTAL, indices=assignment)  # -> REAL; inputs REPOS_REAL: tree, indices: list
# ---------- pick: Python ----------
import rhinoscriptsyntax as rs
import Rhino.Geometry as rg
from clr import AddReference as addr
addr("Grasshopper")
from System import Object
from Grasshopper import DataTree
from Grasshopper.Kernel.Data import GH_Path

def dataTreeToList(aTree):
    theList = []
    for i in range(aTree.BranchCount ):
        thisListPart = []
        thisBranch = aTree.Branch(i)
        for j in range(len(thisBranch)):
            thisListPart.append( thisBranch[j] )
        theList.append(thisListPart)
    return theList
    
REAL = dataTreeToList(REPOS_REAL)
picked = []

for reals,index in zip(REAL,indices):
    if index==None: continue
    picked.append(reals[index])

REAL = picked
# ---------- end pick ----------
panel_4 = Panel(assignment)
test = PythonScript(I=assignment)  # -> SAME, sames, NONS; inputs I: list
# ---------- test: Python ----------
SAME = False
NONS = False
sames = []
for i in range(len(I)):
    for j in range(len(I)):
        if i==j: continue
        if I[i]==None or I[j]==None: 
            NONS = True
            continue
        if I[i]==I[j]: 
            SAME=True
            sames.append(I[i])
print SAME
# ---------- end test ----------
ma = MassAddition(Input=pick)  # -> Result, PartialResults
lng = ListLength(List=ma.PartialResults)
panel_5 = Panel(test.SAME)  # disabled
panel_6 = Panel(test.sames)  # disabled
panel_7 = Panel(test.NONS)  # disabled
division = Division(A=ma.Result, B=lng)
cut_mesh_2 = Mesh(flatten(python_4))  # disabled
cut_mesh_3 = Mesh(flatten(python_5))  # disabled

pick_2 = PythonScript(REPOS_REAL=match.REPOS_REAL, indices=assignment)  # -> REAL; inputs REPOS_REAL: tree, indices: list
# ---------- pick_2: Python ----------
import rhinoscriptsyntax as rs
import Rhino.Geometry as rg
from clr import AddReference as addr
addr("Grasshopper")
from System import Object
from Grasshopper import DataTree
from Grasshopper.Kernel.Data import GH_Path

def dataTreeToList(aTree):
    theList = []
    for i in range(aTree.BranchCount ):
        thisListPart = []
        thisBranch = aTree.Branch(i)
        for j in range(len(thisBranch)):
            thisListPart.append( thisBranch[j] )
        theList.append(thisListPart)
    return theList
    
REAL = dataTreeToList(REPOS_REAL)
picked = []

for reals,index in zip(REAL,indices):
    if index == None:
        picked.append(None)
    else:
        picked.append(reals[index])

REAL = picked
# ---------- end pick_2 ----------
profile_3 = PythonScript(C=pick_2, N=ideal_n_vec, r=Slider(1.5, range=0..10), n=Slider(8, range=0..10))  # -> plane, cutwood, barkwood; inputs n: Int32
# ---------- profile_3: Python ----------
import rhinoscriptsyntax as rs
import Rhino.Geometry as rg

a = []

if C != None: 
    pts = rs.DivideCurve(C,n)
    profiles = []
    aa = []
    bb = []
    cc = []
    dd = []
    
    norm = N
    
    for i in range(len(pts)):
        pt = pts[i]
        t = rs.CurveClosestPoint(C,pt)
        if i == len(pts)-1: t = rs.CurveClosestPoint(C,pts[i-1])
        tan = rs.CurveTangent(C,t)
        xvec = rs.VectorCrossProduct(norm,tan)
        xvec = rs.VectorRotate(xvec,90,tan)
        pln = rs.PlaneFromNormal(pt,-tan,xvec)
        vecY = pln.YAxis
        vecX = pln.XAxis
        rect = rs.AddRectangle(pln,2*r,2*r)
        move_vec = -r*vecX + -r*vecY
        rs.MoveObject(rect,move_vec)
        segs = rs.ExplodeCurves(rect)
        ## arc1
        st = rs.CurveStartPoint(segs[0])
        en = rs.CurveEndPoint(segs[0])
        mid = pt-1.3*r*pln.YAxis
        arc1 = rs.AddArc3Pt(st,en,mid)
        ## arc2
        st = rs.CurveStartPoint(segs[2])
        en = rs.CurveEndPoint(segs[2])
        mid = pt+1.3*r*pln.YAxis
        arc2 = rs.AddArc3Pt(st,en,mid)
        ## profile
        prof = rs.JoinCurves((arc1,segs[1],arc2,segs[3]))[0]
        profiles.append(prof)
        aa.append(segs[1])
        bb.append(segs[3])
        cc.append(arc1)
        dd.append(arc2)
        if i == int(len(pts)/2): plane = pln 
        a.append(pln)
    
    A = rs.AddLoftSrf(aa)[0]
    B = rs.AddLoftSrf(bb)[0]
    C = rs.AddLoftSrf(cc)[0]
    D = rs.AddLoftSrf(dd)[0]
    
    start = profiles[0]
    end = profiles[-1]
    
    
    
    A = rg.Mesh.CreateFromBrep(rs.coercebrep(A))[0]
    B = rg.Mesh.CreateFromBrep(rs.coercebrep(B))[0]
    C = rg.Mesh.CreateFromBrep(rs.coercebrep(C))[0]
    D = rg.Mesh.CreateFromBrep(rs.coercebrep(D))[0]
    param = rg.MeshingParameters()
    E = rg.Mesh.CreateFromPlanarBoundary(rs.coercecurve(start),param)
    F = rg.Mesh.CreateFromPlanarBoundary(rs.coercecurve(end),param)
    
    cutwood = rg.Mesh()
    cutwood.Append(A)
    cutwood.Append(B)
    cutwood.Append(E)
    cutwood.Append(F)
    
    barkwood = rg.Mesh()
    barkwood.Append(C)
    barkwood.Append(D)
# ---------- end profile_3 ----------
mcol_5 = MeshColours(Mesh=profile_3.cutwood, Colours=ColourSwatch(SwatchColor=RGB(255, 234, 0)))  # -> graft(Mesh)
mcol_6 = MeshColours(Mesh=profile_3.barkwood, Colours=ColourSwatch(SwatchColor=RGB(255, 132, 0)))  # -> graft(Mesh)
mjoin_3 = MeshJoin(Meshes=[mcol_5, mcol_6])  # -> flatten(Mesh)

item_3 = ListItem(List=real_crv_2, Index=assignment, Wrap=True)
X_2 = UnitX(Factor=1)
profile_4 = PythonScript(C=item_3, N=X_2, r=Slider(1.5, range=0..10), n=Slider(8, range=0..10))  # -> plane, cutwood, barkwood; inputs n: Int32; same code as profile_2
mcol_7 = MeshColours(Mesh=profile_4.cutwood, Colours=ColourSwatch(SwatchColor=RGB(255, 234, 0)))  # -> graft(Mesh)
mcol_8 = MeshColours(Mesh=profile_4.barkwood, Colours=ColourSwatch(SwatchColor=RGB(255, 132, 0)))  # -> graft(Mesh)
mjoin_4 = MeshJoin(Meshes=[mcol_7, mcol_8])  # -> flatten(Mesh)

panel_8 = Panel(division)

# ==== cluster ExtSrf
number_slider = Slider(200, range=0..200)
number_slider_2 = Slider(1, range=0..1)
number_slider_3 = Slider(200, range=0..200)
number_slider_4 = Slider(50, range=0..100)
S = ClusterInput()
divide_s = PythonScript(S=S, U=number_slider_4, V=number_slider_4)  # -> simplify(pts); inputs S: Surface
# ---------- divide_s: Python ----------
import rhinoscriptsyntax as rs

import Rhino.Geometry as rg
from clr import AddReference as addr
addr("Grasshopper")

from System import Object
from Grasshopper import DataTree
from Grasshopper.Kernel.Data import GH_Path


def raggedListToDataTree(raggedList):
    rl = raggedList
    result = DataTree[object]()
    for i in range(len(rl)):
        temp = []
        for j in range(len(rl[i])):
            temp.append(rl[i][j])
        #print i, " - ",temp
        path = GH_Path(i)
        result.AddRange(temp, path)
    return result



u_step = 1.00/U
v_step = 1.00/V

U = int(U)
V = int(V)

# Creat grid of points on surface
pts = []
for i in range(U+1):
    u_ = u_step * i
    temp = []
    for j in range(V+1):
        v_ = v_step * j
        (u,v) = rs.SurfaceParameter(S,(u_,v_))
        pt = rs.EvaluateSurface(S, u, v,)
        temp.append(pt)
    pts.append(temp)

# Make division equidistance
pts = zip(*pts)
for i in range(len(pts)):
    crv = rs.AddInterpCrvOnSrf(S,pts[i])
    pts[i] = rs.DivideCurve(crv,U)
    pts[i].append(rs.CurveEndPoint(crv))
pts = zip(*pts)
for i in range(len(pts)):
    crv = rs.AddInterpCrvOnSrf(S,pts[i])
    pts[i] = rs.DivideCurve(crv,V)
    pts[i].append(rs.CurveEndPoint(crv))


pts = raggedListToDataTree(pts)
# ---------- end divide_s ----------
nurbs = NurbsCurve(Vertices=divide_s, Degree=3, Periodic=False)  # -> flatten(Curve), Length, Domain
ext = ExtendCurve(Curve=nurbs.Curve, Type=0, Start=number_slider, End=number_slider)  # -> flatten(Curve)
divide = DivideCurve(Curve=ext, Count=number_slider_4, Kinks=False)  # -> Points, Tangents, Parameters
flip = FlipMatrix(Data=divide.Points)
nurbs_2 = NurbsCurve(Vertices=flip, Degree=3, Periodic=False)  # -> flatten(Curve), Length, Domain
ext_2 = ExtendCurve(Curve=nurbs_2.Curve, Type=0, Start=number_slider_3, End=number_slider_3)  # -> flatten(Curve)
divide_2 = DivideCurve(Curve=ext_2, Count=number_slider_4, Kinks=False)  # -> Points, Tangents, Parameters
nurbs_3 = NurbsCurve(Vertices=divide_2.Points, Degree=3, Periodic=False)  # -> flatten(Curve), Length, Domain
loft = Loft(Curves=nurbs_3.Curve, Options={Adjust=False, Closed=False, LoftEnds=0, LoftSimp=0, LoftType=0, Rebuild=10, Refit=0.01})
L = ClusterOutput(loft)

# ==== cluster ClusterEdgePts
S = ClusterInput()
P = ClusterInput()
number_slider = Slider(1, range=0..1)
edgepts = PythonScript(S=S, P=P, d=number_slider)  # -> P; inputs S: Surface, P: tree
# ---------- edgepts: Python ----------
import rhinoscriptsyntax as rs
import math
import Rhino.Geometry as rg
from clr import AddReference as addr
addr("Grasshopper")
from System import Object
from Grasshopper import DataTree
from Grasshopper.Kernel.Data import GH_Path

def dataTreeToList(aTree):
    theList = []
    for i in range(aTree.BranchCount ):
        thisListPart = []
        thisBranch = aTree.Branch(i)
        for j in range(len(thisBranch)):
            thisListPart.append( thisBranch[j] )
        theList.append(thisListPart)
    return theList
    
def raggedListToDataTree(raggedList):
    rl = raggedList
    result = DataTree[object]()
    for i in range(len(rl)):
        temp = []
        for j in range(len(rl[i])):
            temp.append(rl[i][j])
        #print i, " - ",temp
        path = GH_Path(i)
        result.AddRange(temp, path)
    return result

def point_to_surface(pt):
    (u,v) = rs.SurfaceClosestPoint(S,pt)
    pt = rs.EvaluateSurface(S,u,v)
    return pt

P = dataTreeToList(P)

for i in range(len(P)):
    p0 = P[i][0]
    p1 = P[i][1]
    vec = d*rs.VectorCreate(p0,p1)
    p_new = rs.VectorAdd(p0,vec)
    p_new = rs.AddPoint(p_new[0],p_new[1],p_new[2])
    P[i].insert(0,p_new)

for i in range(len(P)):
    p0 = P[i][-1]
    p1 = P[i][-2]
    vec = d*rs.VectorCreate(p0,p1)
    p_new = rs.VectorAdd(p0,vec)
    p_new = rs.AddPoint(p_new[0],p_new[1],p_new[2])
    P[i].append(p_new)



P = raggedListToDataTree(P)
# ---------- end edgepts ----------
flip = FlipMatrix(Data=edgepts)
edgepts_2 = PythonScript(P=flip, d=number_slider)  # -> P; inputs P: tree; same code as edgepts
flip_2 = FlipMatrix(Data=edgepts_2)
D = ClusterOutput(flip_2)
