# Grasshopper definition 181214_fab_des.gh (Grasshopper 0.9.76)
# plug-ins: Python Interpreter, BranchConnect

# ----
# MATCHING
crv = Curve([<curve referenced from the Rhino model> x3])
crv_2 = Curve([<curve referenced from the Rhino model> x3])
loft = Loft(Curves=crv, Options={Adjust=False, Closed=False, LoftEnds=0, LoftSimp=0, LoftType=0, Rebuild=10, Refit=0.01})
srf = Surface(loft)
scale = Scale(Geometry=srf, Center=Point(0, 0, 0), Factor=Slider(1, range=0..1.5))  # -> Geometry, Transform
srf_2 = Surface(<surface referenced from the Rhino model>)

# ---- group: TXT FILES PATH
panel = Panel("C:\Users\hyoshdia\Dropbox\branch_transforms")

# ---- group: OBJ PATH
path = FilePath(["C:\Users\hyoshdia\git\branch_git\input\output\140.obj", "C:\Users\hyoshdia\git\branch_git\input\output\145.obj", "C:\Users\hyoshdia\git\branch_git\input\output\150.obj"])

# ---- group: NAME
# REAL BRANCHES
# IMPORT
python = PythonScript(path=path)  # -> names; inputs path: list
# ---------- python: Python ----------
import os

names = []
for item in path:
    name = item.split(os.sep)[-1]
    name = name.split('.')[0]
    names.append(int(name))
# ---------- end python ----------
panel_2 = Panel(python)

# ---- group: MESH / COLOR
tomesh = ObjToMesh(Obj=path)  # -> Vertices, Faces, Colours
construct_mesh = ConstructMesh(Vertices=tomesh.Vertices, Faces=tomesh.Faces, Colours=tomesh.Colours)  # -> flatten(Mesh)
scale_2 = Scale(Geometry=construct_mesh, Center=Point(0, 0, 0), Factor=Slider(99, range=0..100))  # -> Geometry, Transform
av_col = PythonScript(M=scale_2.Geometry)  # -> RGB; inputs M: list
# ---------- av_col: Python ----------
import rhinoscriptsyntax as rs
import math
import Rhino.Geometry as rg
from clr import AddReference as addr
addr("Grasshopper")
from System import Object
from Grasshopper import DataTree
from Grasshopper.Kernel.Data import GH_Path

def dataTreeToList(aTree):
    theList = []
    for i in range(aTree.BranchCount ):
        thisListPart = []
        thisBranch = aTree.Branch(i)
        for j in range(len(thisBranch)):
            thisListPart.append( thisBranch[j] )
        theList.append(thisListPart)
    return theList

def raggedListToDataTree(raggedList):
    rl = raggedList
    result = DataTree[object]()
    for i in range(len(rl)):
        temp = []
        for j in range(len(rl[i])):
            temp.append(rl[i][j])
        #print i, " - ",temp
        path = GH_Path(i)
        result.AddRange(temp, path)
    return result

RGB = []

for mesh in M:
    colors = rs.MeshVertexColors(mesh)
    R = 0
    G = 0
    B = 0
    for col in colors:
        R = R + col.R
        G = G + col.G
        B = B + col.B
    R = R/len(colors)
    G = G/len(colors)
    B = B/len(colors)
    RGB.append((int(R),int(G),int(B)))

RBG = raggedListToDataTree(RGB)
# ---------- end av_col ----------

# ---- group: TARGET SURFACE
srf_3 = Surface(scale.Geometry)
ext_srf = ExtSrf(S=srf_3)
output_s = Surface(ext_srf)

# ----
number_slider = Slider(2, range=0..10)
tol = Slider(0.05, range=0..0.2)
mill_dia = Slider(1, range=0..1)

# ----
# PICK
button = Button()
import = PythonScript(path=panel, refresh=button)  # -> ang, branch_name, joint_index, pln_jnt, pln_mrk, pln, X, Y, Z
# ---------- import: Python ----------
import rhinoscriptsyntax as rs

location = str(path)+'\\2_fab_pose.txt'
file = open(location,'r')
lst = file.readlines()

# get branch name and joint index
branch_name = lst[0].split(',')[0]
joint_index = lst[0].split(',')[1]
joint_index = int(joint_index)-1
lst.pop(0)
for i in range(len(lst)):
    lst[i] = lst[i].split(',')
    lst[i].pop()
    if len(lst[i])>3: lst[i].pop()
    for j in range(len(lst[i])):
        lst[i][j] = float(lst[i][j])

X = rs.VectorCreate(lst[0],(0,0,0))
Y = rs.VectorCreate(lst[1],(0,0,0))
Z = rs.VectorCreate(lst[2],(0,0,0))
O = lst[3]
pln = rs.PlaneFromFrame(O,X,Y)
ang = rs.VectorAngle(Z,pln.Normal)
print ang
file.close()

if joint_index >=0:
    pln_jnt = pln
    pln_mrk = None
else:
    joint_index = None
    pln_jnt = None
    pln_mrk = pln
# ---------- end import ----------

# ----
# MILLING HEAD
origin_pt_milling_head = Point(Point(0, 0, 8))
origin_pt_milling_head_2 = Point(Point(0, 0, 8))
cluster = Cluster(
    P=origin_pt_milling_head_2,
    A=mill_dia,
    F_2=Slider(6, range=0..10),
    A_2=origin_pt_milling_head_2,
    F=Slider(12, range=0..100))  # -> E, B
environment = PythonScript()  # -> B
# ---------- environment: Python ----------
import rhinoscriptsyntax as rs

B =[]

# board outer outline
org = rs.AddPoint(-0.5,0.5,0)
pln = rs.PlaneFromFrame(org,(1,0,0),(0,1,0))
rect = rs.AddRectangle(pln,40.5,-58.5)
B.append(rect)

# board inner outline
org = rs.AddPoint(3.9,-3.9,0)
pln = rs.PlaneFromFrame(org,(1,0,0),(0,1,0))
rect = rs.AddRectangle(pln,40.5-8.8,-58.5+8.8)
B.append(rect)

# vise
org = rs.AddPoint(3.9+10,-3.9-16.5,0)
pln = rs.PlaneFromFrame(org,(1,0,0),(0,1,0))
rect = rs.AddRectangle(pln,40.5-8.8-10-3,-58.5+8.8+16.5+17.5)
path = rs.AddLine((0,0,0),(0,0,7))
rect = rs.ExtrudeCurve(rect,path)
rs.CapPlanarHoles(rect)
B.append(rect)
# ---------- end environment ----------
data = Data([cluster.E, cluster.B, environment])

calibrating = BooleanToggle(False)

panel_3 = Panel("""19.333,
-3.0733,
-0.28""")
panel_4 = Panel("""20.353,
-55.364,
-1.3""")
pt = Point(panel_4)
pt_2 = Point(panel_3)
addition = Addition(A=origin_pt_milling_head, B=pt)
addition_2 = Addition(A=origin_pt_milling_head, B=pt_2)
ln = Line(StartPoint=addition_2, EndPoint=addition)
pln = PythonScript(L=ln)  # -> P
# ---------- pln: Python ----------
import rhinoscriptsyntax as rs

mid = rs.CurveMidPoint(L)

st = rs.CurveStartPoint(L)
en = rs.CurveEndPoint(L)

vec = rs.VectorCreate(en,st)
vec2 = rs.VectorCrossProduct(vec,(0,0,1))

P = rs.PlaneFromFrame(mid,vec,vec2)
# ---------- end pln ----------

# ----
# make2D layout
number_slider_2 = Slider(-44, range=-180..180)
rad = Radians(Degrees=number_slider_2)
yz = YZPlane(Origin=Point(0, 0, 0))
xy = XYPlane(Origin=Point(0, 0, 0))
X = UnitX(Factor=1)
Z = UnitZ(Factor=1)
rad_2 = Radians(Degrees=Slider(-38, range=-180..180))
rotate = Rotate(Geometry=X, Angle=rad, Plane=xy)  # -> Geometry, Transform
rotate_2 = Rotate(Geometry=Z, Angle=rad_2, Plane=yz)  # -> Geometry, Transform
pl = ConstructPlane(Origin=Point(0, 0, 0), XAxis=rotate.Geometry, YAxis=rotate_2.Geometry)
number_slider_3 = Slider(0.5, range=0..1)
number_slider_4 = Slider(150, range=0..1000)
crv_3 = Curve()
wires = BrepWireframe(Density=1)
project = Project(Geometry=crv_3, Plane=pl)  # -> Geometry, Transform
project_2 = Project(Plane=pl)  # -> Geometry, Transform
project_3 = Project(Geometry=wires, Plane=pl)  # -> Geometry, Transform
orient = Orient(Geometry=project.Geometry, Source=pl, Target=PlaneXY(0, 0, 0))  # -> Geometry, Transform
orient_2 = Orient(Geometry=project_2.Geometry, Source=pl, Target=PlaneXY(0, 0, 0))  # -> Geometry, Transform
orient_3 = Orient(Geometry=project_3.Geometry, Source=pl, Target=PlaneXY(0, 0, 0))  # -> Geometry, Transform
multiplication = Multiplication(A=number_slider_4, B=Slider(3, range=0..10))
multiplication_2 = Multiplication(A=number_slider_4, B=Slider(4, range=0..10))
scale_3 = Scale(Geometry=orient.Geometry, Center=Point(0, 0, 0), Factor=number_slider_3)  # -> Geometry, Transform
multiplication_3 = Multiplication(A=number_slider_4, B=Slider(2, range=0..10))
scale_4 = Scale(Geometry=orient_2.Geometry, Center=Point(0, 0, 0), Factor=number_slider_3)  # -> Geometry, Transform
X_2 = UnitX(Factor=number_slider_4)
move = Move(Geometry=scale_3.Geometry, Motion=X_2)  # -> Geometry, Transform
scale_5 = Scale(Geometry=orient_3.Geometry, Center=Point(0, 0, 0), Factor=number_slider_3)  # -> Geometry, Transform
X_3 = UnitX(Factor=multiplication)
move_2 = Move(Geometry=scale_4.Geometry, Motion=X_3)  # -> Geometry, Transform
X_4 = UnitX(Factor=multiplication_2)
X_5 = UnitX(Factor=multiplication_3)
move_3 = Move(Geometry=scale_4.Geometry, Motion=X_4)  # -> Geometry, Transform
move_4 = Move(Geometry=scale_4.Geometry, Motion=X_5)  # -> Geometry, Transform
pipe = Pipe(Curve=move_3.Geometry, Radius=Slider(2, range=0..10), Caps=0)
data_2 = Data([pipe, move_2.Geometry, move_4.Geometry, move.Geometry, scale_5.Geometry])

# ----
# FABRICATION
crv_4 = Curve([<curve referenced from the Rhino model> x3])
crv_5 = Curve([<curve referenced from the Rhino model> x3])
loop_crvs = Curve([<curve referenced from the Rhino model> x4])
loop_crvs_2 = Curve([<curve referenced from the Rhino model> x4])
panel_5 = Panel(import.ang)

# ---- group: POSE
import_2 = PythonScript(path=panel, refresh=Button(), name=python)  # -> P, pose; inputs name: list
# ---------- import_2: Python ----------
import rhinoscriptsyntax as rs
import math
import Rhino.Geometry as rg
from clr import AddReference as addr
addr("Grasshopper")
from System import Object
from Grasshopper import DataTree
from Grasshopper.Kernel.Data import GH_Path
import os

def dataTreeToList(aTree):
    theList = []
    for i in range(aTree.BranchCount ):
        thisListPart = []
        thisBranch = aTree.Branch(i)
        for j in range(len(thisBranch)):
            thisListPart.append( thisBranch[j] )
        theList.append(thisListPart)
    return theList

def raggedListToDataTree(raggedList):
    rl = raggedList
    result = DataTree[object]()
    for i in range(len(rl)):
        temp = []
        for j in range(len(rl[i])):
            temp.append(rl[i][j])
        #print i, " - ",temp
        path = GH_Path(i)
        result.AddRange(temp, path)
    return result

P = []
pose = []

#files = os.listdir(path)
#for file in files:
#    file = file.split('.')[0]
#    file = file.split('_')
#    if file[0]=='0' and file[1]=='scan' and file[2]=='pose':
#        if file[3] != 'miscellaneous': name.append(file[3])

for n in name:
    location = str(path)+'\\0_scan_pose_'+str(n)+'.txt'
    file = open(location,'r')
    lst = file.readlines()
    for i in range(len(lst)):
        lst[i] = lst[i].split(',')
        lst[i].pop()
        for j in range(len(lst[i])):
            lst[i][j] = float(lst[i][j])
    X = lst[0]
    Y = lst[1]
    Z = lst[2]
    O = lst[3]
    O = rs.VectorCreate(O,(0,0,0))
    X = rs.VectorUnitize(X)
    Y = rs.VectorUnitize(Y)
    Z = rs.VectorUnitize(Z)
    #Z = rs.VectorCrossProduct(X,Y)
    #Y = rs.VectorCrossProduct(Z,X)
    O = rs.AddPoint(O[0],O[1],O[2])
    pln = rs.PlaneFromFrame(O,X,Y)
    P.append(pln)
    pose.append([O,X,Y,Z])
    file.close()

pose =raggedListToDataTree(pose)
# ---------- end import_2 ----------

# ---- group: SKELETON
mshadow = MeshShadow(Mesh=scale_2.Geometry, Light=Vector(0, 0, -1), Plane=PlaneXY(0, 0, 0))
clean_holes = PythonScript(C=mshadow)  # -> C; inputs C: tree
# ---------- clean_holes: Python ----------
import rhinoscriptsyntax as rs
import math
import Rhino.Geometry as rg
from clr import AddReference as addr
addr("Grasshopper")
from System import Object
from Grasshopper import DataTree
from Grasshopper.Kernel.Data import GH_Path
import os

def dataTreeToList(aTree):
    theList = []
    for i in range(aTree.BranchCount ):
        thisListPart = []
        thisBranch = aTree.Branch(i)
        for j in range(len(thisBranch)):
            thisListPart.append( thisBranch[j] )
        theList.append(thisListPart)
    return theList

def raggedListToDataTree(raggedList):
    rl = raggedList
    result = DataTree[object]()
    for i in range(len(rl)):
        temp = []
        for j in range(len(rl[i])):
            temp.append(rl[i][j])
        #print i, " - ",temp
        path = GH_Path(i)
        result.AddRange(temp, path)
    return result

C = dataTreeToList(C)

C2 = []

for crvs in C:
    max_length = 0
    for crv in crvs:
        length = rs.CurveLength(crv)
        if length > max_length:
            max_length = length
            selected_crv = crv
    C2.append(selected_crv)

C = C2
# ---------- end clean_holes ----------
divide = DivideCurve(Curve=clean_holes, Count=Slider(100, range=0..100), Kinks=False)  # -> Points, Tangents, Parameters
con = DelaunayEdges(Points=divide.Points, Plane=PlaneXY(0, 0, 0))  # -> Connectivity, Edges
_2d_skel = PythonScript(C=clean_holes, E=con.Edges)  # -> S; inputs C: list, E: tree
# ---------- _2d_skel: Python ----------
import rhinoscriptsyntax as rs
import math
import Rhino.Geometry as rg
from clr import AddReference as addr
addr("Grasshopper")
from System import Object
from Grasshopper import DataTree
from Grasshopper.Kernel.Data import GH_Path
import os

def dataTreeToList(aTree):
    theList = []
    for i in range(aTree.BranchCount ):
        thisListPart = []
        thisBranch = aTree.Branch(i)
        for j in range(len(thisBranch)):
            thisListPart.append( thisBranch[j] )
        theList.append(thisListPart)
    return theList

def raggedListToDataTree(raggedList):
    rl = raggedList
    result = DataTree[object]()
    for i in range(len(rl)):
        temp = []
        for j in range(len(rl[i])):
            temp.append(rl[i][j])
        #print i, " - ",temp
        path = GH_Path(i)
        result.AddRange(temp, path)
    return result

def containment(pt, crv):
    cont = True
    far_away_point = rs.AddPoint(9999,9999,0)
    line = rs.AddLine(pt,far_away_point)
    X = rs.CurveCurveIntersection(line,crv)
    if X==None or len(X)%2==0: cont = False
    return cont

E = dataTreeToList(E)

S = []

for edges,contour in zip(E,C):
    pts = []
    for edge in edges:
        mid = rs.CurveMidPoint(edge)
        ## take away points on edge
        t = rs.CurveClosestPoint(contour,mid)
        cp = rs.EvaluateCurve(contour,t)
        dist = rs.Distance(mid,cp)
        if dist<1.5: continue
        ## take away points outside contour
        if containment(mid,contour)==False: continue
        pts.append(mid)
    S.append(pts)

# simplyfy point list


d = 2
S2 = []
for pts in S:
    new_pts = []
    for pt in pts:
        min_dist = 9999
        for pt2 in new_pts:
            dist = rs.Distance(pt,pt2)
            if dist<min_dist:
                min_dist = dist
        if min_dist>d:
            new_pts.append(pt)
    S2.append(new_pts)

S = raggedListToDataTree(S2)
# ---------- end _2d_skel ----------
sort_pt = SortPoints(Points=_2d_skel)  # -> Points, Indices
nurbs = NurbsCurve(Vertices=sort_pt.Points, Degree=3, Periodic=False)  # -> flatten(Curve), Length, Domain
edges = PythonScript(C=clean_holes, S=nurbs.Curve)  # -> S
# ---------- edges: Python ----------
import rhinoscriptsyntax as rs

rs.ExtendCurve(S,2,0,[C])
rs.ExtendCurve(S,2,1,[C])

rs.ExtendCurveLength(S,0,0,-1)
rs.ExtendCurveLength(S,2,1,-1)
# ---------- end edges ----------
dir = PythonScript(C=edges, P=import_2.P)  # -> C
# ---------- dir: Python ----------
import rhinoscriptsyntax as rs

pt = P.Origin

st = rs.CurveStartPoint(C)
en = rs.CurveEndPoint(C)

dist1 = rs.Distance(pt,st)
dist2 = rs.Distance(pt,en)

if dist1<dist2:
    rs.ReverseCurve(C)
    rs.ExtendCurveLength(C,1,0,-5)
else: 
    rs.ExtendCurveLength(C,1,1,-5)
# ---------- end dir ----------
corr_skeleton = PythonScript(skel_2d=dir, mesh=scale_2.Geometry, ext=Slider(-3, range=-4..2))  # -> skel_3d, skel_pts, radii, aver_r
# ---------- corr_skeleton: Python ----------
import rhinoscriptsyntax as rs
import Rhino.Geometry as rg

def projectPointToMesh(pt,mesh):
    pt1 = None
    ptX = rs.ProjectPointToMesh(pt,mesh,(0,0,1))
    if ptX!=None and len(ptX)==1: 
        pt1 = ptX[0]
    elif ptX!=None and len(ptX)>1:
        pts_list = []
        for x in ptX: pts_list.append(x)
        pts_list.sort(key=getZ)
        pt1 = pts_list[-1]
    else:
        print "error - no point projection found"
    return pt1

def averagePoint(p1,p2):
    x = 0.5*p1[0]+0.5*p2[0]
    y = 0.5*p1[1]+0.5*p2[1]
    z = 0.5*p1[2]+0.5*p2[2]
    p = rs.AddPoint(x,y,z)
    return p


def getZ(point):
    return point[2]

def polyline_to_curve(pl):
    crv = rg.Polyline.ToNurbsCurve(pl)
    return crv


###

crv = skel_2d

### variables inside

step = 4
lower_z_limit = 1.5


###
skel_pts = []
radii = []


a = []

###
length = rs.CurveLength(crv)
n = int(0.5+length/step)
rs.ExtendCurveLength(crv,0,0,ext)
rs.ExtendCurveLength(crv,0,1,ext)
pts = rs.DivideCurve(crv,n)
new_pts = []
for pt in pts:
    t = rs.CurveClosestPoint(crv,pt)
    tan = rs.CurveTangent(crv,t)
    tan = rs.VectorUnitize(tan)
    pt_up = projectPointToMesh(pt,mesh)
    r = None
    if pt_up!=None:
        p_start = rs.AddPoint(pt[0],pt[1],lower_z_limit)
        p_end = rs.AddPoint(pt_up[0],pt_up[1],pt_up[2]-lower_z_limit)
        line = rs.AddLine(p_start,p_end)
        n = int(rs.Distance(p_start,p_end)/0.2)+1
        zpts = rs.DivideCurve(line,n)
        if zpts!=None and len(zpts)>0:
            R = []
            P = []
            for zpt in zpts:
                pln = rs.PlaneFromNormal(zpt,(0,0,1),tan)
                rect = rs.AddRectangle(pln,2,10)
                rs.MoveObject(rect,-1*tan)
                rect2 = rs.CopyObject(rect,-10*pln.YAxis)
                param = rg.MeshingParameters()
                rect = rg.Mesh.CreateFromPlanarBoundary(rs.coercecurve(rect),param)
                rect2 = rg.Mesh.CreateFromPlanarBoundary(rs.coercecurve(rect2),param)
                crv1 = rs.MeshMeshIntersection(mesh,rect)
                crv2 = rs.MeshMeshIntersection(mesh,rect2)
                if crv1!=None and crv2!=None:
                    crv1 = polyline_to_curve(crv1[0])
                    crv2 = polyline_to_curve(crv2[0])
                    t = rs.CurveClosestPoint(crv1,zpt)
                    pt1 = rs.EvaluateCurve(crv1,t)
                    t = rs.CurveClosestPoint(crv2,zpt)
                    pt2 = rs.EvaluateCurve(crv2,t)
                    r = 0.5*rs.Distance(pt1,pt2)
                    R.append(r)
                    new_pt = rs.CurveMidPoint(rs.AddLine(pt1,pt2))
                    P.append(new_pt)
            R = sorted(R)
            P = [x for _,x in sorted(zip(R,P))]
            if len(R)>0: r = R[-1]
            else: r = 2.2
            if len(P)>0: pt = P[-1]
            else: pt =zpt
        else:
            print "error with zpts"
            a.append(line)
    new_pts.append(pt)
    radii.append(r)

r_sum = 0
count = 0
for r in radii:
    if r!=None:
        r_sum = r_sum+r
        count = count+1
average_r = r_sum/count

for i in range(len(radii)):
    if radii[i] == None:
        radii[i] = average_r

for i in range(len(new_pts)):
    pt = new_pts[i]
    pt_up = projectPointToMesh(pt,mesh)
    if pt_up!=None:
        zpt = rs.AddPoint(0,0,-radii[i])
        pt = rs.PointAdd(zpt,pt_up)
        new_pts[i] = pt

### extend
crv = rs.AddCurve(new_pts)
crv = rs.ExtendCurveLength(crv,0,0,-ext)
crv = rs.ExtendCurveLength(crv,0,1,-ext)
st = rs.CurveStartPoint(crv)
en = rs.CurveEndPoint(crv)
new_pts.append(en)
new_pts.insert(0,st)
radii.append(radii[-1])
radii.insert(0,radii[0])



###
skel_3d = rs.AddCurve(new_pts,3)

skel_pts = new_pts

aver_r = average_r
# ---------- end corr_skeleton ----------

# ---- group: POSE (continued)
corr_trans = PythonScript(C=corr_skeleton.skel_3d, P=import_2.P)  # -> P, simplify(pose)
# ---------- corr_trans: Python ----------
import rhinoscriptsyntax as rs
import math
import Rhino.Geometry as rg
from clr import AddReference as addr
addr("Grasshopper")
from System import Object
from Grasshopper import DataTree
from Grasshopper.Kernel.Data import GH_Path
import os

def dataTreeToList(aTree):
    theList = []
    for i in range(aTree.BranchCount ):
        thisListPart = []
        thisBranch = aTree.Branch(i)
        for j in range(len(thisBranch)):
            thisListPart.append( thisBranch[j] )
        theList.append(thisListPart)
    return theList

def raggedListToDataTree(raggedList):
    rl = raggedList
    result = DataTree[object]()
    for i in range(len(rl)):
        temp = []
        for j in range(len(rl[i])):
            temp.append(rl[i][j])
        #print i, " - ",temp
        path = GH_Path(i)
        result.AddRange(temp, path)
    return result


## cube
d = 4.7
e = 0.6 
m = d-2*e
O = rs.CurveEndPoint(C)


xm = -0.5*m*P.XAxis
xm = rs.AddPoint(xm[0],xm[1],xm[2])
O = rs.PointAdd(O,xm)

ym = (0.6+e)*P.YAxis
ym = rs.AddPoint(ym[0],ym[1],ym[2])
O = rs.PointAdd(O,ym)

zm = -0.5*d*P.ZAxis
zm = rs.AddPoint(zm[0],zm[1],zm[2])
O = rs.PointAdd(O,zm)

P = rs.PlaneFromFrame(O,P.XAxis,P.YAxis)

pose = [P.Origin,P.XAxis,P.YAxis,P.ZAxis]
# ---------- end corr_trans ----------

# ---- group: CONSTRUCT BRANCH CLASS
# B[0] = name / id
# B[1] = skeleton curve
# B[2] = radii
# B[3] = pose (polyline)
# B[4] = color
radii_num = Number(simplify(corr_skeleton.radii))
skel_pt = Point(simplify(corr_skeleton.skel_pts))
# COMPOSE
# BRANCH CLASS
name_txt = Text(python)
pose_vec = Vector(corr_trans.pose)
constr_branch = PythonScript(name=name_txt, points=skel_pt, radii=radii_num, pose=pose_vec, color=av_col)  # -> branch; inputs name: list, points: tree of Point3d, radii: tree, pose: tree, color: list
# ---------- constr_branch: Python ----------
import rhinoscriptsyntax as rs
import math
import Rhino.Geometry as rg
from clr import AddReference as addr
addr("Grasshopper")
from System import Object
from Grasshopper import DataTree
from Grasshopper.Kernel.Data import GH_Path

def dataTreeToList(aTree):
    theList = []
    for i in range(aTree.BranchCount ):
        thisListPart = []
        thisBranch = aTree.Branch(i)
        for j in range(len(thisBranch)):
            thisListPart.append( thisBranch[j] )
        theList.append(thisListPart)
    return theList

def raggedListToDataTree(raggedList):
    rl = raggedList
    result = DataTree[object]()
    for i in range(len(rl)):
        temp = []
        for j in range(len(rl[i])):
            temp.append(rl[i][j])
        #print i, " - ",temp
        path = GH_Path(i)
        result.AddRange(temp, path)
    return result

def list_to_string(lst):
    txt = ''
    for k in range(len(lst)):
        txt = txt+str(lst[k])
        if k<len(lst)-1: txt = txt+','        
    return txt

points = dataTreeToList(points)
radii = dataTreeToList(radii)
pose = dataTreeToList(pose)

branch = []

for i in range(len(name)):
    n = name[i]
    p = points[i]
    crv = rs.AddCurve(p)
    r = list_to_string(radii[i])
    pose_pts = []
    org = pose[i][0]
    org = rs.AddPoint(org[0],org[1],org[2])
    pose_pts.append(org)
    for j in range(1,len(pose[i])):
        pt2 = rs.AddPoint(pose[i][j][0],pose[i][j][1],pose[i][j][2])
        pt = rs.PointAdd(org,pt2)
        pose_pts.append(pt)
    po = rs.AddPolyline(pose_pts)
    c = color[i]
    branch.append([n,crv,r,po,c])

branch = raggedListToDataTree(branch)
# ---------- end constr_branch ----------
branch_data = Data(constr_branch)

# ---- group: ORGNAIZE
planes = PythonScript(B=constr_branch)  # -> REF, TAR; inputs B: tree
# ---------- planes: Python ----------
import rhinoscriptsyntax as rs
import math
import Rhino.Geometry as rg
from clr import AddReference as addr
addr("Grasshopper")
from System import Object
from Grasshopper import DataTree
from Grasshopper.Kernel.Data import GH_Path

def dataTreeToList(aTree):
    theList = []
    for i in range(aTree.BranchCount ):
        thisListPart = []
        thisBranch = aTree.Branch(i)
        for j in range(len(thisBranch)):
            thisListPart.append( thisBranch[j] )
        theList.append(thisListPart)
    return theList

def raggedListToDataTree(raggedList):
    rl = raggedList
    result = DataTree[object]()
    for i in range(len(rl)):
        temp = []
        for j in range(len(rl[i])):
            temp.append(rl[i][j])
        #print i, " - ",temp
        path = GH_Path(i)
        result.AddRange(temp, path)
    return result

B = dataTreeToList(B)
#[name(0),skel_crv(1),radii(2),pose(3),ids(4),color(5)]

x_space = 10

REF = []
TAR = []

for i in range(len(B)):
    # target
    tar_pln = rs.PlaneFromFrame((x_space*i,0,0),(1,0,0),(0,1,0))
    TAR.append(tar_pln)
    # reference
    crv = B[i][1]
    mid = rs.CurveMidPoint(crv)
    t = rs.CurveClosestPoint(crv,mid)
    tan = rs.CurveTangent(crv,t)
    Y = tan
    X = rs.VectorCrossProduct(Y,(0,0,1))
    ref = rs.PlaneFromFrame(mid,X,Y)
    REF.append(ref)
# ---------- end planes ----------
orient_4 = PythonScript(branch=constr_branch, REF=planes.REF, TAR=planes.TAR)  # -> branch; inputs branch: tree, REF: list, TAR: list
# ---------- orient_4: Python ----------
import rhinoscriptsyntax as rs
import math
import Rhino.Geometry as rg
from clr import AddReference as addr
addr("Grasshopper")
from System import Object
from Grasshopper import DataTree
from Grasshopper.Kernel.Data import GH_Path

def dataTreeToList(aTree):
    theList = []
    for i in range(aTree.BranchCount ):
        thisListPart = []
        thisBranch = aTree.Branch(i)
        for j in range(len(thisBranch)):
            thisListPart.append( thisBranch[j] )
        theList.append(thisListPart)
    return theList

def raggedListToDataTree(raggedList):
    rl = raggedList
    result = DataTree[object]()
    for i in range(len(rl)):
        temp = []
        for j in range(len(rl[i])):
            temp.append(rl[i][j])
        #print i, " - ",temp
        path = GH_Path(i)
        result.AddRange(temp, path)
    return result

def plane_points(pln):
    org = pln.Origin
    X = pln.XAxis
    Y = pln.YAxis
    pts = (org,org+X,org+Y)
    return pts

def vec_from_line(ln):
    st = rs.CurveStartPoint(ln)
    en = rs.CurveEndPoint(ln)
    vec = rs.VectorCreate(en,st)
    return vec

def pnt(v):
    pt = rs.AddPoint(v[0],v[1],v[2])
    return pt

branch = dataTreeToList(branch)
#[name(0),points(1),radii(2),pose(3),ids(4),color(5)]
#skeleton points and pose needs to be updated, the rest stays the same!

for i in range(len(branch)):
    crv = branch[i][1]
    pose_pl = branch[i][3]
    tar = TAR[i]
    ref = REF[i]
    #
    tar_pts = plane_points(tar)
    ref_pts = plane_points(ref)
    #
    rs.OrientObject(crv,ref_pts,tar_pts)
    #
    rs.OrientObject(pose_pl,ref_pts,tar_pts)
    #
    branch[i][1] = crv
    branch[i][3] = pose_pl

branch = raggedListToDataTree(branch)
# ---------- end orient_4 ----------

# ---- group: DISPLAY
branch_data_organized = Data(orient_4)
branch_data_original = Data(branch_data)
branch_data_2 = Data(branch_data_organized)
geometry = PythonScript(branch=branch_data_2)  # -> G, M, C; inputs branch: tree
# ---------- geometry: Python ----------
import rhinoscriptsyntax as rs
import math
import Rhino.Geometry as rg
from clr import AddReference as addr
addr("Grasshopper")
from System import Object
from Grasshopper import DataTree
from Grasshopper.Kernel.Data import GH_Path

def dataTreeToList(aTree):
    theList = []
    for i in range(aTree.BranchCount ):
        thisListPart = []
        thisBranch = aTree.Branch(i)
        for j in range(len(thisBranch)):
            thisListPart.append( thisBranch[j] )
        theList.append(thisListPart)
    return theList

def raggedListToDataTree(raggedList):
    rl = raggedList
    result = DataTree[object]()
    for i in range(len(rl)):
        temp = []
        for j in range(len(rl[i])):
            temp.append(rl[i][j])
        #print i, " - ",temp
        path = GH_Path(i)
        result.AddRange(temp, path)
    return result

def string_to_list(txt):
    lst = txt.split(',')
    for k in range(len(lst)):
        lst[k] = float(lst[k])
    return lst

branch = dataTreeToList(branch)
#[name(0),points(1),radii(2),pose(3),ids(4),color(5)]

G = []
M = []
M_col = []
C = []

for br in branch:
    if br == None: continue 
    crv = br[1]
    pts = rs.CurvePoints(crv)
    pts = rs.DivideCurve(crv,len(pts)-1)
    rad = string_to_list(br[2])
    #
    profiles = []
    #
    for i in range(len(pts)):
        pt = pts[i]
        r = rad[i]
        t = rs.CurveClosestPoint(crv,pt)
        #if i == len(pts)-1: t = rs.CurveClosestPoint(crv,pts[i-1])
        tan = rs.CurveTangent(crv,t)
        X = rs.VectorCrossProduct((0,0,1),tan)
        pln = rs.PlaneFromNormal(pt,tan,X)
        circle = rs.AddCircle(pln,r)
        profiles.append(circle)
    geo = rs.AddLoftSrf(profiles)[0]
    rs.CapPlanarHoles(geo)
    mesh = rg.Mesh.CreateFromBrep(rs.coercebrep(geo))
    mesh = rs.JoinMeshes(mesh)
    #param = rg.MeshingParameters()
    #E = rg.Mesh.CreateFromPlanarBoundary(rs.coercecurve(start),param)
    colors = []
    color = br[4]
    for i in range(rs.MeshVertexCount(mesh)):
        colors.append(color)
    rs.MeshVertexColors(mesh,colors)
    #
    G.append(geo)
    M.append(mesh)
    ## cube
    d = 4.7
    e = 0.6 
    ## pose plane
    pose_pl = br[3]
    pose_pts = rs.CurvePoints(pose_pl)
    org = pose_pts[0]
    X = rs.VectorCreate(pose_pts[1],pose_pts[0])
    Y = rs.VectorCreate(pose_pts[2],pose_pts[0])
    Z = rs.VectorCreate(pose_pts[3],pose_pts[0]) 
    ### adjust org considering boarder
    org = rs.VectorAdd(org,-e*X)
    org = rs.VectorAdd(org,-e*Y)
    org = rs.AddPoint(org[0],org[1],org[2])
    ## plane
    pln = rs.PlaneFromFrame(org,X,Y)
    ##
    R = rs.AddRectangle(pln,d,d)
    ptz = d*pln.ZAxis
    ptz = rs.AddPoint(ptz[0],ptz[1],ptz[2])
    path = rs.AddLine((0,0,0),ptz)
    B = rs.ExtrudeCurve(R,path)
    rs.CapPlanarHoles(B)
    C.append(B)
# ---------- end geometry ----------
pose = PythonScript(branch=branch_data_2)  # -> A, V; inputs branch: tree
# ---------- pose: Python ----------
import rhinoscriptsyntax as rs
import Rhino as rc
import math
import Rhino.Geometry as rg
from clr import AddReference as addr
addr("Grasshopper")
from System import Object
from Grasshopper import DataTree
from Grasshopper.Kernel.Data import GH_Path

def dataTreeToList(aTree):
    theList = []
    for i in range(aTree.BranchCount ):
        thisListPart = []
        thisBranch = aTree.Branch(i)
        for j in range(len(thisBranch)):
            thisListPart.append( thisBranch[j] )
        theList.append(thisListPart)
    return theList

def raggedListToDataTree(raggedList):
    rl = raggedList
    result = DataTree[object]()
    for i in range(len(rl)):
        temp = []
        for j in range(len(rl[i])):
            temp.append(rl[i][j])
        #print i, " - ",temp
        path = GH_Path(i)
        result.AddRange(temp, path)
    return result

branch = dataTreeToList(branch)

A = []
V = []

for br in branch:
    pose_pl = br[3]
    pose_pts = rs.CurvePoints(pose_pl)
    for i in range(1,len(pose_pts)):
        vec = 5*rs.VectorCreate(pose_pts[i],pose_pts[0])
        A.append(pose_pts[0])
        V.append(vec)
# ---------- end pose ----------
vdis = VectorDisplay(Anchor=pose.A, Vector=pose.V)
mesh = Mesh(geometry.M)
brep = Brep([geometry.C, geometry.G])

# ----
planes_2 = PythonScript(C=loop_crvs_2, branch=branch_data)  # -> REF, TAR; inputs C: list, branch: tree
# ---------- planes_2: Python ----------
import rhinoscriptsyntax as rs
import Rhino.Geometry as rg
from clr import AddReference as addr
addr("Grasshopper")
from System import Object
from Grasshopper import DataTree
from Grasshopper.Kernel.Data import GH_Path

def dataTreeToList(aTree):
    theList = []
    for i in range(aTree.BranchCount ):
        thisListPart = []
        thisBranch = aTree.Branch(i)
        for j in range(len(thisBranch)):
            thisListPart.append( thisBranch[j] )
        theList.append(thisListPart)
    return theList

def raggedListToDataTree(raggedList):
    rl = raggedList
    result = DataTree[object]()
    for i in range(len(rl)):
        temp = []
        for j in range(len(rl[i])):
            temp.append(rl[i][j])
        #print i, " - ",temp
        path = GH_Path(i)
        result.AddRange(temp, path)
    return result

branch = dataTreeToList(branch)
#[name(0),points(1),radii(2),pose(3),ids(4),color(5)]

REF = []
TAR = []

for crv,br in zip(C,branch):
    original = br[1]
    #
    tar_pts = rs.DivideCurve(crv,5)
    tar_pln = rs.PlaneFromPoints(tar_pts[0],tar_pts[2],tar_pts[-1])
    ref_pts = rs.DivideCurve(original,5)
    ref_pln = rs.PlaneFromPoints(ref_pts[0],ref_pts[2],ref_pts[-1])
    #
    REF.append(ref_pln)
    TAR.append(tar_pln)
# ---------- end planes_2 ----------
orient_5 = PythonScript(branch=branch_data, REF=planes_2.REF, TAR=planes_2.TAR)  # -> branch; inputs branch: tree, REF: list, TAR: list; same code as orient_4
branch_data_3 = Data(orient_5)

# ----
# DISPLAY BRANCH
pose_2 = PythonScript(branch=branch_data_3)  # -> O, X, Y, Z; inputs branch: tree
# ---------- pose_2: Python ----------
import rhinoscriptsyntax as rs
import Rhino as rc
import math
import Rhino.Geometry as rg
from clr import AddReference as addr
addr("Grasshopper")
from System import Object
from Grasshopper import DataTree
from Grasshopper.Kernel.Data import GH_Path

def dataTreeToList(aTree):
    theList = []
    for i in range(aTree.BranchCount ):
        thisListPart = []
        thisBranch = aTree.Branch(i)
        for j in range(len(thisBranch)):
            thisListPart.append( thisBranch[j] )
        theList.append(thisListPart)
    return theList

def raggedListToDataTree(raggedList):
    rl = raggedList
    result = DataTree[object]()
    for i in range(len(rl)):
        temp = []
        for j in range(len(rl[i])):
            temp.append(rl[i][j])
        #print i, " - ",temp
        path = GH_Path(i)
        result.AddRange(temp, path)
    return result

branch = dataTreeToList(branch)


P = []

for br in branch:
    pose_pl = br[3]
    pose_pts = rs.CurvePoints(pose_pl)
    V = []
    for i in range(1,len(pose_pts)):
        vec = rs.VectorCreate(pose_pts[i],pose_pts[0])
        V.append(vec)
    X = V[0]
    Y = V[1]
    Z = V[2]
    P = rs.PlaneFromFrame(pose_pts[0],X,Y)
# ---------- end pose_2 ----------
geometry_2 = PythonScript(branch=branch_data_3)  # -> G, M, C, L, T; inputs branch: tree
# ---------- geometry_2: Python ----------
import rhinoscriptsyntax as rs
import math
import Rhino.Geometry as rg
from clr import AddReference as addr
addr("Grasshopper")
from System import Object
from Grasshopper import DataTree
from Grasshopper.Kernel.Data import GH_Path

def dataTreeToList(aTree):
    theList = []
    for i in range(aTree.BranchCount ):
        thisListPart = []
        thisBranch = aTree.Branch(i)
        for j in range(len(thisBranch)):
            thisListPart.append( thisBranch[j] )
        theList.append(thisListPart)
    return theList

def raggedListToDataTree(raggedList):
    rl = raggedList
    result = DataTree[object]()
    for i in range(len(rl)):
        temp = []
        for j in range(len(rl[i])):
            temp.append(rl[i][j])
        #print i, " - ",temp
        path = GH_Path(i)
        result.AddRange(temp, path)
    return result

def string_to_list(txt):
    lst = txt.split(',')
    for k in range(len(lst)):
        lst[k] = float(lst[k])
    return lst

branch = dataTreeToList(branch)
#[name(0),points(1),radii(2),pose(3),ids(4),color(5)]

G = []
M = []
M_col = []
C = []
T = []
L = []

for br in branch:
    if br == None: continue 
    T.append(str(br[0]))
    crv = br[1]
    L.append(rs.CurveMidPoint(crv))
    pts = rs.CurvePoints(crv)
    pts = rs.DivideCurve(crv,len(pts)-1)
    rad = string_to_list(br[2])
    #
    profiles = []
    #
    for i in range(len(pts)):
        pt = pts[i]
        r = rad[i]
        t = rs.CurveClosestPoint(crv,pt)
        #if i == len(pts)-1: t = rs.CurveClosestPoint(crv,pts[i-1])
        tan = rs.CurveTangent(crv,t)
        X = rs.VectorCrossProduct((0,0,1),tan)
        pln = rs.PlaneFromNormal(pt,tan,X)
        circle = rs.AddCircle(pln,r)
        profiles.append(circle)
    geo = rs.AddLoftSrf(profiles)[0]
    rs.CapPlanarHoles(geo)
    mesh = rg.Mesh.CreateFromBrep(rs.coercebrep(geo))
    mesh = rs.JoinMeshes(mesh)
    #param = rg.MeshingParameters()
    #E = rg.Mesh.CreateFromPlanarBoundary(rs.coercecurve(start),param)
    colors = []
    color = br[4]
    for i in range(rs.MeshVertexCount(mesh)):
        colors.append(color)
    rs.MeshVertexColors(mesh,colors)
    #
    G.append(geo)
    M.append(mesh)
    ## cube
    d = 4.7
    e = 0.6 
    ## pose plane
    pose_pl = br[3]
    pose_pts = rs.CurvePoints(pose_pl)
    org = pose_pts[0]
    X = rs.VectorCreate(pose_pts[1],pose_pts[0])
    Y = rs.VectorCreate(pose_pts[2],pose_pts[0])
    Z = rs.VectorCreate(pose_pts[3],pose_pts[0]) 
    ### adjust org considering boarder
    org = rs.VectorAdd(org,-e*X)
    org = rs.VectorAdd(org,-e*Y)
    org = rs.AddPoint(org[0],org[1],org[2])
    ## plane
    pln = rs.PlaneFromFrame(org,X,Y)
    ##
    R = rs.AddRectangle(pln,d,d)
    ptz = d*pln.ZAxis
    ptz = rs.AddPoint(ptz[0],ptz[1],ptz[2])
    path = rs.AddLine((0,0,0),ptz)
    B = rs.ExtrudeCurve(R,path)
    rs.CapPlanarHoles(B)
    C.append(B)
# ---------- end geometry_2 ----------
vdisex = VectorDisplayEx(Point=pose_2.O, Vector=pose_2.X, Colour=ColourSwatch(SwatchColor=RGB(255, 0, 0)), Width=2)
vdisex_2 = VectorDisplayEx(Point=pose_2.O, Vector=pose_2.Y, Colour=ColourSwatch(SwatchColor=RGB(72, 255, 0)), Width=2)
vdisex_3 = VectorDisplayEx(Vector=pose_2.Z, Colour=ColourSwatch(SwatchColor=RGB(25, 0, 255)), Width=2)
brep_2 = Brep([geometry_2.G, geometry_2.C])
mesh_2 = Mesh(geometry_2.M)
preview = CustomPreview(Geometry=brep_2, Shader=ColourSwatch(SwatchColor=RGBA(255, 255, 255, 27)))

# ----
# JOINT POINTS
types = PythonScript()  # -> side, type
# ---------- types: Python ----------
import rhinoscriptsyntax as rs
import Rhino.Geometry as rg
from clr import AddReference as addr
addr("Grasshopper")
from System import Object
from Grasshopper import DataTree
from Grasshopper.Kernel.Data import GH_Path
import math

def dataTreeToList(aTree):
    theList = []
    for i in range(aTree.BranchCount ):
        thisListPart = []
        thisBranch = aTree.Branch(i)
        for j in range(len(thisBranch)):
            thisListPart.append( thisBranch[j] )
        theList.append(thisListPart)
    return theList

def raggedListToDataTree(raggedList):
    rl = raggedList
    result = DataTree[object]()
    for i in range(len(rl)):
        temp = []
        for j in range(len(rl[i])):
            temp.append(rl[i][j])
        #print i, " - ",temp
        path = GH_Path(i)
        result.AddRange(temp, path)
    return result



side = [ [1,0], [0,1], [0,1], [1,0] ]
type = [ [1,1], [2,2], [1,1], [2,2] ]


side = raggedListToDataTree(side)
type = raggedListToDataTree(type)
# ---------- end types ----------
joint = PythonScript(B=branch_data_3, side=types.side)  # -> X, P, J; inputs B: tree, side: tree of Int32
# ---------- joint: Python ----------
import rhinoscriptsyntax as rs
import math
import Rhino.Geometry as rg
from clr import AddReference as addr
addr("Grasshopper")
from System import Object
from Grasshopper import DataTree
from Grasshopper.Kernel.Data import GH_Path

def dataTreeToList(aTree):
    theList = []
    for i in range(aTree.BranchCount ):
        thisListPart = []
        thisBranch = aTree.Branch(i)
        for j in range(len(thisBranch)):
            thisListPart.append( thisBranch[j] )
        theList.append(thisListPart)
    return theList

def raggedListToDataTree(raggedList):
    rl = raggedList
    result = DataTree[object]()
    for i in range(len(rl)):
        temp = []
        for j in range(len(rl[i])):
            temp.append(rl[i][j])
        #print i, " - ",temp
        path = GH_Path(i)
        result.AddRange(temp, path)
    return result

B = dataTreeToList(B)
side = dataTreeToList(side) # 0=up, 1=down

X = []
P = []
J = []

for i in range(len(B)):
    temp = []
    temp2 = []
    temp3 = []
    for j in range(len(B)):
        if i==j: continue
        crv1 = B[i][1]
        crv2 = B[j][1]
        x = rs.CurveCurveIntersection(crv1,crv2,2)
        if x!=None:
            x = x[0][1]
            temp.append(x)
            t = rs.CurveClosestPoint(crv1,x)
            v = rs.CurveTangent(crv1,t)
            t = rs.CurveClosestPoint(crv2,x)
            v2 = rs.CurveTangent(crv2,t)
            n = rs.VectorCrossProduct(v,v2)
            xaxis = rs.VectorCrossProduct(n,v)
            
            pln = rs.PlaneFromNormal(x,n,xaxis)
            temp2.append(pln)
            temp3.append(j)
    X.append(temp)
    P.append(temp2)
    J.append(temp3)

### correct plane direction according to pattern
for i in range(len(P)):
    for j in range(len(P[i])):
        pln = P[i][j]
        normal = pln.Normal
        ang = rs.VectorAngle(normal,(0,0,1))
        if (ang>90 and side[i][j]==0) or (ang<90 and side[i][j]==1):
            pln = rs.PlaneFromNormal(pln.Origin,rs.VectorReverse(normal),pln.XAxis)
            P[i][j] = pln


X = raggedListToDataTree(X)
P = raggedListToDataTree(P)
J = raggedListToDataTree(J)
# ---------- end joint ----------
pt_3 = Point(joint.X)

tag = TextTag(Location=geometry_2.L, Text=geometry_2.T)

# ----
# JOINT
# JOINT GEOMETRY / MILLING PATH
data_3 = Data(branch_data_3)
pln_2 = Plane(joint.P)
int = Integer(joint.J)
skel_rad = PythonScript(B=data_3, P=pln_2, J=int)  # -> C, Cx, R, Rx; inputs B: tree, P: tree, J: tree of Int32
# ---------- skel_rad: Python ----------
import rhinoscriptsyntax as rs
import scriptcontext as sc
import math
import Rhino.Geometry as rg
from clr import AddReference as addr
addr("Grasshopper")
from System import Object
from Grasshopper import DataTree
from Grasshopper.Kernel.Data import GH_Path

def dataTreeToList(aTree):
    theList = []
    for i in range(aTree.BranchCount ):
        thisListPart = []
        thisBranch = aTree.Branch(i)
        for j in range(len(thisBranch)):
            thisListPart.append( thisBranch[j] )
        theList.append(thisListPart)
    return theList

def raggedListToDataTree(raggedList):
    rl = raggedList
    result = DataTree[object]()
    for i in range(len(rl)):
        temp = []
        for j in range(len(rl[i])):
            temp.append(rl[i][j])
        #print i, " - ",temp
        path = GH_Path(i)
        result.AddRange(temp, path)
    return result

def closest_radius(pt,pts,rads):
    mindist = 9999
    r = 99
    for pt2,rad in zip(pts,rads):
        dist = rs.Distance(pt,pt2)
        if dist<mindist:
            mindist = dist
            r = rad
    return r
    
def string_to_list(txt):
    lst = txt.split(',')
    for k in range(len(lst)):
        lst[k] = float(lst[k])
    return lst

B = dataTreeToList(B)
P = dataTreeToList(P)
J = dataTreeToList(J)

C = []
Cx = []
R = []
Rx = []
P2 = []

for branch,plns,js in zip(B,P,J):
    temp1 = []
    temp2 = []
    temp3 = []
    temp4 = []
    crv = branch[1]
    skel_pts = rs.CurvePoints(crv)
    rads = string_to_list(branch[2])
    for j,pln in zip(js,plns):
        crv2 = B[j][1]
        skel_pts2 = rs.CurvePoints(crv2)
        rads2 = string_to_list(B[j][2])
        pt = pln.Origin
        r = closest_radius(pt,skel_pts,rads)
        r2 = closest_radius(pt,skel_pts2,rads2)
        temp1.append(crv)
        temp2.append(crv2)
        temp3.append(r)
        temp4.append(r2)
    C.append(temp1)
    Cx.append(temp2)
    R.append(temp3)
    Rx.append(temp4)

C = raggedListToDataTree(C)
Cx = raggedListToDataTree(Cx)
R = raggedListToDataTree(R)
Rx = raggedListToDataTree(Rx)
# ---------- end skel_rad ----------
joint_points = PythonScript(Org_skeleton_A=skel_rad.C, Org_skeleton_B=skel_rad.Cx, radius_A=skel_rad.R, radius_B=skel_rad.Rx, plane=pln_2)  # -> intersection_point, outer_points, outer_polyline, inner_points, inner_polyline
# ---------- joint_points: Python ----------
import rhinoscriptsyntax as rs

def get_tangent_in_plane(curve,point,plane):
    plane = rs.PlaneFromFrame((0,0,0),plane.XAxis,plane.YAxis)
    t = rs.CurveClosestPoint(curve,point)
    vec = rs.CurveTangent(curve,t)
    vec = rs.AddPoint(vec[0],vec[1],vec[2])
    vec = rs.PlaneClosestPoint(plane,vec)
    vec = rs.VectorUnitize(vec)
    return vec

def makePoints(V):
    P = []
    for vec in V:
        x = vec[0]
        y = vec[1]
        z = vec[2]
        pt = rs.AddPoint((x,y,z))
        P.append(pt)
    return P


ratio = 0.65

### simplify names of input parameters

crv1 = Org_skeleton_A
crv2 = Org_skeleton_B
r1 = float(radius_A)
r2 = float(radius_B)

###

ptX = plane.Origin

v1 = r2*get_tangent_in_plane(crv1,ptX,plane)
v2 = r1*get_tangent_in_plane(crv2,ptX,plane)

###outer 
A = ptX+v1+v2
B = A-2*v1
C = B-2*v2
D = A-2*v2

###inner 
a = ptX+ratio*(v1+v2)
b = a-ratio*2*v1
c = b-ratio*2*v2
d = a-ratio*2*v2

### output
outer_points = makePoints((A,B,C,D))
inner_points = makePoints((a,b,c,d))
outer_polyline = rs.AddPolyline(outer_points)
inner_polyline = rs.AddPolyline(inner_points)
intersection_point = ptX
# ---------- end joint_points ----------
subtraction = Subtraction(A=mill_dia, B=tol)
cutting_paths = PythonScript(
    OUT=joint_points.outer_polyline,
    IN=joint_points.inner_polyline,
    d=subtraction,
    z=Slider(0.1, range=0..0.1),
    P=pln_2,
    R=skel_rad.R,
    type=types.type)  # -> S1, S2, C0; inputs OUT: tree, IN: tree, P: tree, R: tree, type: tree of Int32
# ---------- cutting_paths: Python ----------
import rhinoscriptsyntax as rs
import Rhino.Geometry as rg
from clr import AddReference as addr
addr("Grasshopper")
from System import Object
from Grasshopper import DataTree
from Grasshopper.Kernel.Data import GH_Path
import math

def dataTreeToList(aTree):
    theList = []
    for i in range(aTree.BranchCount ):
        thisListPart = []
        thisBranch = aTree.Branch(i)
        for j in range(len(thisBranch)):
            thisListPart.append( thisBranch[j] )
        theList.append(thisListPart)
    return theList

def raggedListToDataTree(raggedList):
    rl = raggedList
    result = DataTree[object]()
    for i in range(len(rl)):
        temp = []
        for j in range(len(rl[i])):
            temp.append(rl[i][j])
        #print i, " - ",temp
        path = GH_Path(i)
        result.AddRange(temp, path)
    return result

def movePoints(points,vector):
    points2 = []
    for pt in points: points2.append(rs.PointAdd(pt,vector))
    return points2    

def side_cut_points(A,a,B,b,r,d1_,v2,d2_,extra):
    #start lines, and move in by mill bit radius
    line_Aa = rs.MoveObject(rs.AddLine(A,a),r*d1_)
    rs.ExtendCurveLength(line_Aa,0,0,extra)
    line_ab = rs.MoveObject(rs.AddLine(a,b),r*v2)
    line_Bb = rs.MoveObject(rs.AddLine(B,b),r*d2_)
    rs.ExtendCurveLength(line_Bb,0,0,extra)
    #
    #define path by intersection points of above lines
    P0 = rs.CurveStartPoint(line_Aa)
    p0 = rs.LineLineIntersection(line_Aa,line_ab)[0]
    p1 = rs.LineLineIntersection(line_ab,line_Bb)[0]
    P1 = rs.CurveStartPoint(line_Bb)
    #
    #list of points to define cutting path
    pts = [P0,p0,p1,P1]
    #
    return pts

def adjust_side_cut_angle(p,z,alfa,vec):
    ln = rs.AddLine(p[1],p[2])
    mag = z*math.tan(math.radians(alfa))
    vec = mag*vec
    rs.MoveObject(ln,vec)
    rs.ExtendCurveLength(ln,0,0,5)
    rs.ExtendCurveLength(ln,0,1,5)
    # get intersections
    ln1 = rs.AddLine(p[0],p[1])
    ln2 = rs.AddLine(p[2],p[3])
    X1 = rs.CurveCurveIntersection(ln,ln1)
    X2 = rs.CurveCurveIntersection(ln,ln2)
    if X1!=None and len(X1)>0 and X2!=None and len(X2)>0: 
        p1 = X1[0][1]
        p2 = X2[0][1]
        pts = (p[0],p1,p2,p[3])
    else: 
        pts = None
    return pts
    
def update_ctr_pts(pts,index,z,alfa,vec1,vec2):
    step = z*math.tan(math.radians(alfa))
    ln0 = rs.AddLine(pts[0],pts[1])
    ln1 = rs.AddLine(pts[1],pts[2])
    ln2 = rs.AddLine(pts[2],pts[3])
    ln3 = rs.AddLine(pts[3],pts[0])
    rs.MoveObject(ln1,-index*step*vec1)
    rs.MoveObject(ln3,index*step*vec1)
    rs.MoveObject(ln0,0*index*step*vec2)
    rs.MoveObject(ln2,-0*index*step*vec2)
    rs.ExtendCurveLength(ln0,0,0,5)
    rs.ExtendCurveLength(ln0,0,1,5)
    rs.ExtendCurveLength(ln1,0,0,5)
    rs.ExtendCurveLength(ln1,0,1,5)
    rs.ExtendCurveLength(ln2,0,0,5)
    rs.ExtendCurveLength(ln2,0,1,5)    
    rs.ExtendCurveLength(ln3,0,0,5)
    rs.ExtendCurveLength(ln3,0,1,5)
    X0 = rs.CurveCurveIntersection(ln3,ln0)
    X1 = rs.CurveCurveIntersection(ln0,ln1)
    X2 = rs.CurveCurveIntersection(ln1,ln2)
    X3 = rs.CurveCurveIntersection(ln2,ln3)
    if X0!=None and len(X0)>0 and X1!=None and len(X1)>0 and X2!=None and len(X2)>0 and X3!=None and len(X3)>0:
        p0 = X0[0][1]
        p1 = X1[0][1]
        p2 = X2[0][1]
        p3 = X3[0][1]
        pts = [p0,p1,p2,p3]
    test.extend(pts)
    return pts

OUT = dataTreeToList(OUT)
IN = dataTreeToList(IN)
R = dataTreeToList(R)
P = dataTreeToList(P)
type = dataTreeToList(type)

S1 = []
S2 = []
C0 = []

test = []
alfa = 30
r = d/2
extra = 0.3
rot_type_ratio = 0.2

for opls,ipls,brs,plns,typ in zip(OUT,IN,R,P,type):
    temp1 = []
    temp2 = []
    temp3 = []
    for opl,ipl,br,pln,ty in zip(opls,ipls,brs,plns,typ):
        # cutting angle vector
        dir = pln.Normal
        #
        # reference points
        outer_points = rs.CurvePoints(opl)
        inner_points = rs.CurvePoints(ipl)
        A = outer_points[0]
        B = outer_points[1]
        C = outer_points[2]
        D = outer_points[3]
        a = inner_points[0]
        b = inner_points[1]
        c = inner_points[2]
        d = inner_points[3]
        #
        # intersection vectors
        v1 = rs.VectorUnitize(rs.VectorCreate(a,b))
        v2 = rs.VectorUnitize(rs.VectorCreate(a,d))
        #
        #diagonal vectors
        d1 = rs.VectorUnitize(rs.VectorCreate(A,a))
        d2 = rs.VectorUnitize(rs.VectorCreate(B,b))
        #
        #orthogonal to diagonal vectors
        N = rs.VectorCrossProduct(v2,v1)
        d1_ = rs.VectorRotate(d1,-90,N)
        d2_ = rs.VectorRotate(d2,90,N)
        #
        # Adjust proprotions or rotational types
        #
        if ty == 1 and ty == 1: #center open
            move_vec = rot_type_ratio*rs.VectorCreate(b,a)
            move_vec = rs.AddPoint(move_vec[0],move_vec[1],move_vec[2])
            a = rs.PointAdd(a,move_vec)
            d = rs.PointAdd(d,move_vec)
            b = rs.PointSubtract(b,move_vec)
            c = rs.PointSubtract(c,move_vec)
        elif ty == 2: #side open
            move_vec = rot_type_ratio*rs.VectorCreate(d,a)
            move_vec = rs.AddPoint(move_vec[0],move_vec[1],move_vec[2])
            a = rs.PointAdd(a,move_vec)
            b = rs.PointAdd(b,move_vec)
            c = rs.PointSubtract(c,move_vec)
            d = rs.PointSubtract(d,move_vec)
        #
        # Side cut points
        #
        pts1 = side_cut_points(A,a,B,b,r,d1_,v2,d2_,extra)
        pts2 = side_cut_points(C,c,D,d,r,-d1_,-v2,-d2_,extra)
        #
        ################ Z ################
        #
        #start height for Z is zero (we set origin at branch center
        #on branch top surface
        v_st = br*dir
        #
        #calculate in how many iterations to move the path down
        h = 2*br-0.1 
        n = int(h/z)
        # move curve down
        path_pts1 = []
        path_pts2 = []
        for i in range(n):
            #move down points
            v_add = z*dir*i
            v = v_st-v_add
            v = rs.AddPoint(v[0],v[1],v[2])
            if z*i>=br and ty == 2: 
                pts1 = adjust_side_cut_angle(pts1,z,alfa,v2)
                pts2 = adjust_side_cut_angle(pts2,z,alfa,-v2)
                if pts1==None or pts2==None: break
            new_path_points1 = movePoints(pts1,v)
            #
            new_path_points2 = movePoints(pts2,v)
            #
            if i%2==1:
                new_path_points1 = reversed(new_path_points1)
                new_path_points2 = reversed(new_path_points2)
            path_pts1.extend(new_path_points1)
            path_pts2.extend(new_path_points2)
        temp1.append(rs.AddPolyline(path_pts1))
        temp2.append(rs.AddPolyline(path_pts2))
        #
        # CENTER PATH
        #
        ####### Z #########
        #
        #calculate numer of cutting laters
        n = int(br/z)
        #add layers to path
        ctr_pts = [a,b,c,d]
        path_pts = []
        for i in range(n):
            if ty == 1: 
                cpts = update_ctr_pts(ctr_pts,n-i-1,z,alfa,v1,v2)
            else: cpts = ctr_pts
            #move down points
            v_add = z*dir*i
            v = v_st-v_add
            v = rs.AddPoint(v[0],v[1],v[2])
            #
            ### calculate number of horizontal cut lines
            #
            dist = rs.Distance(cpts[0],cpts[1])
            m = int(dist/(2*r))+1
            r_ = 0.5*(dist-2*r)/(m-1)
            #
            ### define start point for cut
            p = cpts[0]-r*v1+0.1*v2
            #
            #list of points to define cutting path
            pts = []
            pts.append(p)
            length = rs.Distance(cpts[0],cpts[3])+0.2 
            for j in range(m):
                p = pts[-1]+(2*(j%2)-1)*length*v2
                p2 = p-2*r_*v1
                pts.append(p)
                if j < m-1: pts.append(p2)
            new_path_points = movePoints(pts,v)
            if i%2==1:
                new_path_points = reversed(new_path_points)
            path_pts.extend(new_path_points)
        ###
        temp3.append(rs.AddPolyline(path_pts))
    S1.append(temp1)
    S2.append(temp2)
    C0.append(temp3)

S1 = raggedListToDataTree(S1)
S2 = raggedListToDataTree(S2)
C0 = raggedListToDataTree(C0)
# ---------- end cutting_paths ----------

# ----
# EXP. TARGET VECS
branch_data_4 = Data(branch_data_3)
pln_3 = Plane(joint.P)
change_basis = PythonScript(P=pln_3, B=branch_data_4)  # -> V, Vt, names, mrk_pln; inputs P: tree, B: tree
# ---------- change_basis: Python ----------
import rhinoscriptsyntax as rs
import math
import Rhino.Geometry as rg
from clr import AddReference as addr
addr("Grasshopper")
from System import Object
from Grasshopper import DataTree
from Grasshopper.Kernel.Data import GH_Path

def dataTreeToList(aTree):
    theList = []
    for i in range(aTree.BranchCount ):
        thisListPart = []
        thisBranch = aTree.Branch(i)
        for j in range(len(thisBranch)):
            thisListPart.append( thisBranch[j] )
        theList.append(thisListPart)
    return theList

def raggedListToDataTree(raggedList):
    rl = raggedList
    result = DataTree[object]()
    for i in range(len(rl)):
        temp = []
        for j in range(len(rl[i])):
            temp.append(rl[i][j])
        #print i, " - ",temp
        path = GH_Path(i)
        result.AddRange(temp, path)
    return result

def transposeMatrix(m):
    return map(list,zip(*m))

def getMatrixMinor(m,i,j):
    return [row[:j] + row[j+1:] for row in (m[:i]+m[i+1:])]

def getMatrixDeternminant(m):
    #base case for 2x2 matrix
    if len(m) == 2:
        return m[0][0]*m[1][1]-m[0][1]*m[1][0]

    determinant = 0
    for c in range(len(m)):
        determinant += ((-1)**c)*m[0][c]*getMatrixDeternminant(getMatrixMinor(m,0,c))
    return determinant

def getMatrixInverse(m):
    determinant = getMatrixDeternminant(m)
    #special case for 2x2 matrix:
    if len(m) == 2:
        return [[m[1][1]/determinant, -1*m[0][1]/determinant],
                [-1*m[1][0]/determinant, m[0][0]/determinant]]

    #find matrix of cofactors
    cofactors = []
    for r in range(len(m)):
        cofactorRow = []
        for c in range(len(m)):
            minor = getMatrixMinor(m,r,c)
            cofactorRow.append(((-1)**(r+c)) * getMatrixDeternminant(minor))
        cofactors.append(cofactorRow)
    cofactors = transposeMatrix(cofactors)
    for r in range(len(cofactors)):
        for c in range(len(cofactors)):
            cofactors[r][c] = cofactors[r][c]/determinant
    return cofactors

def matmult(m, v):
    nrows = len(m)
    w = [None] * nrows
    for row in range(nrows):
        w[row] = reduce(lambda x,y: x+y, map(lambda x,y: x*y, m[row], v))
    return w

P = dataTreeToList(P)
B = dataTreeToList(B)

V = list()
Vt = list()
names = list()
mrk_pln = []

for plns,branch in zip(P,B):
    temp1 = []
    temp2 = []
    temp3 = []
    pose_pts = rs.CurvePoints(branch[3])
    Org = pose_pts[0]
    X = rs.VectorCreate(pose_pts[1],pose_pts[0])
    Y = rs.VectorCreate(pose_pts[2],pose_pts[0])
    Z = rs.VectorCreate(pose_pts[3],pose_pts[0]) 
    #change of basis matrix
    C = [ [X[0],Y[0],Z[0]] , [X[1],Y[1],Z[1]] , [X[2],Y[2],Z[2]] ]
    C_1 = getMatrixInverse(C)
    ## joint vec
    for i in range(len(plns)):
        name = branch[0]+'_'+str(i+1)
        temp1.append(name)
        #
        pln = plns[i]
        vec = pln.Normal
        vec = [vec[0],vec[1],vec[2]]
        vec = matmult(C_1,vec)
        vec = rs.VectorCreate((vec[0],vec[1],vec[2]),(0,0,0))
        temp2.append(vec)
        # translation vector
        jnt = pln.Origin
        tvec = rs.VectorCreate(jnt,Org)
        tvec = [tvec[0],tvec[1],tvec[2]]
        tvec = matmult(C_1,tvec)
        tvec = rs.VectorCreate((tvec[0],tvec[1],tvec[2]),(0,0,0))
        temp3.append(tvec)
    ## mark vec
    name = branch[0]+'_marks'
    temp1.append(name)
    #
    norm = rs.VectorCreate((0,0,0),(0,0,0))
    yaxis = rs.VectorCreate((0,0,0),(0,0,0))
    n0 = plns[0].Normal
    y0 = plns[0].YAxis
    for pln in plns:
        n = pln.Normal
        ang = rs.VectorAngle(n,n0)
        if ang>90: n = -n
        norm = norm+n
        #
        y = pln.YAxis
        ang = rs.VectorAngle(y,y0)
        if ang>90: y = -y
        yaxis = yaxis+y
    norm = rs.VectorUnitize(norm)
    yaxis = rs.VectorUnitize(yaxis)
    vec = rs.VectorCrossProduct(yaxis,norm)
    vec = rs.VectorUnitize(vec)
    #
    st = rs.CurveStartPoint(branch[1])
    en = rs.CurveEndPoint(branch[1])
    test_pt = rs.CurveMidPoint(rs.AddLine(st,en))
    mid = rs.CurveMidPoint(branch[1])
    test_vec = rs.VectorCreate(mid,test_pt)
    ang = rs.VectorAngle(vec,test_vec)
    if ang<90:
        vec = rs.VectorReverse(vec)
    #
    mrk_pln.append(rs.PlaneFromNormal(mid,vec))
    #
    vec = [vec[0],vec[1],vec[2]]
    vec = matmult(C_1,vec)
    vec = rs.VectorCreate((vec[0],vec[1],vec[2]),(0,0,0))
    temp2.append(vec)
    # translation vector
    tvec = rs.VectorCreate(mid,Org)
    tvec = [tvec[0],tvec[1],tvec[2]]
    tvec = matmult(C_1,tvec)
    tvec = rs.VectorCreate((tvec[0],tvec[1],tvec[2]),(0,0,0))
    temp3.append(tvec)
    #
    names.append(temp1)
    V.append(temp2)
    Vt.append(temp3)



V = raggedListToDataTree(V)
Vt = raggedListToDataTree(Vt)
names = raggedListToDataTree(names)
# ---------- end change_basis ----------
test = PythonScript(B=branch_data_4, Vb=change_basis.Vt, P=pln_3)  # -> A, Vw; inputs B: tree, Vb: tree, P: tree
# ---------- test: Python ----------
import rhinoscriptsyntax as rs
import math
import Rhino.Geometry as rg
from clr import AddReference as addr
addr("Grasshopper")
from System import Object
from Grasshopper import DataTree
from Grasshopper.Kernel.Data import GH_Path

def dataTreeToList(aTree):
    theList = []
    for i in range(aTree.BranchCount ):
        thisListPart = []
        thisBranch = aTree.Branch(i)
        for j in range(len(thisBranch)):
            thisListPart.append( thisBranch[j] )
        theList.append(thisListPart)
    return theList

def raggedListToDataTree(raggedList):
    rl = raggedList
    result = DataTree[object]()
    for i in range(len(rl)):
        temp = []
        for j in range(len(rl[i])):
            temp.append(rl[i][j])
        #print i, " - ",temp
        path = GH_Path(i)
        result.AddRange(temp, path)
    return result

B = dataTreeToList(B)
Vb = dataTreeToList(Vb)
P = dataTreeToList(P)

A = []
Vw = []

for branch,vecs,plns in zip(B,Vb,P):
    pose_pts = rs.CurvePoints(branch[3])
    X = rs.VectorCreate(pose_pts[1],pose_pts[0])
    Y = rs.VectorCreate(pose_pts[2],pose_pts[0])
    Z = rs.VectorCreate(pose_pts[3],pose_pts[0]) 
    for j in range(len(vecs)):
        vec = vecs[j]
        if j<2: A.append(plns[j].Origin)
        else: A.append(rs.CurveMidPoint(branch[1]))
        vwx = X*vec[0]
        vwy = Y*vec[1]
        vwz = Z*vec[2]
        p = vwx+vwy+vwz
        p = p
        p = rs.AddPoint(p[0],p[1],p[2])
        vw = rs.VectorCreate(p,(0,0,0))
        Vw.append(rs.VectorReverse(vw))
# ---------- end test ----------
test_2 = PythonScript(B=branch_data_4, Vb=change_basis.V, P=pln_3)  # -> A, Vw; inputs B: tree, Vb: tree, P: tree
# ---------- test_2: Python ----------
import rhinoscriptsyntax as rs
import math
import Rhino.Geometry as rg
from clr import AddReference as addr
addr("Grasshopper")
from System import Object
from Grasshopper import DataTree
from Grasshopper.Kernel.Data import GH_Path

def dataTreeToList(aTree):
    theList = []
    for i in range(aTree.BranchCount ):
        thisListPart = []
        thisBranch = aTree.Branch(i)
        for j in range(len(thisBranch)):
            thisListPart.append( thisBranch[j] )
        theList.append(thisListPart)
    return theList

def raggedListToDataTree(raggedList):
    rl = raggedList
    result = DataTree[object]()
    for i in range(len(rl)):
        temp = []
        for j in range(len(rl[i])):
            temp.append(rl[i][j])
        #print i, " - ",temp
        path = GH_Path(i)
        result.AddRange(temp, path)
    return result

B = dataTreeToList(B)
Vb = dataTreeToList(Vb)
P = dataTreeToList(P)

A = []
Vw = []

for branch,vecs,plns in zip(B,Vb,P):
    pose_pts = rs.CurvePoints(branch[3])
    X = rs.VectorCreate(pose_pts[1],pose_pts[0])
    Y = rs.VectorCreate(pose_pts[2],pose_pts[0])
    Z = rs.VectorCreate(pose_pts[3],pose_pts[0]) 
    for j in range(len(vecs)):
        vec = vecs[j]
        if j<2: A.append(plns[j].Origin)
        else: A.append(rs.CurveMidPoint(branch[1]))
        vwx = X*vec[0]
        vwy = Y*vec[1]
        vwz = Z*vec[2]
        p = vwx+vwy+vwz
        p = 5*p
        p = rs.AddPoint(p[0],p[1],p[2])
        vw = rs.VectorCreate(p,(0,0,0))
        Vw.append(vw)
# ---------- end test_2 ----------
export = PythonScript(path=panel, V=change_basis.V, Vt=change_basis.Vt, N=change_basis.names)  # inputs V: list, Vt: list, N: list
# ---------- export: Python ----------
import rhinoscriptsyntax as rs

def sr(num):
    num = round(num,3)
    txt = str(num)
    return txt

for name,vec,tvec in zip(N,V,Vt):
    file = open(str(path)+'\\1_cut_vec_'+name+'.txt','w')
    ###initialization
    file.write(sr(vec[0])+','+sr(vec[1])+','+sr(vec[2])+', "Target direction vector"\n')
    file.write(sr(0.01*tvec[0])+','+sr(0.01*tvec[1])+','+sr(0.01*tvec[2])+', "Translation vector (meters)"\n') 
    file.close()
# ---------- end export ----------
vdis_2 = VectorDisplay(Anchor=test_2.A, Vector=test_2.Vw)
vdis_3 = VectorDisplay(Anchor=test.A, Vector=test.Vw)

branch_name = Panel(import.branch_name)
branch_data_5 = Data(branch_data_3)
index = PythonScript(name=import.branch_name, B=branch_data_5)  # -> i; inputs B: tree
# ---------- index: Python ----------
import rhinoscriptsyntax as rs
import Rhino.Geometry as rg
from clr import AddReference as addr
addr("Grasshopper")
from System import Object
from Grasshopper import DataTree
from Grasshopper.Kernel.Data import GH_Path

def dataTreeToList(aTree):
    theList = []
    for i in range(aTree.BranchCount ):
        thisListPart = []
        thisBranch = aTree.Branch(i)
        for j in range(len(thisBranch)):
            thisListPart.append( thisBranch[j] )
        theList.append(thisListPart)
    return theList

B = dataTreeToList(B)
index = None

for i in range(len(B)):
    if name == B[i][0]:
        index = i
        break

i = index
# ---------- end index ----------
flip = FlipMatrix(Data=joint.P)
flip_2 = FlipMatrix(Data=branch_data_5)
branch = ListItem(List=flip_2, Index=index, Wrap=True)  # -> flatten(Item)
flip_3 = FlipMatrix(Data=skel_rad.R)
geometry_3 = PythonScript(branch=branch)  # -> G, M, C; inputs branch: tree
# ---------- geometry_3: Python ----------
import rhinoscriptsyntax as rs
import math
import Rhino.Geometry as rg
from clr import AddReference as addr
addr("Grasshopper")
from System import Object
from Grasshopper import DataTree
from Grasshopper.Kernel.Data import GH_Path

def dataTreeToList(aTree):
    theList = []
    for i in range(aTree.BranchCount ):
        thisListPart = []
        thisBranch = aTree.Branch(i)
        for j in range(len(thisBranch)):
            thisListPart.append( thisBranch[j] )
        theList.append(thisListPart)
    return theList

def raggedListToDataTree(raggedList):
    rl = raggedList
    result = DataTree[object]()
    for i in range(len(rl)):
        temp = []
        for j in range(len(rl[i])):
            temp.append(rl[i][j])
        #print i, " - ",temp
        path = GH_Path(i)
        result.AddRange(temp, path)
    return result

def string_to_list(txt):
    lst = txt.split(',')
    for k in range(len(lst)):
        lst[k] = float(lst[k])
    return lst

branch = dataTreeToList(branch)
#[name(0),points(1),radii(2),pose(3),ids(4),color(5)]

G = []
M = []
M_col = []
C = []

for br in branch:
    if br == None: continue 
    crv = br[1]
    pts = rs.CurvePoints(crv)
    pts = rs.DivideCurve(crv,len(pts)-1)
    rad = string_to_list(br[2])
    #
    profiles = []
    #
    for i in range(len(pts)):
        pt = pts[i]
        r = rad[i]
        t = rs.CurveClosestPoint(crv,pt)
        #if i == len(pts)-1: t = rs.CurveClosestPoint(crv,pts[i-1])
        tan = rs.CurveTangent(crv,t)
        X = rs.VectorCrossProduct((0,0,1),tan)
        pln = rs.PlaneFromNormal(pt,tan,X)
        circle = rs.AddCircle(pln,r)
        profiles.append(circle)
    geo = rs.AddLoftSrf(profiles)[0]
    rs.CapPlanarHoles(geo)
    mesh = rg.Mesh.CreateFromBrep(rs.coercebrep(geo))
    mesh = rs.JoinMeshes(mesh)
    #param = rg.MeshingParameters()
    #E = rg.Mesh.CreateFromPlanarBoundary(rs.coercecurve(start),param)
    colors = []
    color = br[5]
    for i in range(rs.MeshVertexCount(mesh)):
        colors.append(color)
    rs.MeshVertexColors(mesh,colors)
    #
    G.append(geo)
    M.append(mesh)
    ## cube
    d = 4.7
    e = 0.6 
    ## pose plane
    pose_pl = br[3]
    pose_pts = rs.CurvePoints(pose_pl)
    org = pose_pts[0]
    X = rs.VectorCreate(pose_pts[1],pose_pts[0])
    Y = rs.VectorCreate(pose_pts[2],pose_pts[0])
    Z = rs.VectorCreate(pose_pts[3],pose_pts[0]) 
    ### adjust org considering boarder
    org = rs.VectorAdd(org,-e*X)
    org = rs.VectorAdd(org,-e*Y)
    org = rs.AddPoint(org[0],org[1],org[2])
    ## plane
    pln = rs.PlaneFromFrame(org,X,Y)
    ##
    R = rs.AddRectangle(pln,d,d)
    ptz = d*pln.ZAxis
    ptz = rs.AddPoint(ptz[0],ptz[1],ptz[2])
    path = rs.AddLine((0,0,0),ptz)
    B = rs.ExtrudeCurve(R,path)
    rs.CapPlanarHoles(B)
    C.append(B)
# ---------- end geometry_3 ----------
jnt_plns = ListItem(List=flip, Index=index, Wrap=True)  # -> flatten(Item)
loc_rads = ListItem(List=flip_3, Index=index, Wrap=True)  # -> flatten(Item)
brep_3 = Brep([geometry_3.G, geometry_3.C])

int_2 = Integer(import.joint_index)
jnt_pln = TreeItem(Tree=joint.P, Path=index, Index=int_2, Wrap=True)
side_1 = TreeItem(Tree=cutting_paths.S1, Path=index, Index=int_2, Wrap=True)
side_2 = TreeItem(Tree=cutting_paths.S2, Path=index, Index=int_2, Wrap=True)
ctr_cut = TreeItem(Tree=cutting_paths.C0, Path=index, Index=int_2, Wrap=True)
loc_rad = TreeItem(Tree=skel_rad.R, Path=index, Index=int_2, Wrap=True)

# ----
# POSE
ref = PythonScript(B=branch)  # -> pln; inputs B: list
# ---------- ref: Python ----------
import rhinoscriptsyntax as rs

pose_pts = rs.CurvePoints(B[3])
O = pose_pts[0]
O = rs.AddPoint(O[0],O[1],O[2])
X = rs.VectorCreate(pose_pts[1],pose_pts[0])
Y = rs.VectorCreate(pose_pts[2],pose_pts[0])
Z = rs.VectorCreate(pose_pts[3],pose_pts[0]) 

pln = rs.PlaneFromFrame(O,X,Y)
print rs.VectorAngle(Z,pln.Normal)
# ---------- end ref ----------
orient_6 = PythonScript(branch=branch, REF=ref, TAR=import.pln)  # -> branch; inputs branch: tree, REF: list, TAR: list; same code as orient_4
geometry_4 = PythonScript(branch=orient_6)  # -> G, M, C; inputs branch: tree; same code as geometry_3
actual_pose_brep = Brep([geometry_4.G, geometry_4.C])

# ----
# FAB
item = ListItem(List=change_basis.mrk_pln, Index=index, Wrap=True)
sel = PythonScript(jnt_ind=import.joint_index, mrk_pln=item, jnt_pln=jnt_pln)  # -> pln
# ---------- sel: Python ----------
if jnt_ind>=0:
    pln = jnt_pln
else:
    pln = mrk_pln
# ---------- end sel ----------
pose_3 = PythonScript(B=branch)  # -> P; inputs B: list
# ---------- pose_3: Python ----------
import rhinoscriptsyntax as rs

P = []


pose_pl = B[3]
pose_pts = rs.CurvePoints(pose_pl)
V = []
for i in range(1,len(pose_pts)):
    vec = rs.VectorCreate(pose_pts[i],pose_pts[0])
    V.append(vec)
P = rs.PlaneFromFrame(pose_pts[0],V[0],V[1])
# ---------- end pose_3 ----------
pln_4 = Plane(import.pln)
orient_7 = Orient(Geometry=sel, Source=pose_3, Target=pln_4)  # -> Geometry, Transform
cut_v = PythonScript(P=orient_7.Geometry)  # -> A, V
# ---------- cut_v: Python ----------
import rhinoscriptsyntax as rs

A = P.Origin
V = 10*P.Normal
# ---------- end cut_v ----------
vdisex_4 = VectorDisplayEx(Point=cut_v.A, Vector=cut_v.V, Colour=ColourSwatch(SwatchColor=RGB(140, 0, 255)), Width=4)

alfa = Slider(20, range=-40..40)
alfa_2 = Number(alfa)

number_slider_5 = Slider(5, range=0..10)

length = PythonScript(B=branch_data, ext=number_slider_5)  # -> L_max; inputs B: tree
# ---------- length: Python ----------
import rhinoscriptsyntax as rs
import math
import Rhino.Geometry as rg
from clr import AddReference as addr
addr("Grasshopper")
from System import Object
from Grasshopper import DataTree
from Grasshopper.Kernel.Data import GH_Path

def dataTreeToList(aTree):
    theList = []
    for i in range(aTree.BranchCount ):
        thisListPart = []
        thisBranch = aTree.Branch(i)
        for j in range(len(thisBranch)):
            thisListPart.append( thisBranch[j] )
        theList.append(thisListPart)
    return theList
    
def raggedListToDataTree(raggedList):
    rl = raggedList
    result = DataTree[object]()
    for i in range(len(rl)):
        temp = []
        for j in range(len(rl[i])):
            temp.append(rl[i][j])
        #print i, " - ",temp
        path = GH_Path(i)
        result.AddRange(temp, path)
    return result

B = dataTreeToList(B)

L = []

for branch in B:
    crv = branch[1]
    length = rs.CurveLength(crv)
    L.append(length)

L_max = sorted(L)[1]-ext
# ---------- end length ----------
# PATTERN
python_2 = PythonScript(S=srf_3, L_max=length)  # -> U, V
# ---------- python_2: Python ----------
import rhinoscriptsyntax as rs
import Rhino.Geometry as rg

pts = []
lensU = []
lensV = []

divU = 20
divV = 20

for i in range(20):
    u_ = 1/20 * i
    temp = []
    for j in range(20+1):
        v_ = 1/20 * j
        (u,v) = rs.SurfaceParameter(S,(u_,v_))
        pt = rs.EvaluateSurface(S, u, v,)
        temp.append(pt)
    crv = rs.AddCurve(temp)
    lensU.append(rs.CurveLength(crv))
    pts.append(temp)


pts = zip(*pts)

for crv_pts in pts:
    crv = rs.AddCurve(crv_pts)
    lensV.append(rs.CurveLength(crv))

maxU = sorted(lensU)[-1]
maxV = sorted(lensV)[-1]

U = int(maxU/L_max)+1
V = int(maxV/L_max)+1

print U,V
# ---------- end python_2 ----------
sdivide = DivideSurface(Surface=srf_3, UCount=python_2.V, VCount=python_2.U)  # -> simplify(Points), Normals, Parameters
sdiv_equi = PythonScript(S=srf_3, U=python_2.V, V=python_2.U)  # -> simplify(P); inputs S: Surface
# ---------- sdiv_equi: Python ----------
import rhinoscriptsyntax as rs
import math
import Rhino.Geometry as rg
from clr import AddReference as addr
addr("Grasshopper")
from System import Object
from Grasshopper import DataTree
from Grasshopper.Kernel.Data import GH_Path

def raggedListToDataTree(raggedList):
    rl = raggedList
    result = DataTree[object]()
    for i in range(len(rl)):
        temp = []
        for j in range(len(rl[i])):
            temp.append(rl[i][j])
        #print i, " - ",temp
        path = GH_Path(i)
        result.AddRange(temp, path)
    return result

def add_rotate_line(pt0,pt1):
    ln = rs.AddLine(pt0,pt1)
    # Rotate line around its mid point
    mid = rs.CurveMidPoint(ln)
    uv = rs.SurfaceClosestPoint(S,mid)
    axis = rs.SurfaceNormal(S,uv)
    rs.RotateObject(ln,mid,alfa,axis)
    # Extend line
    rs.ExtendCurveLength(ln,0,0,ext)
    rs.ExtendCurveLength(ln,0,1,ext)
    # Project line to surface
    # ln = rs.ProjectCurveToSurface(ln,S,axis)
    return ln


u_step = 1.00/U
v_step = 1.00/V

U = int(U)
V = int(V)

# Creat grid of points on surface
pts = []
for i in range(U+1):
    u_ = u_step * i
    temp = []
    for j in range(V+1):
        v_ = v_step * j
        (u,v) = rs.SurfaceParameter(S,(u_,v_))
        pt = rs.EvaluateSurface(S, u, v,)
        temp.append(pt)
    pts.append(temp)

# Make division equidistance
pts = zip(*pts)
for i in range(len(pts)):
    crv = rs.AddInterpCrvOnSrf(S,pts[i])
    pts[i] = rs.DivideCurve(crv,U)
    #pts[i].append(rs.CurveEndPoint(crv))
pts = zip(*pts)
for i in range(len(pts)):
    #crv = rs.AddInterpCrvOnSrf(S,pts[i])
    crv = rs.AddInterpCurve(pts[i])
    pts[i] = rs.DivideCurve(crv,V)
    #pts[i].append(rs.CurveEndPoint(crv))
pts = zip(*pts)

P = raggedListToDataTree(pts)
# ---------- end sdiv_equi ----------

pattern = PythonScript(S=output_s, P=sdiv_equi, alfa=alfa_2)  # -> L1, L2; inputs S: Surface, P: tree
# ---------- pattern: Python ----------
import rhinoscriptsyntax as rs
import math
import Rhino.Geometry as rg
from clr import AddReference as addr
addr("Grasshopper")
from System import Object
from Grasshopper import DataTree
from Grasshopper.Kernel.Data import GH_Path

def dataTreeToList(aTree):
    theList = []
    for i in range(aTree.BranchCount ):
        thisListPart = []
        thisBranch = aTree.Branch(i)
        for j in range(len(thisBranch)):
            thisListPart.append( thisBranch[j] )
        theList.append(thisListPart)
    return theList
    
def raggedListToDataTree(raggedList):
    rl = raggedList
    result = DataTree[object]()
    for i in range(len(rl)):
        temp = []
        for j in range(len(rl[i])):
            temp.append(rl[i][j])
        #print i, " - ",temp
        path = GH_Path(i)
        result.AddRange(temp, path)
    return result

def point_to_surface(pt):
    (u,v) = rs.SurfaceClosestPoint(S,pt)
    pt = rs.EvaluateSurface(S,u,v)
    return pt

def add_rotate_line(pt0,pt1):
    ln = rs.AddLine(pt0,pt1)
    # Rotate line around its mid point
    mid = rs.CurveMidPoint(ln)
    uv = rs.SurfaceClosestPoint(S,mid)
    axis = rs.SurfaceNormal(S,uv)
    rs.RotateObject(ln,mid,alfa,axis)
    # Project line endpoints to surface
    st = point_to_surface(rs.CurveStartPoint(ln))
    en = point_to_surface(rs.CurveEndPoint(ln))
    ln = rs.AddLine(st,en)
    # ln = rs.ProjectCurveToSurface(ln,S,axis)
    # Extend line
    #rs.ExtendCurveLength(ln,0,0,ext)
    #rs.ExtendCurveLength(ln,0,1,ext)
    return ln

P = dataTreeToList(P)

# Create rotated lines along V direction
L1 = []
for i in range(len(P)):
    temp = []
    for j in range(len(P[i])-1):
        p0 = P[i][j]
        p1 = P[i][j+1]
        line = add_rotate_line(p0,p1)
        temp.append(line)
    L1.append(temp)

# Create rotated lines along U direction
L2 = []
for i in range(len(P)-1):
    temp = []
    for j in range(len(P[i])):
        p0 = P[i][j]
        p1 = P[i+1][j]
        line = add_rotate_line(p0,p1)
        temp.append(line)
    L2.append(temp)

L1 = raggedListToDataTree(L1)
L2 = raggedListToDataTree(L2)
# ---------- end pattern ----------
ext_proj = PythonScript(S=output_s, L1=pattern.L1, L2=pattern.L2)  # -> C1, C2; inputs S: list, L1: tree, L2: tree
# ---------- ext_proj: Python ----------
import rhinoscriptsyntax as rs
import math
import Rhino.Geometry as rg
from clr import AddReference as addr
addr("Grasshopper")
from System import Object
from Grasshopper import DataTree
from Grasshopper.Kernel.Data import GH_Path

def dataTreeToList(aTree):
    theList = []
    for i in range(aTree.BranchCount ):
        thisListPart = []
        thisBranch = aTree.Branch(i)
        for j in range(len(thisBranch)):
            thisListPart.append( thisBranch[j] )
        theList.append(thisListPart)
    return theList
    
def raggedListToDataTree(raggedList):
    rl = raggedList
    result = DataTree[object]()
    for i in range(len(rl)):
        temp = []
        for j in range(len(rl[i])):
            temp.append(rl[i][j])
        #print i, " - ",temp
        path = GH_Path(i)
        result.AddRange(temp, path)
    return result

def curve_to_surface(crv):
    mid = rs.CurveMidPoint(crv)
    uv = rs.SurfaceClosestPoint(S[0],mid)
    norm = rs.SurfaceNormal(S[0],uv)
    pts = rs.DivideCurve(crv,n)
    for k in range(len(pts)):
        pt = pts[k]
        ppts = rs.ProjectPointToSurface(pt,S,norm)
        if ppts==None or len(ppts)==0:
            ppts = rs.ProjectPointToSurface(pt,S,-norm)
        if ppts!=None and len(ppts)>0:
            if len(ppts)==1: pt = ppts[0]
            else:
                (u,v) = rs.SurfaceClosestPoint(S[0],pt)
                cpt = rs.EvaluateSurface(S[0],u,v)
                mindist = 9999
                for ppt in ppts:
                    dist = rs.Distance(ppt,cpt)
                    if dist<mindist:
                        mindist = dist
                        pt = ppt
        else: 
            pt = None
            print "miss"
        pts[k] = pt
    pts2 = []
    for pt in pts:
        if pt!=None:
            pts2.append(pt)
    crv = rs.AddInterpCurve(pts2)
    return crv


C1 = dataTreeToList(L1)
C2 = dataTreeToList(L2)

ratio = 0.4
n = 12

for i in range(len(C1)):
    for j in range(len(C1[0])):
        ln = C1[i][j]
        d = ratio*rs.CurveLength(ln)
        rs.ExtendCurveLength(ln,0,0,d)
        rs.ExtendCurveLength(ln,0,1,d)
        crv = curve_to_surface(ln)
        C1[i][j] = crv

for i in range(len(C2)):
    for j in range(len(C2[0])):
        ln = C2[i][j]
        d = ratio*rs.CurveLength(ln)
        rs.ExtendCurveLength(ln,0,0,d)
        rs.ExtendCurveLength(ln,0,1,d)
        crv = curve_to_surface(ln)
        C2[i][j] = crv

C1 = raggedListToDataTree(C1)
C2 = raggedListToDataTree(C2)
# ---------- end ext_proj ----------
trim_ext_curves = PythonScript(S=output_s, C1=flatten(ext_proj.C1), C2=flatten(ext_proj.C2), ext=number_slider_5)  # -> IDEAL, XPTS, EPTS; inputs S: Surface, C1: list, C2: list
# ---------- trim_ext_curves: Python ----------
import rhinoscriptsyntax as rs
import math
import Rhino.Geometry as rg
from clr import AddReference as addr
addr("Grasshopper")
from System import Object
from Grasshopper import DataTree
from Grasshopper.Kernel.Data import GH_Path

def dataTreeToList(aTree):
    theList = []
    for i in range(aTree.BranchCount ):
        thisListPart = []
        thisBranch = aTree.Branch(i)
        for j in range(len(thisBranch)):
            thisListPart.append( thisBranch[j] )
        theList.append(thisListPart)
    return theList

def raggedListToDataTree(raggedList):
    rl = raggedList
    result = DataTree[object]()
    for i in range(len(rl)):
        temp = []
        for j in range(len(rl[i])):
            temp.append(rl[i][j])
        path = GH_Path(i)
        result.AddRange(temp, path)
    return result

def curve_cp(crv,pt):
    t = rs.CurveClosestPoint(crv,pt)
    pt = rs.EvaluateCurve(crv,t)
    return pt


IDEAL = []
XPTS = []
EPTS = []

C1_ = rs.CopyObjects(C1)

for crv in C1:
    T = []
    P = []
    for bound in C2:
        X = rs.CurveCurveIntersection(crv,bound,1)
        if X!=None and len(X)>0: 
            T.append(rs.CurveClosestPoint(crv,X[0][1]))
            P.append(X[0][1])
    stt = sorted(T)[0]
    ent = sorted(T)[-1]
    trimmed_crv = rs.SplitCurve(crv,(stt,ent))[1]
    IDEAL.append(trimmed_crv)
    XPTS.append(P)

for crv in C2:
    T = []
    P = []
    for bound in C1_:
        X = rs.CurveCurveIntersection(crv,bound,1)
        if X!=None and len(X)>0: 
            T.append(rs.CurveClosestPoint(crv,X[0][1]))
            P.append(X[0][1])
    stt = sorted(T)[0]
    ent = sorted(T)[-1]
    trimmed_crv = rs.SplitCurve(crv,(stt,ent))[1]
    IDEAL.append(trimmed_crv)
    XPTS.append(P)

for crv in IDEAL:
    rs.ExtendCurveLength(crv,2,0,ext)
    rs.ExtendCurveLength(crv,2,1,ext)

# create evaliation points
max_eval_dist = 15
for crv,pts in zip(IDEAL,XPTS):
    epts = []
    epts.extend(pts)
    T = []
    for pt in pts: T.append(rs.CurveClosestPoint(crv,pt))
    segs = rs.SplitCurve(crv,T,False)
    for seg in segs:
        seglen = rs.CurveLength(seg)
        if seglen>15:
            n = 1+int(seglen/max_eval_dist)
            divpts = rs.DivideCurve(seg,n)
            divpts.pop(0)
            divpts.pop()
            epts.extend(divpts)
    EPTS.append(epts)

XPTS = raggedListToDataTree(XPTS)
EPTS = raggedListToDataTree(EPTS)
# ---------- end trim_ext_curves ----------

# ---- group: MATCHING
# MATHCING / ASSIGNING
ideal_crvs = Curve(trim_ext_curves.IDEAL)
xpts_pts = Point(trim_ext_curves.XPTS)
epts_pts = Point(trim_ext_curves.EPTS)
match = PythonScript(IDEAL=ideal_crvs, XPTS=xpts_pts, EPTS=epts_pts, BRANCH=branch_data)  # -> REPOS_REAL, UNTRIMMED, DIFF; inputs IDEAL: list, XPTS: tree of Point3d, EPTS: tree, BRANCH: tree; disabled
# ---------- match: Python ----------
import rhinoscriptsyntax as rs
import Rhino.Geometry as rg
from clr import AddReference as addr
addr("Grasshopper")
from System import Object
from Grasshopper import DataTree
from Grasshopper.Kernel.Data import GH_Path

def dataTreeToList(aTree):
    theList = []
    for i in range(aTree.BranchCount ):
        thisListPart = []
        thisBranch = aTree.Branch(i)
        for j in range(len(thisBranch)):
            thisListPart.append( thisBranch[j] )
        theList.append(thisListPart)
    return theList

def raggedListToDataTree(raggedList):
    rl = raggedList
    result = DataTree[object]()
    for i in range(len(rl)):
        temp = []
        for j in range(len(rl[i])):
            temp.append(rl[i][j])
        #print i, " - ",temp
        path = GH_Path(i)
        result.AddRange(temp, path)
    return result

def plane_points(pln):
    org = pln.Origin
    X = pln.XAxis
    Y = pln.YAxis
    pts = (org,org+X,org+Y)
    return pts

def get_norm_params_relative_midpoint(crv,pts):
    # Returns the normalized parameters of a list of points on a curve,
    # relative to the mid point of the curve
    T = []
    ref_pt = rs.CurveMidPoint(crv)
    t_ref = rs.CurveClosestPoint(crv,ref_pt)
    t_ref = rs.CurveNormalizedParameter(crv,t_ref)
    for pt in pts:
        t = rs.CurveClosestPoint(crv,pt)
        t = rs.CurveNormalizedParameter(crv,t)
        t = t - t_ref
        T.append(t)
    return(T)

def get_points_from_norm_params_relative_ref_point(crv,norm_rel_T,ref_pt):
    # Return the points on a curve, defined by a list of normalized parameters
    # and relative to a reference point
    pts = []
    t_ref = rs.CurveClosestPoint(crv,ref_pt)
    t_ref = rs.CurveNormalizedParameter(crv,t_ref)
    for norm_t in norm_rel_T:
        t = rs.CurveParameter(crv,norm_t+t_ref)
        pt = rs.EvaluateCurve(crv,t)
        pts.append(pt)
    return pts

def get_curve_ref_parameters(crv,target_len,interval):
    ref_T = []
    length = rs.CurveLength(crv)
    len_diff = length-target_len
    n = int(0.5+len_diff/interval)
    if n>0:
        st = rs.DivideCurveLength(crv,0.5*target_len)[1]
        st_t = rs.CurveClosestPoint(crv,st)
        en = rs.DivideCurveLength(crv,0.5*target_len+len_diff)[1]
        en_t = rs.CurveClosestPoint(crv,en)
        step = (en_t-st_t)/n
        for i in range(n+1):
            t = st_t+step*i
            ref_T.append(t)
        
    else:
        pt = rs.CurveMidPoint(crv)
        t = rs.CurveClosestPoint(crv,pt)
        ref_T.append(t)
    return ref_T

def get_refined_reference_parameters(crv,ref_t,target_len,dist,step):
    ref_T = []
    length = rs.CurveLength(crv)
    len_diff = length-target_len
    st = rs.DivideCurveLength(crv,0.5*target_len)[1]
    st_t = rs.CurveClosestPoint(crv,st)
    en = rs.DivideCurveLength(crv,0.5*target_len+len_diff)[1]
    en_t = rs.CurveClosestPoint(crv,en)
    #t should be between st_t and en_t
    #
    segs = rs.SplitCurve(crv,ref_t,False)
    rs.ReverseCurve(segs[0])
    p0 = rs.DivideCurveLength(segs[0],0.5*dist)[1]
    p1 = rs.DivideCurveLength(segs[1],0.5*dist)[1]
    t0 = rs.CurveClosestPoint(crv,p0)
    t1 = rs.CurveClosestPoint(crv,p1)
    if t0<st_t: t0 = st_t
    if t1<en_t: t1 = en_t
    seg = rs.SplitCurve(crv,(t0,t1),False)[1]
    pts = rs.DivideCurve(seg,int(0.5+dist/step))
    T = []
    for pt in pts: T.append(rs.CurveClosestPoint(crv,pt))
    return T


def curve_difference_lite(real,ideal,xpts):
    diff_joint_dist = curve_joint_dist_difference(real,ideal,xpts)
    diff = round(diff_joint_dist,3)
    return diff

def curve_joint_dist_difference(crv1,crv2,pts2):
    sum = 0
    for pt2 in pts2:
        t = rs.CurveClosestPoint(crv1,pt2)
        pt1 = rs.EvaluateCurve(crv1,t)
        dist = rs.Distance(pt1,pt2)
        sum = sum+dist
    average_diff = sum/len(pts2)
    return average_diff

def get_diffs(crvs,ideal,xpts):
    diffs = []
    for crv in crvs:
        diff = curve_difference_lite(crv,ideal,xpts)
        diffs.append(diff)
    return diffs

def trim_curve(crv_,ref_crv):
    crv = rs.CopyObject(crv_)
    st = rs.CurveStartPoint(ref_crv)
    st_t = rs.CurveClosestPoint(crv,st)
    en = rs.CurveEndPoint(ref_crv)
    en_t = rs.CurveClosestPoint(crv,en)
    if st_t>en_t: 
        st_t,en_t = en_t,st_t
    crv = rs.TrimCurve(crv,(st_t,en_t))
    return crv

def get_average_point(pts):
    x = 0
    y = 0
    z = 0
    for pt in pts:
        x = x + pt[0]
        y = y + pt[1]
        z = z + pt[2]
    x = x/len(pts)
    y = y/len(pts)
    z = z/len(pts)
    pt = rs.AddPoint(x,y,z)
    return pt

def get_average_direction(pts):
    if len(pts)==2:
        V = rs.VectorCreate(pts[1],pts[0])
    elif len(pts)==4:
        st = get_average_point((pts[0],pts[1]))
        en = get_average_point((pts[2],pts[3]))
        V = rs.VectorCreate(en,st)
    else: 
        V = None
        print 'error'
        print len(pts)
    return V

def get_plane_fit_to_curve(crv,org,n):
    pts = rs.DivideCurve(crv,n)
    pln = rs.PlaneFitFromPoints(pts)
    org = rs.coerce3dpoint(org)
    pln.Origin = org
    return pln

def get_plane_fit_to_segment_of_curve(crv,length_seg,ref_t,org,n):
    segs = rs.SplitCurve(crv,ref_t,False)
    if rs.CurveLength(segs[0])>0.5*length_seg:
        rs.ReverseCurve(segs[0])
        st = rs.DivideCurveLength(segs[0],0.5*length_seg)[1]
    else: st = rs.CurveStartPoint(segs[0])
    if rs.CurveLength(segs[1])>0.5*length_seg:
        en = rs.DivideCurveLength(segs[1],0.5*length_seg)[1]
    else: en = rs.CurveEndPoint(segs[1])
    ###
    start_t = rs.CurveClosestPoint(crv,st)
    end_t = rs.CurveClosestPoint(crv,en)
    step = (end_t-start_t)/(n-1)
    pts = []
    for i in range(n):
        t = start_t+step*i
        pt = rs.EvaluateCurve(crv,t)
        pts.append(pt)
    ### plane
    pln = rs.PlaneFitFromPoints(pts)
    org = rs.coerce3dpoint(org)
    pln.Origin = org
    return pln

XPTS = dataTreeToList(XPTS)
EPTS = dataTreeToList(EPTS)
BRANCH = dataTreeToList(BRANCH)

REAL = []
for branch in BRANCH: REAL.append(branch[1])

### Initialize output lists
REPOS_REAL = []
UNTRIMMED = []
DIFF = []

# test list
a = []
b = []

for i in range(len(IDEAL)):
    #
    ### Extract values for ideal curve
    #
    ideal = IDEAL[i]
    xpts = XPTS[i]
    epts = EPTS[i]
    #
    ### Calculate properties of ideal curve
    #
    dir_ideal = get_average_direction(xpts)
    ctr_ideal = get_average_point(xpts)
    pln_strong_ideal = get_plane_fit_to_curve(ideal,ctr_ideal,10)
    pln_Y = rs.VectorCrossProduct(dir_ideal,pln_strong_ideal.Normal)
    pln_ideal = rs.PlaneFromFrame(ctr_ideal,dir_ideal,pln_Y)
    tsx_ideal = get_norm_params_relative_midpoint(ideal,xpts)
    length_ideal = rs.CurveLength(ideal)
    #
    ### Initiate local lists to store each real branch at its best fitting pose
    ### and its difference to the ideal curve
    #
    repos_real = []
    diff_total = []
    untrimmed = []
    #
    ### Iterate all the real curves
    #
    for j in range(len(REAL)):
        real = rs.CopyObject(REAL[j])
        #
        ### Obmit real curve if it is shorter than the ideal one
        #
        length = rs.CurveLength(real)
        if length < length_ideal: 
            repos_real.append(None)
            diff_total.append(99)
            untrimmed.append(None)
            continue
        #
        ### Try  matching the real branch at different poses
        #
        ### First along length
        ### Create a series of "midpoints" at every about every 5 cm
        #
        temp_reals = []
        temp_pos_t = []
        temp_axis_dirs = []
        ref_T = get_curve_ref_parameters(real,length_ideal,5)
        for ref_t in ref_T:
            for xdir in range(2):
                xdir = 2*xdir-1
                if xdir < 0: # reverse curve
                    real_pts = rs.CurvePoints(real)
                    real_pts.reverse()
                    real_reversed = rs.AddCurve(real_pts)
                    crv = real_reversed
                else:
                    crv = real
                ref_pt = rs.EvaluateCurve(crv,ref_t)
                xpts_real = get_points_from_norm_params_relative_ref_point(crv,tsx_ideal,ref_pt)
                dir_real = get_average_direction(xpts_real)
                ctr_real = get_average_point(xpts_real)
                pln_strong_real = get_plane_fit_to_segment_of_curve(crv,length_ideal,ref_t,ctr_real,10)
                pln_Y = rs.VectorCrossProduct(dir_real,pln_strong_real.Normal)
                pln_real = rs.PlaneFromFrame(ctr_real,dir_real,pln_Y)
                for ydir in range(2):
                    ydir = 2*ydir-1
                    ### make ref_pln
                    O = pln_real.Origin
                    X = pln_real.XAxis 
                    Y = ydir * pln_real.YAxis
                    ref_pln = rs.PlaneFromFrame(O,X,Y)
                    ### orient
                    oriented_real = rs.OrientObject(real,plane_points(ref_pln),plane_points(pln_ideal),1)
                    temp_reals.append(oriented_real)
                    temp_pos_t.append(ref_t)
                    temp_axis_dirs.append((xdir,ydir))
        diffs = get_diffs(temp_reals,ideal,epts)
        diff = sorted(diffs)[0]
        best_real = [x for _,x in sorted(zip(diffs,temp_reals))][0]
        best_pos_t = [x for _,x in sorted(zip(diffs,temp_pos_t))][0]
        dirs = [x for _,x in sorted(zip(diffs,temp_axis_dirs))][0]
        #
        ### Refine at every 1 cm
        #
        ref_T = get_refined_reference_parameters(real,best_pos_t,length_ideal,6,1)
        temp_reals = []
        for ref_t in ref_T:
            xdir = dirs[0]
            ydir = dirs[1] 
            ###
            if xdir < 0: # reverse curve
                real_pts = rs.CurvePoints(real)
                real_pts.reverse()
                real_reversed = rs.AddCurve(real_pts)
                crv = real_reversed
            else:
                crv = real
            ref_pt = rs.EvaluateCurve(crv,ref_t)
            xpts_real = get_points_from_norm_params_relative_ref_point(crv,tsx_ideal,ref_pt)
            dir_real = get_average_direction(xpts_real)
            ctr_real = get_average_point(xpts_real)
            pln_strong_real = get_plane_fit_to_segment_of_curve(crv,length_ideal,ref_t,ctr_real,10)
            pln_Y = rs.VectorCrossProduct(dir_real,pln_strong_real.Normal)
            pln_real = rs.PlaneFromFrame(ctr_real,dir_real,pln_Y)
            ###
            ydir = 2*ydir-1
            ### make ref_pln
            O = pln_real.Origin
            X = pln_real.XAxis 
            Y = ydir * pln_real.YAxis
            ref_pln = rs.PlaneFromFrame(O,X,Y)
            ### orient
            oriented_real = rs.OrientObject(real,plane_points(ref_pln),plane_points(pln_ideal),1)
            temp_reals.append(oriented_real)
        diffs = get_diffs(temp_reals,ideal,xpts)
        diff = sorted(diffs)[0]
        best_real = [x for _,x in sorted(zip(diffs,temp_reals))][0]
        #
        # Append final lists
        #
        untrimmed.append(best_real)
        repos_real.append(trim_curve(best_real,ideal))
        diff_total.append(diff)
    REPOS_REAL.append(repos_real)
    UNTRIMMED.append(untrimmed)
    DIFF.append(diff_total)
REPOS_REAL = raggedListToDataTree(REPOS_REAL)
UNTRIMMED = raggedListToDataTree(UNTRIMMED)
DIFF = raggedListToDataTree(DIFF)
# ---------- end match ----------
assign = PythonScript(DIFF_TOTAL=match.DIFF)  # -> indices; inputs DIFF_TOTAL: tree
# ---------- assign: Python ----------
import rhinoscriptsyntax as rs
import Rhino.Geometry as rg
import rhinoscriptsyntax as rs
import Rhino.Geometry as rg
from clr import AddReference as addr
addr("Grasshopper")
from System import Object
from Grasshopper import DataTree
from Grasshopper.Kernel.Data import GH_Path


def get_maximum_assignements(list):
    ind = [None] * len(list)          # Create an initial list of "Nons"
    for i in range(len(list)):        # Browse list of possible column matches (list_of_zeros)
        for j in range(len(list[i])): # Brows possible column matches for each row
            item = list[i][j]
            if already_exists(ind,item)==False: # Check if item already exists in list if assigned column indexes
                ind[i] = item                   # If it doesnt, assign this posibility to the row
                break                           # And break
        if ind[i] == None:                  # If no match was found yet for this row
            for j in range(len(list[i])):   # Browse possibilities again
                item = list[i][j]           
                (ind,free) = try_reassigning(ind,[item],list,0) # Try to geassign the possibility where it already exists in the list
                if free == True:            # If reassignment was successfull, 
                    ind[i] = item           # assign possibility to the current row
                    break                   # and break
    return ind  # return list of assigned columns

def try_reassigning(ass_list,visited_col_indexes,poss_list,n): 
    if n>len(ass_list):                     # If n is higher than "safetly limit" for recusion function, 
        print "Ended early"     # 
        return (ass_list,False) # return that reassignment was unsuccessful (false)
    else:
        col_index = visited_col_indexes[-1]               # The index we are looking at currently is the last one added to the list of visited indexes
        other_row = get_index_in_list(ass_list,col_index) # Find the row of the column index you are trying to free up
        other_row_poss_list = poss_list[other_row]        # Get the list of possibilities for this row
        if len(other_row_poss_list)<=1:                   # If the possibilities are just one, it is impossible to reassign
            #print "Ended because ran into list of just one possibility"   
            return (ass_list,False)                       # return that reassignment was unsuccessful (false)
        else:           # Else we have a list of several possibilities, so we can try other ones
            n = n+1     # Add value to your safety number, so that you wont go in endless loops
            success = False
            for poss in other_row_poss_list:             # The possibilities for this row
                if poss==col_index: continue             # If it is same as the one already assigned, move on immediately
                if already_exists(ass_list,poss)==False: # Check if the possibility already exists elsewhere among assignments
                    ass_list[other_row] = poss           # If not, reassign!
                    #print "Reassignment success!!!!!!!!!!!!!!!!!!!!!!!!!!!!!!!!!!!!!!!!!!!!!!!!!!!!!!!!!!!"
                    success = True                       # Recoded that reassignemnt was successful
                    break                                # And exit loop
            if success == False:                                    # If reassignment still wasn't successful...
                for poss in other_row_poss_list:                    # Browse the possibilities again
                    if poss==col_index: continue                    # If it is same as the one already assigned, move on immediately               
                    #print "***Doing a recursion***"                 # Do a recusstion, trying to reassign the value to freeup the one you are trying to reassign
                    if already_exists(visited_col_indexes,poss)==False: # Avoid looping in recursion
                        visited_col_indexes.append(poss)
                        (ass_list,success) = try_reassigning(ass_list,visited_col_indexes,poss_list,n)
                        if success == True:                             # If this reassignment is successful
                            #print "***Did a successful recursion***"          
                            ass_list[other_row] = poss                  # Assign the new possibility to the other row 
                            break                                       # Exit loop
                    #else: 
                    #    print "Didnt continue recursion because of loop"
            return (ass_list,success)                               # Return (possibly) updated assignment list and weather or not the operation was successful

def dataTreeToList(aTree):
    theList = []
    for i in range(aTree.BranchCount ):
        thisListPart = []
        thisBranch = aTree.Branch(i)
        for j in range(len(thisBranch)):
            thisListPart.append( thisBranch[j] )
        theList.append(thisListPart)
    return theList

def get_list_of_all_zeros(matrix):
    zeros = [None] * len(matrix)
    for i in range(len(matrix)):
        row_zeros = []
        for j in range(len(matrix[i])):
            if matrix[i][j]==0.00:
                row_zeros.append(j)
        zeros[i] = row_zeros
    return zeros

def get_unssigned_rows(list):
    non_items = []
    for i in range(len(list)):
        if list[i]==None:
            non_items.append(i)
    return non_items

def invert_mark(list,list_length):
    unmarked = []
    for i in range(list_length):
        marked = False
        for mark in list:
            if i==mark:
                marked = True
                break
        if marked == False:
            unmarked.append(i)
    return unmarked

def already_exists(list,item):
    exists = False
    for item2 in list:
        if item == item2:
            exists = True
            break
    return exists

def get_index_in_list(list,value):
    index = None
    for i in range(len(list)):
        if list[i]==value: index = i
    return index

def make_square(matrix):
    row_no = len(matrix)
    col_no = len(matrix[0])
    # Add rows if number of columns is greater than number of rows
    if row_no<col_no:
        zero_row = []
        add_no = col_no-row_no
        for i in range(col_no): zero_row.append(0)
        for i in range(add_no): matrix.append(zero_row)
    # Make matrix square by adding dummy zeros
    # Add columns if number of columns is smaller than number of rows
    if row_no>col_no:
        zero_col = []
        add_no = row_no-col_no
        for i in range(len(matrix)):
            for j in range(add_no): 
                matrix[i].append(0)
    return matrix

mat = dataTreeToList(DIFF_TOTAL)

# Make matrix square by adding dummy zeros
# Store original size in order to revert to it at the end
org_row_no = len(mat)
org_col_no = len(mat[0])
mat = make_square(mat)
print "Size",len(mat),len(mat[0])

### Make integer (for faster calculation) ###
for i in range(len(mat)):
    for j in range(len(mat[i])):
        mat[i][j] = int(10*mat[i][j]+0.5)
#print "Start matrix", mat

### Subtract minimum value in each row (should result in at least one 0 in each row) ###
for i in range(len(mat)):
    min_value = sorted(mat[i])[0]
    for j in range(len(mat[i])): mat[i][j] = mat[i][j]-min_value

### Subtract minimum value in each col (should result in at least one 0 in each col) ###
for j in range(len(mat[0])):
    temp = []
    for i in range(len(mat)):
        temp.append(mat[i][j])
    min_value = sorted(temp)[0]
    if min_value==0: continue
    for i in range(len(mat)):
        mat[i][j] = mat[i][j]-min_value
#print "Matrix after initial subtractions", mat

for iterantion0 in range(len(mat)*len(mat[0])):
    print " - - - - - - - - - - I T E R A T I O N   ",iterantion0,"    - - - - - - - - - - "
    #
    ### Try to assign one column to each row ###
    #
    zeros_list = get_list_of_all_zeros(mat)
    #print "Zeros", zeros_list
    indices = get_maximum_assignements(zeros_list)
    print "Indices:",indices
    unass = get_unssigned_rows(indices)
    # 
    ### Break if there are no unassigned columns ###
    #
    if len(unass)==0:
        print "Done!"
        break
    ### Mark rows and columns ###
    #
    #1. Tick all unassigned rows
    #
    marked_rows = unass
    marked_columns = []
    for mark_iteration in range(len(mat)):
        #
        # 2. Tick all (unticked) columns that have zeros in ticked rows
        #
        start_len_cols = len(marked_columns)
        for row_index in marked_rows:
            #find zeros in this row
            for j in range(len(mat[0])):
                if mat[row_index][j]==0:
                    # Check that it is not already added to marked columns
                    new = True
                    for mark in marked_columns:
                        if mark==j:
                            new = False
                            break
                    if new == True: marked_columns.append(j)
        marked_columns = sorted(marked_columns)
        #print "Marked cols at",mark_iteration,"are",marked_columns
        #
        # 3. Tick all (unticked) rows that have assigned zeros in ticked columns
        #
        start_len_rows = len(marked_rows)
        for col_index in marked_columns:
            # Find zeros in the column
            for i in range(len(indices)):
                index = indices[i]
                if col_index == index:
                    new = True
                    for mark in marked_rows:
                        if mark == i:
                            new = False
                            break
                    if new==True: marked_rows.append(i)
        marked_rows = sorted(marked_rows)
        #print "Marked rows at",mark_iteration,"are",marked_rows
        # Break if no items were added to columns or rows at this iteration
        if start_len_rows==len(marked_rows) and start_len_cols==len(marked_columns):
            print "Marking done at iteration:", mark_iteration
            break
    marked_rows = invert_mark(marked_rows,len(mat))
    print "Marked rows", marked_rows
    print "Marked colmuns", marked_columns
    #
    ### Find the smallest value in unmarked columns and unmarked rows ###
    #
    unmarked_items = []
    for i in range(len(mat)):
        marked = False
        for mark in marked_rows:
            if i == mark:
                marked = True
                break
        if marked == True: continue
        for j in range(len(mat[i])):
            marked = False
            for mark in marked_columns:
                if j == mark:
                    marked = True
                    break
            if marked == True: continue
            unmarked_items.append(mat[i][j])
    if len(unmarked_items)==0: 
        print "***Break because all items are marked"
        break
    lowest_value = min(unmarked_items)
    print "Lowest value:", lowest_value
    if lowest_value == 0: 
        print "****Break because lowest_value was zero"
        break
    #
    ### Subtract the lowest value from all unmarked elements ###
    ### and add it to all double-marked elements             ###
    #
    for i in range(len(mat)):
        #check for marked row
        marked_row = False
        for mark in marked_rows:
            if i == mark:
                marked_row = True
        for j in range(len(mat[i])):
            marked_col = False
            for mark in marked_columns:
                if j == mark:
                    marked_col = True
            if marked_row==False and marked_col==False:
                mat[i][j] = mat[i][j]-lowest_value
            elif marked_row==True and marked_col==True:
                mat[i][j] = mat[i][j]+lowest_value
    #print "New mat",mat


### Remove padded part of matrix ###
#
# 1. Remove rows if number of initial rows were smaller
#
if org_row_no<len(mat):
    for i in range(len(mat)-org_row_no):
        indices.pop()
#
# Or 2. Remove columns if number of initial columns was smaller
#
if org_col_no<len(mat[0]):
    for i in range(len(indices)):
        if indices[i]>=org_col_no:
            indices[i]=None

#Finally print result!
print "Result:",indices
# ---------- end assign ----------
avr = Average(Input=flatten(match.DIFF))
panel_6 = Panel(avr)
pick = PythonScript(branch=branch_data, repos=match.REPOS_REAL, indices=assign)  # -> branch_assigned, repos_assigned, untrimmed_assigned; inputs branch: tree, repos: tree, indices: list
# ---------- pick: Python ----------
import rhinoscriptsyntax as rs
import Rhino.Geometry as rg
from clr import AddReference as addr
addr("Grasshopper")
from System import Object
from Grasshopper import DataTree
from Grasshopper.Kernel.Data import GH_Path

def dataTreeToList(aTree):
    theList = []
    for i in range(aTree.BranchCount ):
        thisListPart = []
        thisBranch = aTree.Branch(i)
        for j in range(len(thisBranch)):
            thisListPart.append( thisBranch[j] )
        theList.append(thisListPart)
    return theList

def raggedListToDataTree(raggedList):
    rl = raggedList
    result = DataTree[object]()
    for i in range(len(rl)):
        temp = []
        for j in range(len(rl[i])):
            temp.append(rl[i][j])
        #print i, " - ",temp
        path = GH_Path(i)
        result.AddRange(temp, path)
    return result

repos = dataTreeToList(repos)
repos_assigned = []
for crvs,i in zip(repos,indices):
    if i!=None:
        repos_assigned.append(crvs[i])
# ---------- end pick ----------

# ---- group: OPTIMIZATION
xpts_pts_2 = Point(xpts_pts)
timer = Timer(TimerInterval=20, Target=sim)  # disabled
sim = PythonScript(
    crvs=pick.repos_assigned,
    XPTS=xpts_pts_2,
    force=Slider(0.1, range=0..0.2),
    slide_len=Slider(4, range=0..10),
    reset=Button(),
    ext=Slider(2, range=0..10))  # -> out, L, L2, rL, rL2, C, P, segsP; inputs crvs: list, XPTS: tree of Point3d
# ---------- sim: Python ----------
import rhinoscriptsyntax as rs
import scriptcontext as sc
import math
import Rhino.Geometry as rg
from clr import AddReference as addr
addr("Grasshopper")
from System import Object
from Grasshopper import DataTree
from Grasshopper.Kernel.Data import GH_Path

def dataTreeToList(aTree):
    theList = []
    for i in range(aTree.BranchCount ):
        thisListPart = []
        thisBranch = aTree.Branch(i)
        for j in range(len(thisBranch)):
            thisListPart.append( thisBranch[j] )
        theList.append(thisListPart)
    return theList

def raggedListToDataTree(raggedList):
    rl = raggedList
    result = DataTree[object]()
    for i in range(len(rl)):
        temp = []
        for j in range(len(rl[i])):
            temp.append(rl[i][j])
        #print i, " - ",temp
        path = GH_Path(i)
        result.AddRange(temp, path)
    return result

def get2pts(pts,crv):  
    # If there are 4 key points (xpts) of the target curve,
    # this funtions returns the two average points of each 
    # pair of points. Else if there are already just 2 points,
    # like for an edge element, it just gives back the 2 points.
    if len(pts)==2:   
        pts2 = pts    
    elif len(pts)==4: 
        p0 = 0.5*rs.PointAdd(pts[0],pts[1])
        t = rs.CurveClosestPoint(crv,p0)
        p0 = rs.EvaluateCurve(crv,t)
        p1 = 0.5*rs.PointAdd(pts[2],pts[3])
        t = rs.CurveClosestPoint(crv,p1)
        p1 = rs.EvaluateCurve(crv,t)
        pts2 = [p0,p1]
    else:
        pts2 = None
        print "error"
    return pts2

def get_average_point(pts):  
    x = 0
    y = 0
    z = 0
    for pt in pts:
        x = x+pt[0]
        y = y+pt[1]
        z = z+pt[2]
    x = x/len(pts)
    y = y/len(pts)
    z = z/len(pts)
    pt = rs.AddPoint(x,y,z)
    #pt = rs.coerce3dpoint(pt)
    return pt

def get_curve(pts):
    pts2 = []
    for pt in pts:
        pt = sc.doc.Objects.AddPoint(pt)
        pts2.append(pt)
    crv = rs.AddCurve(pts2)
    return crv

def get_segments(pair_pts):
    segs = []
    for pair in pair_pts:
        pt0 = sc.doc.Objects.AddPoint(pair[0])
        pt1 = sc.doc.Objects.AddPoint(pair[1])
        line = rs.AddLine(pt0,pt1)
        segs.append(line)
    return segs

def get_point_and_tan(curve,point):
    t = rs.CurveClosestPoint(curve,point)
    point = rs.EvaluateCurve(curve,t)
    tan = rs.CurveTangent(curve,t)
    tan = rs.VectorUnitize(tan)
    return point,tan

def get_tan(curve,point):
    t = rs.CurveClosestPoint(curve,point)
    tan = rs.CurveTangent(curve,t)
    tan = rs.VectorUnitize(tan)
    return tan

def closest_point(curve,point):
    t = rs.CurveClosestPoint(curve,point)
    closest_point = rs.EvaluateCurve(curve,t)
    return closest_point

def vector_angle_negpos(vec1,vec2,pln):
    ang = rs.VectorAngle(vec1,vec2)
    cross = rs.VectorCrossProduct(vec1,vec2)
    test_ang = rs.VectorAngle(cross,pln.ZAxis)
    if test_ang>90: ang = -ang
    return ang

def angle_in_plane(pt1,pt2,pln):
    pt1 = rs.PlaneClosestPoint(pln,pt1)
    pt2 = rs.PlaneClosestPoint(pln,pt2)
    vec1 = rs.VectorUnitize(rs.VectorCreate(pln.Origin,pt1))
    vec2 = rs.VectorUnitize(rs.VectorCreate(pln.Origin,pt2))
    ang = vector_angle_negpos(vec1,vec2,pln)
    return ang

def get_average_vec(vecs):
    average_vec = rs.VectorCreate((0,0,0),(0,0,0))
    for vec in vecs: average_vec = average_vec+vec
    average_vec = average_vec/len(vecs)
    return average_vec

def get_average_ang(angs):
    average_ang = 0
    for ang in angs: average_ang = average_ang+ang
    if len(angs)>0: average_ang = average_ang/len(angs)
    return average_ang

XPTS = dataTreeToList(XPTS)

#initialize
if reset or 'crv_pts' not in globals():
    count = 0
    crv_pts = []
    crv_pair_pts = []
    for crv,xpts in zip(crvs,XPTS):
        ## get curve points
        pts = rs.CurvePoints(crv)
        pts = rs.coerce3dpointlist(pts)
        crv_pts.append(pts)
        ## get curve pair points
        temp = []
        for xpt in xpts:
            crv_short = rs.CopyObject(crv)
            rs.ExtendCurveLength(crv_short,0,0,-ext)
            rs.ExtendCurveLength(crv_short,0,1,-ext)
            pt,vec = get_point_and_tan(crv_short,xpt)
            vec = 0.5*slide_len*vec
            vec = rs.AddPoint(vec[0],vec[1],vec[2])
            # start
            p0 = rs.PointSubtract(pt,vec)
            p0 = closest_point(crv_short,p0)
            # end
            p1 = rs.PointAdd(pt,vec)
            p1 = closest_point(crv_short,p1)
            # convert to rhino geometry
            p0 = rs.coerce3dpoint(p0)
            p1 = rs.coerce3dpoint(p1)
            # append
            temp.append((p0,p1))
        crv_pair_pts.append(temp)

count = count+1
print count

C = []
P = []

L = []
L2 = []

segsP = []

crv_pts2 = []
crv_pair_pts2 = []

for i in range(len(crv_pts)):
    crv = get_curve(crv_pts[i])
    xpts = XPTS[i]
    xsegs = get_segments(crv_pair_pts[i])
    #
    ctr_of_mass = get_average_point(crv_pts[i])
    X = (1,0,0)
    Y = (0,1,0)
    Z = (0,0,1)
    pln = rs.PlaneFromFrame(ctr_of_mass,X,Y)
    pln2 = rs.PlaneFromFrame(ctr_of_mass,X,Z)
    pln3 = rs.PlaneFromFrame(ctr_of_mass,Y,Z)
    #
    vecs = []
    angs = []
    angs2 = []
    angs3 = []
    for j in range(len(crv_pts)):
        if i==j: continue
        xpts2 = XPTS[j]
        xsegs2 = get_segments(crv_pair_pts[j])
        for pt,seg in zip(xpts,xsegs):
            for pt2,seg2 in zip(xpts2,xsegs2):
                dist = rs.Distance(pt,pt2)
                if dist>0.25: continue
                # intersection identified (should be)
                #
                crv2 = get_curve(crv_pts[j])
                xpt = rs.AddPoint(pt[0],pt[1],pt[2])
                X = rs.CurveCurveIntersection(seg,seg2,5)
                if X!=None and len(X)>0:
                    pt = X[0][1]
                    pt2 = X[0][3]
                else:
                    pt = closest_point(seg,pt)
                    pt2 = closest_point(seg2,pt2)
                # move towards other line
                vec = rs.VectorCreate(pt2,pt)
                vecs.append(vec)
                L.append(rs.AddLine(pt2,pt)) 
                # move towards ideal intersection point
                vec = rs.VectorCreate(xpt,pt)
                vecs.append(vec)
                L2.append(rs.AddLine(xpt,pt))
                # rotate 1 data (pln)
                ang = angle_in_plane(pt,pt2,pln)
                angs.append(ang)
                ang = angle_in_plane(pt,xpt,pln)
                angs.append(ang)
                # rotate 2 data (pln2)
                ang = angle_in_plane(pt,pt2,pln2)
                angs2.append(ang)
                ang = angle_in_plane(pt,xpt,pln2)
                angs2.append(ang)
                # roate 3 data (pln3 / normal)
                ang = angle_in_plane(pt,pt2,pln3)
                angs.append(ang)
                ang = angle_in_plane(pt,xpt,pln3)
                angs.append(ang)
                angs3.append(ang)
    # move
    move_vec = force*get_average_vec(vecs)
    rs.MoveObject(crv,move_vec)
    rs.MoveObjects(xsegs,move_vec)
    # rotate 1
    rot_ang = force*get_average_ang(angs)
    rs.RotateObject(crv,pln.Origin,rot_ang,pln.ZAxis)
    rs.RotateObjects(xsegs,pln.Origin,rot_ang,pln.ZAxis)
    # rotate 2
    rot_ang = force*get_average_ang(angs2)
    rs.RotateObject(crv,pln.Origin,rot_ang,pln2.ZAxis)
    rs.RotateObjects(xsegs,pln.Origin,rot_ang,pln2.ZAxis)
    # rotate 3 
    rot_ang = force*get_average_ang(angs3)
    rs.RotateObject(crv,pln.Origin,rot_ang,pln3.ZAxis)
    rs.RotateObjects(xsegs,pln.Origin,rot_ang,pln3.ZAxis)
    # format and append
    pts = rs.CurvePoints(crv)
    pts = rs.coerce3dpointlist(pts)
    crv_pts2.append(pts)
    pair_pts = []
    for xseg in xsegs:
        st = rs.CurveStartPoint(xseg)
        en = rs.CurveEndPoint(xseg)
        st = rs.coerce3dpoint(st)
        en = rs.coerce3dpoint(en) 
        pair_pts.append((st,en))
        segsP.extend((st,en))
    crv_pair_pts2.append(pair_pts)
    C.append(crv)
    P.append(rs.CurvePoints(crv))


crv_pts = crv_pts2
crv_pair_pts = crv_pair_pts2



P = raggedListToDataTree(P)
# ---------- end sim ----------
panel_7 = Panel(sim.out)
crv_6 = Curve(sim.C)
len = Length(Curve=sim.L)
len_2 = Length(Curve=sim.L2)
pipe_2 = Pipe(Curve=crv_6, Radius=Slider(2, range=0..10), Caps=1)
avr_2 = Average(Input=len)
panel_8 = Panel(avr_2)
avr_3 = Average(Input=len_2)
panel_9 = Panel(avr_3)

# ----
# JOINTS
orient_8 = Orient(Geometry=ctr_cut, Source=ref, Target=import.pln_jnt)  # -> Geometry, Transform
orient_9 = Orient(Geometry=side_1, Source=ref, Target=import.pln_jnt)  # -> Geometry, Transform
orient_10 = Orient(Geometry=side_2, Source=ref, Target=import.pln_jnt)  # -> Geometry, Transform
orient_11 = Orient(Geometry=jnt_pln, Source=ref, Target=import.pln_jnt)  # -> Geometry, Transform
corr_z = PythonScript(pln=orient_11.Geometry)  # -> pln
# ---------- corr_z: Python ----------
import rhinoscriptsyntax as rs

O = pln.Origin
X = pln.XAxis
Y = pln.YAxis

X = rs.AddPoint(X[0],X[1],0)
Y = rs.AddPoint(Y[0],Y[1],0)

X = rs.VectorCreate(X,(0,0,0))
Y = rs.VectorCreate(Y,(0,0,0))

X = rs.VectorUnitize(X)
Y = rs.VectorUnitize(Y)

pln = rs.PlaneFromFrame(O,X,Y)
# ---------- end corr_z ----------
orient_12 = Orient(Geometry=orient_9.Geometry, Source=orient_11.Geometry, Target=corr_z)  # -> Geometry, Transform
orient_13 = Orient(Geometry=orient_10.Geometry, Source=orient_11.Geometry, Target=corr_z)  # -> Geometry, Transform
orient_14 = Orient(Geometry=orient_8.Geometry, Source=orient_11.Geometry, Target=corr_z)  # -> Geometry, Transform

top = PythonScript(B=orient_6)  # -> skel_pts, skel_rads, max_z; inputs B: list
# ---------- top: Python ----------
import rhinoscriptsyntax as rs

def string_to_list(txt):
    lst = txt.split(',')
    for k in range(len(lst)):
        lst[k] = float(lst[k])
    return lst

pts = rs.DivideCurve(B[1],rs.CurvePointCount(B[1])-1)
rads = string_to_list(B[2])

max_z = -9999999

for pt,r in zip(pts,rads):
    z = pt[2]+r
    if z>max_z:
        max_z = z

skel_pts = pts
skel_rads = rads
# ---------- end top ----------
# MARKS CALIBRATION
calibration = PythonScript(org=origin_pt_milling_head_2, skel_pts=top.skel_pts, skel_rads=top.skel_rads, rads=loc_rads)  # -> st, en; inputs org: Point3d, skel_pts: list of Point3d, skel_rads: list, rads: list
# ---------- calibration: Python ----------
import rhinoscriptsyntax as rs

dist1 = rs.Distance(skel_pts[0],org)
dist2 = rs.Distance(skel_pts[-1],org)
if dist2<dist1: 
    skel_pts.reverse()
    skel_rads.reverse()
#add

st = rs.AddPoint(skel_pts[0][0],skel_pts[0][1],skel_pts[0][2]+skel_rads[0])
en = rs.AddPoint(skel_pts[-1][0],skel_pts[-1][1],skel_pts[-1][2]+skel_rads[-1])
# ---------- end calibration ----------
ln_2 = Line(StartPoint=calibration.st, EndPoint=calibration.en)
pln_5 = PythonScript(L=ln_2)  # -> P; same code as pln
python_3 = PythonScript(ref=pln_5, tar=pln, cal=calibrating)  # -> ref, tar
# ---------- python_3: Python ----------
if cal == True: tar = ref
# ---------- end python_3 ----------
orient_15 = PythonScript(branch=orient_6, REF=python_3.ref, TAR=python_3.tar)  # -> branch; inputs branch: tree, REF: list, TAR: list; same code as orient_4
geometry_5 = PythonScript(branch=orient_15)  # -> G, M, C; inputs branch: tree; same code as geometry_3
top_2 = PythonScript(B=orient_15)  # -> skel_pts, skel_rads, max_z; inputs B: list; same code as top
actual_pose_after_calibration_brep = Brep([geometry_5.G, geometry_5.C])
compose_path_cm = PythonScript(
    org=origin_pt_milling_head_2,
    skel_pts=top_2.skel_pts,
    skel_rads=top_2.skel_rads,
    rads=loc_rads,
    move_h=Slider(1, range=0..10),
    max_z=top_2.max_z,
    dia=mill_dia)  # -> P, S, PL; inputs org: Point3d, skel_pts: list of Point3d, skel_rads: list, rads: list
# ---------- compose_path_cm: Python ----------
import rhinoscriptsyntax as rs

pts = []
speeds = []

h = max_z+move_h
extra = 1 #0.5

moving = 800
cutting = 300
milling = 100

#adjust height
#pts.append(rs.AddPoint(org[0],org[1],org[2]))
#pts.append(rs.AddPoint(org[0],org[1],h))
#
# go to start point, go down low, follow skeleton,go up
#ensure efficient direction
dist1 = rs.Distance(skel_pts[0],org)
dist2 = rs.Distance(skel_pts[-1],org)
if dist2<dist1: 
    skel_pts.reverse()
    skel_rads.reverse()


### Adjust start and end not to collide with marker cube

# Modify start
p1 = skel_pts[0]
p1b = skel_pts[1]
vec = dia*rs.VectorUnitize(rs.VectorCreate(p1b,p1))
vec = rs.AddPoint(vec[0],vec[1],vec[2])
p1 = rs.PointAdd(p1,vec)

# Modify end
p2 = skel_pts[-1]
p2b = skel_pts[-2]
vec = dia*rs.VectorUnitize(rs.VectorCreate(p2b,p2))
vec = rs.AddPoint(vec[0],vec[1],vec[2])
p2 = rs.PointAdd(p2,vec)


### Add points and speeds

#Start
pts.append(rs.AddPoint(p1[0],p1[1],h))
speeds.append(moving)

pts.append(rs.AddPoint(p1[0],p1[1],p1[2]+skel_rads[0]+extra))
speeds.append(milling)

pts.append(rs.AddPoint(p1[0],p1[1],h))
speeds.append(moving)

# End
pts.append(rs.AddPoint(p2[0],p2[1],p2[2]+skel_rads[-1]+extra))
speeds.append(moving)

pts.append(rs.AddPoint(p2[0],p2[1],h))
speeds.append(milling)

### Make polyline
polyline = rs.AddPolyline(pts)

###

PL = polyline
P = pts
S = speeds
# ---------- end compose_path_cm ----------

# ----
# JOINT CALIBRATION
panel_10 = Panel("""17.1,
-41.95,
-2.79""")
num = Number(loc_rad)
Z_2 = UnitZ(Factor=num)
pt_4 = Point(panel_10)
addition_3 = Addition(A=origin_pt_milling_head, B=pt_4)
rev = Reverse(Vector=Z_2)
addition_4 = Addition(A=addition_3, B=rev)
pt_5 = Point(orient_11.Geometry)

calibrating_joint = BooleanToggle(False)

python_4 = PythonScript(pt1=pt_5, pt2=addition_4, jnt_cal=calibrating_joint)  # -> pt
# ---------- python_4: Python ----------
if jnt_cal == True: pt = pt1
else: pt = pt2
# ---------- end python_4 ----------
vec2pt = Vector2Pt(PointA=pt_5, PointB=python_4, Unitize=False)  # -> Vector, Length

move_5 = Move(Geometry=orient_14.Geometry, Motion=vec2pt.Vector)  # -> Geometry, Transform
move_6 = Move(Geometry=orient_13.Geometry, Motion=vec2pt.Vector)  # -> Geometry, Transform
move_7 = Move(Geometry=orient_12.Geometry, Motion=vec2pt.Vector)  # -> Geometry, Transform

compose_path_cm_2 = PythonScript(
    org=origin_pt_milling_head_2,
    ctr=python_4,
    rad=loc_rad,
    path1=move_7.Geometry,
    path2=move_6.Geometry,
    pathC=move_5.Geometry,
    move_h=Slider(0.5, range=0..1))  # -> P, S, PL; inputs org: Point3d, ctr: Point3d
# ---------- compose_path_cm_2: Python ----------
import rhinoscriptsyntax as rs

moving = 800
milling = 300
drilling = 100

pts = []
speeds = []

h = ctr[2]+rad+move_h
h_0 = ctr[2]+rad-0.2

pts1 = rs.CurvePoints(path1)
pts2 = rs.CurvePoints(path2)
pts3 = rs.CurvePoints(pathC)

### compose ###
#
# go to joint center point
pts.append(rs.AddPoint(ctr[0],ctr[1],h))
speeds.append(moving)
pts.append(rs.AddPoint(ctr[0],ctr[1],h_0))
speeds.append(drilling)
pts.append(rs.AddPoint(ctr[0],ctr[1],h))
speeds.append(moving)
#
# move over second sidecut
pts.append(rs.AddPoint(pts2[0][0],pts2[0][1],h))
speeds.append(moving)
for i in range(4):
    pts.append(pts2[i])
    speeds.append(milling)
pts.append(rs.AddPoint(pts2[3][0],pts2[3][1],h))
speeds.append(moving)
#
# go to start of p1, add path, move up
pts.append(rs.AddPoint(pts1[0][0],pts1[0][1],h))
speeds.append(moving)
pts.extend(pts1)
for pt in pts1: speeds.append(milling)
pts.append(rs.AddPoint(pts1[-1][0],pts1[-1][1],h))
speeds.append(moving)
#
# go to start of p2, add path, move up
pts.append(rs.AddPoint(pts2[0][0],pts2[0][1],h))
speeds.append(moving)
pts.extend(pts2)
for pt in pts2: speeds.append(milling)
pts.append(rs.AddPoint(pts2[-1][0],pts2[-1][1],h))
speeds.append(moving)
#
# go to start of p3, add path, move up
pts.append(rs.AddPoint(pts3[0][0],pts3[0][1],h))
speeds.append(moving)
pts.extend(pts3)
for pt in pts3: speeds.append(milling)
pts.append(rs.AddPoint(pts3[-1][0],pts3[-1][1],h))
speeds.append(moving)

###
polyline = rs.AddPolyline(pts)

PL = polyline
P = pts
S = speeds
# ---------- end compose_path_cm_2 ----------
crv_7 = Curve(compose_path_cm_2.PL)

# ----
# MARKS
orient_16 = Orient(Geometry=jnt_plns, Source=ref, Target=import.pln_mrk)  # -> Geometry, Transform
corr = PythonScript(pln=orient_16.Geometry)  # -> pln
# ---------- corr: Python ----------
import rhinoscriptsyntax as rs

O = pln.Origin
X = pln.XAxis
Y = pln.YAxis

X = (0,0,X[2])
X = rs.VectorUnitize(X)

pln = rs.PlaneFromFrame(O,X,Y)
# ---------- end corr ----------
rad_vec = PythonScript(P=corr, R=loc_rads)  # -> V
# ---------- rad_vec: Python ----------
import rhinoscriptsyntax as rs

z = P.Normal
V = z*R
# ---------- end rad_vec ----------
pt_6 = Point(orient_16.Geometry)
move_8 = Move(Geometry=pt_6, Motion=rad_vec)  # -> Geometry, Transform

orient_17 = Orient(Geometry=move_8.Geometry, Source=python_3.ref, Target=python_3.tar)  # -> Geometry, Transform

compose_path_cm_3 = PythonScript(
    org=origin_pt_milling_head_2,
    jnts=orient_17.Geometry,
    skel_pts=top_2.skel_pts,
    skel_rads=top_2.skel_rads,
    rads=loc_rads,
    move_h=Slider(1, range=0..10),
    max_z=top_2.max_z,
    dia=mill_dia)  # -> P, S, PL; inputs org: Point3d, jnts: list of Point3d, skel_pts: list of Point3d, skel_rads: list, rads: list
# ---------- compose_path_cm_3: Python ----------
import rhinoscriptsyntax as rs

moving = 800
milling = 300
drilling = 100

pts = []
speeds = []

h = max_z+move_h
extra = 1 #0.5

### Ensure efficient direction
dist1 = rs.Distance(skel_pts[0],org)
dist2 = rs.Distance(skel_pts[-1],org)
if dist2>dist1: 
    skel_pts.reverse()
    skel_rads.reverse()

### Adjust start/end points
p1 = skel_pts[0]
p1b = skel_pts[1]
vec = dia*rs.VectorUnitize(rs.VectorCreate(p1b,p1))
vec = rs.AddPoint(vec[0],vec[1],vec[2])
p1 = rs.PointAdd(p1,vec)
#
p2 = skel_pts[-1]
p2b = skel_pts[-2]
vec = dia*rs.VectorUnitize(rs.VectorCreate(p2b,p2))
vec = rs.AddPoint(vec[0],vec[1],vec[2])
p2 = rs.PointAdd(p2,vec)
#
skel_pts[0]=p1
skel_pts[-1]=p2

### Compose
#
# go to start point, go down low, follow skeleton,go up
pts.append(rs.AddPoint(skel_pts[0][0],skel_pts[0][1],h))
speeds.append(moving)
for i in range(len(skel_pts)):
    pt = skel_pts[i]
    r = skel_rads[i]
    pts.append(rs.AddPoint(pt[0],pt[1],pt[2]+r+extra))
    speeds.append(moving)
pts.append(rs.AddPoint(skel_pts[-1][0],skel_pts[-1][1],h))
speeds.append(moving)
#
# joint points
# ensure efficient direction
dist1 = rs.Distance(skel_pts[-1],jnts[0])
dist2 = rs.Distance(skel_pts[-1],jnts[-1])
if dist2<dist1: jnts.reverse()
# add
for jnt,rad in zip(jnts,rads):
    # go to joint point, move down, move up
    pts.append(rs.AddPoint(jnt[0],jnt[1],h))
    speeds.append(moving)
    #
    pts.append(rs.AddPoint(jnt[0],jnt[1],jnt[2]+rad))
    speeds.append(milling)
    #
    pts.append(rs.AddPoint(jnt[0],jnt[1],jnt[2]-rad+0.2))
    speeds.append(drilling)
    #
    pts.append(rs.AddPoint(jnt[0],jnt[1],h))
    speeds.append(moving)

polyline = rs.AddPolyline(pts)

PL = polyline
P = pts

S = speeds
# ---------- end compose_path_cm_3 ----------
crv_8 = Curve(compose_path_cm_3.PL)

# ----
# Exporting G-Code
select = PythonScript(
    P_cal=compose_path_cm.P,
    P_mark=compose_path_cm_3.P,
    P_joint=compose_path_cm_2.P,
    S_cal=compose_path_cm.S,
    S_mark=compose_path_cm_3.S,
    S_joint=compose_path_cm_2.S,
    cal=calibrating)  # -> P, S; inputs P_cal: list, P_mark: list, P_joint: list, S_cal: list, S_mark: list, S_joint: list
# ---------- select: Python ----------
if P_mark == None or len(P_mark)==0: 
    P = P_joint
    S = S_joint
else: 
    P = P_mark
    S = S_mark
if cal == True and len(P_joint)==0: 
    P = P_cal
    S = S_cal
# ---------- end select ----------
path_txt = Text(panel)
export_2 = Button()
join = TextJoin(Text=[path_txt, "\gcode"])
txt = Text("joint")
panel_11 = Panel(join)
export_g_code_mm = PythonScript(file_name=txt, path=panel_11, path_points=select.P, org=origin_pt_milling_head_2, speeds=select.S, Refresh=export_2)  # -> a; inputs path_points: list of Point3d, org: Point3d, speeds: list
# ---------- export_g_code_mm: Python ----------
import rhinoscriptsyntax as rs


d = 3 # =precision / no of decimals to write
file = open(str(path)+'\\'+str(file_name)+".gcode","w")
###initialization
file.write("%\n")
file.write("G90(Absolute [G91 is incremental])\n") 
file.write("G21(set unit[mm])\n") 
file.write("G54\n") 
file.write("F1000.0S6000 (Feeding 2000mm/min, Spindle 6000rpm)\n") 
file.write("G17(set XY plane for circle path)\n") 
file.write("M03 (spindle start)\n") 
###content
x_ = str(9999999999)
y_ = str(9999999999)
z_ = str(9999999999)
for pt,speed in zip(path_points,speeds):
    #move point relative to local origin
    pt = rs.PointSubtract(pt,org)
    #convert from cm to mm
    x = str(round(10*pt[0],d))
    y = str(round(10*pt[1],d))
    z = str(round(10*pt[2],d))
    if x_!=x or y_!=y: file.write("G01 X "+x+" Y "+y+" F "+str(speed)+"\n")
    if z_!=z: file.write("G01 Z "+z+" F "+str(speed)+"\n")
    x_ = x
    y_ = y
    z_ = z
###end
file.write("M05 (Spindle stop)\n") 
file.write("M02(end of program)\n") 
file.write("%\n") 
file.close()
# ---------- end export_g_code_mm ----------
import_3 = Button()
import_g_code = PythonScript(file=txt, path=panel_11, org=origin_pt_milling_head_2, refresh=export_g_code_mm, refresh2=import_3)  # -> cut_path; inputs org: Point3d
# ---------- import_g_code: Python ----------
import rhinoscriptsyntax as rs
import Rhino as rc


print "Importing..."
file = open(str(path)+'\\'+str(file)+".gcode","r")
lines = file.readlines()
pts = []
x = 0
y = 0
z = 0
for line in lines:
    items = line.split(" ") 
    if items!=None and items[0] == "G01":
        for i in range(1,len(items)):
            item = items[i]
            if item=="X": x = 0.1*float(items[i+1])
            if item=="Y": y = 0.1*float(items[i+1])
            if item=="Z": z = 0.1*float(items[i+1])
        pt = rs.AddPoint(x,y,z)
        pts.append(pt)
cut_path = rs.AddPolyline(pts)
rs.MoveObject(cut_path,org)
file.close()
# ---------- end import_g_code ----------

# ==== cluster Cluster
F = ClusterInput()
A = ClusterInput()
P = ClusterInput()
F_2 = ClusterInput()
A_2 = ClusterInput()
Z = UnitZ(Factor=F)
division = Division(A=A, B=2)
cir = Circle(Plane=P, Radius=division)
Z_2 = UnitZ(Factor=F_2)
addition = Addition(A=A_2, B=Z_2)
rectangle = Rectangle(Plane=addition, XSize=Domain(-3.5, 3.5), YSize=Domain(-3.5, 3.5), Radius=0)  # -> Rectangle, Length
extr = Extrude(Base=rectangle.Rectangle, Direction=Z)
cap = CapHoles(Brep=extr)
extr_2 = Extrude(Base=cir, Direction=Z_2)
B = ClusterOutput(cap)
E = ClusterOutput(extr_2)

# ==== cluster ExtSrf
number_slider = Slider(20, range=0..200)
number_slider_2 = Slider(1, range=0..1)
number_slider_3 = Slider(20, range=0..200)
number_slider_4 = Slider(50, range=0..100)
S = ClusterInput()
divide_s = PythonScript(S=S, U=number_slider_4, V=number_slider_4)  # -> simplify(pts); inputs S: Surface
# ---------- divide_s: Python ----------
import rhinoscriptsyntax as rs

import Rhino.Geometry as rg
from clr import AddReference as addr
addr("Grasshopper")

from System import Object
from Grasshopper import DataTree
from Grasshopper.Kernel.Data import GH_Path


def raggedListToDataTree(raggedList):
    rl = raggedList
    result = DataTree[object]()
    for i in range(len(rl)):
        temp = []
        for j in range(len(rl[i])):
            temp.append(rl[i][j])
        #print i, " - ",temp
        path = GH_Path(i)
        result.AddRange(temp, path)
    return result



u_step = 1.00/U
v_step = 1.00/V

U = int(U)
V = int(V)

# Creat grid of points on surface
pts = []
for i in range(U+1):
    u_ = u_step * i
    temp = []
    for j in range(V+1):
        v_ = v_step * j
        (u,v) = rs.SurfaceParameter(S,(u_,v_))
        pt = rs.EvaluateSurface(S, u, v,)
        temp.append(pt)
    pts.append(temp)

# Make division equidistance
pts = zip(*pts)
for i in range(len(pts)):
    crv = rs.AddInterpCrvOnSrf(S,pts[i])
    pts[i] = rs.DivideCurve(crv,U)
    pts[i].append(rs.CurveEndPoint(crv))
pts = zip(*pts)
for i in range(len(pts)):
    crv = rs.AddInterpCrvOnSrf(S,pts[i])
    pts[i] = rs.DivideCurve(crv,V)
    pts[i].append(rs.CurveEndPoint(crv))


pts = raggedListToDataTree(pts)
# ---------- end divide_s ----------
nurbs = NurbsCurve(Vertices=divide_s, Degree=3, Periodic=False)  # -> flatten(Curve), Length, Domain
ext = ExtendCurve(Curve=nurbs.Curve, Type=0, Start=number_slider, End=number_slider)  # -> flatten(Curve)
divide = DivideCurve(Curve=ext, Count=number_slider_4, Kinks=False)  # -> Points, Tangents, Parameters
flip = FlipMatrix(Data=divide.Points)
nurbs_2 = NurbsCurve(Vertices=flip, Degree=3, Periodic=False)  # -> flatten(Curve), Length, Domain
ext_2 = ExtendCurve(Curve=nurbs_2.Curve, Type=0, Start=number_slider_3, End=number_slider_3)  # -> flatten(Curve)
divide_2 = DivideCurve(Curve=ext_2, Count=number_slider_4, Kinks=False)  # -> Points, Tangents, Parameters
nurbs_3 = NurbsCurve(Vertices=divide_2.Points, Degree=3, Periodic=False)  # -> flatten(Curve), Length, Domain
loft = Loft(Curves=nurbs_3.Curve, Options={Adjust=False, Closed=False, LoftEnds=0, LoftSimp=0, LoftType=0, Rebuild=10, Refit=0.01})
L = ClusterOutput(loft)
