# Grasshopper definition branchIO.gh (Grasshopper 1.0.7)
# plug-ins: BranchConnect

Z = UnitZ(Factor=1)

# ---- group: Run MeshLabServer
button = Button()

# ---- group: Python Interpreter Path
# [ Dependencies ]
# 
# - Python 2.7
#    - Open3D
#    - NumPy
path = FilePath("C:\Users\katak\AppData\Local\conda\conda\envs\rhinoremote\python.exe")

# ---- group: Ply Files Folder Path
path_2 = FilePath("C:\Users\katak\Projects\BranchConnect\MeshProcessing\input\")

# ---- group: Meshlab
toobj = PlyToObj(On=button, Path=path_2, Py=path)

# ----
# This component run external
# python script (that run meshlabserver).
# 
# And run rhino as administrator.
tomesh = ObjToMesh(Obj=toobj)  # -> Vertices, Faces, Colours
construct_mesh = ConstructMesh(Vertices=tomesh.Vertices, Faces=tomesh.Faces, Colours=tomesh.Colours)  # -> flatten(Mesh)
scale = Scale(Geometry=construct_mesh, Center=Point(0, 0, 0), Factor=Slider(100, range=0..1000))  # -> Geometry, Transform

mesh = Mesh(scale.Geometry)
contour = Contour(Shape=mesh, Point=Point(13, -20, 0), Direction=Z, Distance=Slider(0.5, range=0..1))  # -> simplify(Contours)
pshift = ShiftPaths(Data=contour, Offset=-1)

# ---- group: For Statement
lng = ListLength(List=mesh)
timer = Timer(TimerInterval=500, Target=c_script)  # disabled
c_script = CSharpScript(x=Button(), y=lng)  # -> out, A; inputs x: Boolean, y: Int32
# ---------- c_script: C# ----------
    if(x == true)
    {
      flag = true;
      counter = 0;
    }
    if( flag == true){
      counter = counter + 1;
      Print("counting");
      A = counter;
    }else{

      A = counter;
      Print("Stop");
    }

    if(counter >= y)
    {
      flag = false;
      // counter = 0;
    }
# ---------- c_script: C# additional code ----------
  int counter;
  bool flag = false;
# ---------- end c_script ----------

# ----
area = Area(Geometry=pshift)  # -> Area, Centroid
panel = Panel(lng)
c_script_2 = CSharpScript(y=area.Area)  # -> B, A; inputs y: list of Double
# ---------- c_script_2: C# ----------
    max = 0;
    num = 0;
    for(int i = 0; i < y.Count; i++)
    {
      if(y[i] > max)
      {
        max = y[i];
        num = i;
      }
    }

    A = max; 
    B = num;
# ---------- c_script_2: C# additional code ----------
  double max = 0;
  int num = 0;
# ---------- end c_script_2 ----------
item = ListItem(List=pshift, Index=c_script_2.B, Wrap=True)
panel_2 = Panel(c_script.A)
item_2 = ListItem(List=flatten(item), Index=c_script.A, Wrap=True)
divide = DivideCurve(Curve=item_2, Count=Slider(42, range=0..60), Kinks=False)  # -> flatten(Points), Tangents, Parameters
boundary = BoundarySurfaces(Edges=item_2)
voronoi = Voronoi(Points=divide.Points, BruteForceOverride=False)
explode = Explode(Curve=voronoi, Recursive=True)  # -> flatten(Segments), Vertices
end = EndPoints(Curve=graft(explode.Segments))  # -> Start, End
brep_cp = BrepClosestPoint(Point=[end.Start, end.End], Brep=boundary)  # -> Point, Normal, Distance
ma = MassAddition(Input=brep_cp.Distance)  # -> Result, PartialResults
smaller = SmallerThan(FirstNumber=ma.Result, SecondNumber="0.01")  # -> flatten(SmallerThan), OrEqualTo
cull = CullPattern(List=explode.Segments, CullPattern=smaller.SmallerThan)
eval = EvaluateLength(Curve=cull, Length="0.5", Normalized=True)  # -> Point, Tangent, Parameter
cullpt = CullDuplicates(Points=eval.Point, Tolerance=0.1, CullMode=1)  # -> Points, Indices, Valence
item_3 = ListItem(List=cull, Index=cullpt.Indices, Wrap=True)
join = JoinCurves(Curves=item_3, Preserve=False)
pcol = PolylineCollapse(Polyline=join, Tolerance=Slider(0.373, range=0..10))  # -> Polyline, Count
len = Length(Curve=pcol.Polyline)
c_script_3 = CSharpScript(y=len)  # -> B, A; inputs y: list of Double
# ---------- c_script_3: C# ----------
    max = 0;
    num = 0;
    for(int i = 0; i < y.Count; i++)
    {
      if(y[i] > max)
      {
        max = y[i];
        num = i;
      }
    }

    A = max;
    B = num;
# ---------- c_script_3: C# additional code ----------
  double max = 0;
  int num = 0;
# ---------- end c_script_3 ----------
item_4 = ListItem(List=pcol.Polyline, Index=c_script_3.B, Wrap=True)
disc = Discontinuity(Curve=item_4, Level=1)  # -> Points, Parameters
nurbs = NurbsCurve(Vertices=disc.Points, Degree=Slider(8, range=0..10), Periodic=False)  # -> Curve, Length, Domain
pipe = Pipe(Curve=nurbs.Curve, Radius=0.1, Caps=0)
preview = CustomPreview(Geometry=pipe, Material=ColourSwatch(SwatchColor=RGBA(0, 128, 250, 84)))

# ---- group: For Statement
c_script_4 = CSharpScript(x=nurbs.Curve, clear=Button())  # -> out, simplify(A); inputs x: Curve, clear: Boolean
# ---------- c_script_4: C# ----------
    foreach(Curve cc in C)
    {
      if(Rhino.Geometry.GeometryBase.GeometryEquals(cc, x))
      {
        flag = false;
      }
    }

    if(flag)
    {
      C.Add(x);
    }


    if(clear)
    {
      C.Clear();
    }
    flag = true;

    A = C;
# ---------- c_script_4: C# additional code ----------
  List<Curve> C = new List<Curve>();
  bool flag = true;
# ---------- end c_script_4 ----------

# ----
panel_3 = Panel(c_script_4.A)
crv = Curve([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])
corr_skeleton = PythonScript(skel_2d=c_script_4.A, mesh=mesh, ext=Slider(-4, range=-4..4))  # -> skel_3d, skel_pts, radii, aver_r
# ---------- corr_skeleton: Python ----------
import rhinoscriptsyntax as rs
import Rhino.Geometry as rg

def projectPointToMesh(pt,mesh):
    pt1 = None
    ptX = rs.ProjectPointToMesh(pt,mesh,(0,0,1))
    if ptX!=None and len(ptX)==1: 
        pt1 = ptX[0]
    elif ptX!=None and len(ptX)>1:
        pts_list = []
        for x in ptX: pts_list.append(x)
        pts_list.sort(key=getZ)
        pt1 = pts_list[-1]
    else:
        print "error - no point projection found"
    return pt1

def averagePoint(p1,p2):
    x = 0.5*p1[0]+0.5*p2[0]
    y = 0.5*p1[1]+0.5*p2[1]
    z = 0.5*p1[2]+0.5*p2[2]
    p = rs.AddPoint(x,y,z)
    return p

def getZ(point):
    return point[2]

def polyline_to_curve(pl):
    crv = rg.Polyline.ToNurbsCurve(pl)
    return crv


###

crv = skel_2d

### variables inside

step = 4
lower_z_limit = 1.5


###
skel_pts = []
radii = []


a = []

###
length = rs.CurveLength(crv)
n = int(0.5+length/step)
rs.ExtendCurveLength(crv,0,0,ext)
rs.ExtendCurveLength(crv,0,1,ext)
pts = rs.DivideCurve(crv,n)
new_pts = []
for pt in pts:
    t = rs.CurveClosestPoint(crv,pt)
    tan = rs.CurveTangent(crv,t)
    tan = rs.VectorUnitize(tan)
    pt_up = projectPointToMesh(pt,mesh)
    r = None
    if pt_up!=None:
        p_start = rs.AddPoint(pt[0],pt[1],lower_z_limit)
        p_end = rs.AddPoint(pt_up[0],pt_up[1],pt_up[2]-lower_z_limit)
        line = rs.AddLine(p_start,p_end)
        n = int(rs.Distance(p_start,p_end)/0.2)+1
        zpts = rs.DivideCurve(line,n)
        if zpts!=None and len(zpts)>0:
            R = []
            P = []
            for zpt in zpts:
                pln = rs.PlaneFromNormal(zpt,(0,0,1),tan)
                rect = rs.AddRectangle(pln,2,10)
                rs.MoveObject(rect,-1*tan)
                rect2 = rs.CopyObject(rect,-10*pln.YAxis)
                param = rg.MeshingParameters()
                rect = rg.Mesh.CreateFromPlanarBoundary(rs.coercecurve(rect),param)
                rect2 = rg.Mesh.CreateFromPlanarBoundary(rs.coercecurve(rect2),param)
                crv1 = rs.MeshMeshIntersection(mesh,rect)
                crv2 = rs.MeshMeshIntersection(mesh,rect2)
                if crv1!=None and crv2!=None:
                    crv1 = polyline_to_curve(crv1[0])
                    crv2 = polyline_to_curve(crv2[0])
                    t = rs.CurveClosestPoint(crv1,zpt)
                    pt1 = rs.EvaluateCurve(crv1,t)
                    t = rs.CurveClosestPoint(crv2,zpt)
                    pt2 = rs.EvaluateCurve(crv2,t)
                    r = 0.5*rs.Distance(pt1,pt2)
                    R.append(r)
                    new_pt = rs.CurveMidPoint(rs.AddLine(pt1,pt2))
                    P.append(new_pt)
            R = sorted(R)
            P = [x for _,x in sorted(zip(R,P))]
            if len(R)>0: r = R[-1]
            else: r = 2.2
            if len(P)>0: pt = P[-1]
            else: pt =zpt
        else:
            print "error with zpts"
            a.append(line)
    new_pts.append(pt)
    radii.append(r)

r_sum = 0
count = 0
for r in radii:
    if r!=None:
        r_sum = r_sum+r
        count = count+1
average_r = r_sum/count

for i in range(len(radii)):
    if radii[i] == None:
        radii[i] = average_r

for i in range(len(new_pts)):
    pt = new_pts[i]
    pt_up = projectPointToMesh(pt,mesh)
    if pt_up!=None:
        zpt = rs.AddPoint(0,0,-radii[i])
        pt = rs.PointAdd(zpt,pt_up)
        new_pts[i] = pt

### extend
crv = rs.AddCurve(new_pts)
crv = rs.ExtendCurveLength(crv,0,0,-ext)
crv = rs.ExtendCurveLength(crv,0,1,-ext)
st = rs.CurveStartPoint(crv)
en = rs.CurveEndPoint(crv)
new_pts.append(en)
new_pts.insert(0,st)
radii.append(radii[-1])
radii.insert(0,radii[0])



###
skel_3d = rs.AddCurve(new_pts,3)

skel_pts = new_pts

aver_r = average_r
# ---------- end corr_skeleton ----------
av_col = PythonScript(M=mesh)  # -> RGB; inputs M: list
# ---------- av_col: Python ----------
import rhinoscriptsyntax as rs
import math
import Rhino.Geometry as rg
from clr import AddReference as addr
addr("Grasshopper")
from System import Object
from Grasshopper import DataTree
from Grasshopper.Kernel.Data import GH_Path


RGB = []

for mesh in M:
    colors = rs.MeshVertexColors(mesh)
    R = 0
    G = 0
    B = 0
    for col in colors:
        R = R + col.R
        G = G + col.G
        B = B + col.B
    R = R/len(colors)
    G = G/len(colors)
    B = B/len(colors)
    RGB.append((int(R),int(G),int(B)))

RBG = RGB
# ---------- end av_col ----------
number_slider = Slider(10, range=0..10)
geometry = PythonScript(S=corr_skeleton.skel_3d, R=corr_skeleton.radii, C=av_col)  # -> M; inputs S: list, R: tree, C: list
# ---------- geometry: Python ----------
import rhinoscriptsyntax as rs
import math
import Rhino.Geometry as rg
from clr import AddReference as addr
addr("Grasshopper")
from System import Object
from Grasshopper import DataTree
from Grasshopper.Kernel.Data import GH_Path


def dataTreeToList(aTree):
    theList = []
    for i in range(aTree.BranchCount ):
        thisListPart = []
        thisBranch = aTree.Branch(i)
        for j in range(len(thisBranch)):
            thisListPart.append( thisBranch[j] )
        theList.append(thisListPart)
    return theList

def raggedListToDataTree(raggedList):
    rl = raggedList
    result = DataTree[object]()
    for i in range(len(rl)):
        temp = []
        for j in range(len(rl[i])):
            temp.append(rl[i][j])
        #print i, " - ",temp
        path = GH_Path(i)
        result.AddRange(temp, path)
    return result

def string_to_list(txt):
    lst = txt.split(',')
    for k in range(len(lst)):
        lst[k] = float(lst[k])
    return lst

R = dataTreeToList(R)
#[name(0),points(1),radii(2),pose(3),ids(4),color(5)]

M = []

for crv,rad,col in zip(S,R,C):
    pts = rs.CurvePoints(crv)
    pts = rs.DivideCurve(crv,len(pts)-1)
    #
    profiles = []
    #
    for i in range(len(pts)):
        pt = pts[i]
        r = rad[i]
        t = rs.CurveClosestPoint(crv,pt)
        #if i == len(pts)-1: t = rs.CurveClosestPoint(crv,pts[i-1])
        tan = rs.CurveTangent(crv,t)
        X = rs.VectorCrossProduct((0,0,1),tan)
        pln = rs.PlaneFromNormal(pt,tan,X)
        circle = rs.AddCircle(pln,r)
        profiles.append(circle)
    geo = rs.AddLoftSrf(profiles)[0]
    rs.CapPlanarHoles(geo)
    mesh = rg.Mesh.CreateFromBrep(rs.coercebrep(geo))
    mesh = rs.JoinMeshes(mesh)
    colors = []
    for i in range(rs.MeshVertexCount(mesh)):
        colors.append(col)
    rs.MeshVertexColors(mesh,colors)
    #
    M.append(mesh)
# ---------- end geometry ----------
mesh_2 = Mesh(geometry)
item_5 = ListItem(List=flatten(item), Index=number_slider, Wrap=True)

# ---- group: Skeleton
item_6 = ListItem(List=corr_skeleton.skel_3d, Index=number_slider, Wrap=True)

# ----
original_mesh = ListItem(List=mesh, Index=number_slider, Wrap=True)

# ---- group: Average Color Mesh
item_7 = ListItem(List=mesh_2, Index=number_slider, Wrap=True)
